# Grasshopper definition #132 Level marks on plan.gh (Grasshopper 1.0.7)
# plug-ins: Grasshopper-Tekla drawing Link 2.25, Grasshopper-Tekla Link 2026.1.21

drawing_object = DrawingObject(null)
panel = Panel(drawing_object)
drawing_to_model_object = DrawingToModelObject(DrawingPart=drawing_object)
father_view = FatherView(DrawingObject=drawing_object)
convert_to_brep = ConvertToBrep(TeklaObject=drawing_to_model_object, SolidType=2, ToleranceMm=0.6)
view_properties = ViewProperties(View=father_view)  # -> Type, Name, ViewCS, DisplayCS, RestrictionBox, Scale, Tags
simple_orient = SimpleOrient(Geometry=convert_to_brep, Plane=view_properties.DisplayCS)

# ---- group: Search for flat face's centers
deconstruct_brep = DeconstructBrep(Brep=simple_orient)  # -> Faces, Edges, Vertices
face_normals = FaceNormals(Mesh=deconstruct_brep.Faces)  # -> Centers, Normals
unit_z = UnitZ(Factor=1)
list_item = ListItem(List=face_normals.Normals, Index=0, Wrap=True)  # -> flatten(Item)
dot_product = DotProduct(VectorA=list_item, VectorB=unit_z, Unitize=False)
larger_than = LargerThan(FirstNumber=dot_product, SecondNumber="0.99")  # -> LargerThan, OrEqualTo
dispatch = Dispatch(List=deconstruct_brep.Faces, DispatchPattern=larger_than.LargerThan)  # -> ListA, ListB
surface_points = SurfacePoints(Surface=dispatch.ListA)  # -> Points, Weights, Greville, UCount, VCount
polyline = PolyLine(Vertices=surface_points.Points, Closed=True)
polygon_center = PolygonCenter(Polyline=polyline)  # -> CenterV, CenterE, CenterA
list_item_2 = ListItem(List=polygon_center.CenterV, Index=0, Wrap=True)  # -> flatten(Item)

# ---- group: Naive way to find out top-most face and others
deconstruct = Deconstruct(Point=list_item_2)  # -> XComponent, YComponent, ZComponent
sort_list = SortList(Keys=deconstruct.ZComponent, ValuesValuesA=list_item_2)  # -> Keys, ValuesValuesA
reverse_list = ReverseList(List=sort_list.ValuesValuesA)
split_list = SplitList(List=reverse_list, Index="1")  # -> ListA, ListB

# ---- group: Some way to measure offset from top face to current one
deconstruct_2 = Deconstruct(Point=split_list.ListB)  # -> XComponent, YComponent, ZComponent
deconstruct_3 = Deconstruct(Point=split_list.ListA)  # -> XComponent, YComponent, ZComponent
subtraction = Subtraction(A=deconstruct_3.ZComponent, B=deconstruct_2.ZComponent)
format = Format(Format="-{0}", Culture=127, Data0=subtraction)

# ----
leader_type = AutoValueList({"NoLeaderLine": 0, "LeaderLine": 1, "AlongLine": 2, "BaseLine": 3}, selected="LeaderLine")
move = Move(Geometry=split_list.ListB, Motion="{200,400,0}")  # -> Geometry, Transform

# ---- group: Not working in plan views :/
level_mark = LevelMark(
    View=father_view,
    BasePoint=split_list.ListB,
    InsertionPoint=move.Geometry,
    MarkAttributes="standard",
    Remove_when_input_is_empty=False)  # disabled

# ----
placing_type = PlacingType(LeaderType=leader_type, StartPoint=split_list.ListB)
text_attributes = TextAttributes()
text = Text(
    View=father_view,
    Text=format,
    InsertionPoint=move.Geometry,
    PlacingType=placing_type,
    TextAttributes=text_attributes,
    Remove_when_input_is_empty=False)
