# Grasshopper definition 2026 Connected Construction Day Tallinn Estonia.gh (Grasshopper 1.0.8)
# plug-ins: Grasshopper-Tekla Link 2025.1.21, Grasshopper-Tekla drawing Link 2.24, Wombat

# Delivery
boolean_toggle = BooleanToggle(True)
model_object = ModelObject(
    ModelID="2025_Sample Office Building.db1",
    ModelObjectInfos=["Tekla.Structures.Model.Assembly, Tekla.Structures.Model, Version=2025.0.0.0, Culture=neutral, PublicKeyToken=2f04dbe497b71114;4efac5d4-0002-0561-3133-323530363130", "Tekla.Structures.Model.Assembly, Tekla.Structures.Model, Version=2025.0.0.0, Culture=neutral, PublicKeyToken=2f04dbe497b71114;4f0ea108-0000-1347-3133-323633363730", "Tekla.Structures.Model.Assembly, Tekla.Structures.Model, Version=2025.0.0.0, Culture=neutral, PublicKeyToken=2f04dbe497b71114;4efac5d4-0002-05b1-3133-323530363130", "Tekla.Structures.Model.Assembly, Tekla.Structures.Model, Version=2025.0.0.0, Culture=neutral, PublicKeyToken=2f04dbe497b71114;4efac5d4-0002-0565-3133-323530363130", "Tekla.Structures.Model.Assembly, Tekla.Structures.Model, Version=2025.0.0.0, Culture=neutral, PublicKeyToken=2f04dbe497b71114;4f0ea108-0000-12eb-3133-323633363730", "Tekla.Structures.Model.Assembly, Tekla.Structures.Model, Version=2025.0.0.0, Culture=neutral, PublicKeyToken=2f04dbe497b71114;4efac5d4-0002-05d9-3133-323530363130"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])

# ---- group: Connect to the existing drawing
# View repositioning
# 2025_Sample office building
# DEFAULT Environment
boolean_toggle_2 = BooleanToggle(False)
active_drawing = ActiveDrawing(Toggle=boolean_toggle_2)

# Rebar section with lifter
boolean_toggle_3 = BooleanToggle(True)
active_drawing_2 = ActiveDrawing(Toggle=boolean_toggle_3)

# ----
tekla_line = TeklaLine(null, TeklaLines="40000;3.5527136788005E-14;-4.9737991503207E-14;40000;9000;-4.9737991503207E-14")
# Truss dimensions
boolean_toggle_4 = BooleanToggle(False)
# GA for steel warehouse
model_object_2 = ModelObject(
    [null x35],
    ModelObjectInfos=["Tekla.Structures.Model.Assembly, Tekla.Structures.Model, Version=2025.0.0.0, Culture=neutral, PublicKeyToken=2f04dbe497b71114;96925399-c6f5-4ee7-94e2-b55148dde227", "Tekla.Structures.Model.Assembly, Tekla.Structures.Model, Version=2025.0.0.0, Culture=neutral, PublicKeyToken=2f04dbe497b71114;6281a182-d5d7-433f-a734-4b52eb0a46a1", "Tekla.Structures.Model.Assembly, Tekla.Structures.Model, Version=2025.0.0.0, Culture=neutral, PublicKeyToken=2f04dbe497b71114;bd39ff5b-f451-49ed-b395-bbcf4c09e1ef", "Tekla.Structures.Model.Assembly, Tekla.Structures.Model, Version=2025.0.0.0, Culture=neutral, PublicKeyToken=2f04dbe497b71114;c0df7bc6-5832-43c5-9993-f9c534d250ff", "Tekla.Structures.Model.Assembly, Tekla.Structures.Model, Version=2025.0.0.0, Culture=neutral, PublicKeyToken=2f04dbe497b71114;5e342cd0-0807-4fba-bd37-aa2d1e725299", "Tekla.Structures.Model.Assembly, Tekla.Structures.Model, Version=2025.0.0.0, Culture=neutral, PublicKeyToken=2f04dbe497b71114;f0e326a7-a66b-4b50-9700-6876330d4762"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])
drawing_object_types = DrawingObjectTypes({"Arc", "Bolt", "Circle", "Cloud", "Connection", "Container View", "Detail Mark", "Dwg Object", "Edge Chamfer", "Grid"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}, selected="Part")
# Create GA drawing
boolean_toggle_5 = BooleanToggle(True)
# Modify part mark
boolean_toggle_6 = BooleanToggle(False)
null_item = NullItem(Item=model_object)  # -> NullFlags, InvalidFlags, Description
drawing_object_types_2 = DrawingObjectTypes({"Arc", "Bolt", "Circle", "Cloud", "Connection", "Container View", "Detail Mark", "Dwg Object", "Edge Chamfer", "Grid"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}, selected="Reinforcement Group")
drawing_object_types_3 = DrawingObjectTypes({"Arc", "Bolt", "Circle", "Cloud", "Connection", "Container View", "Detail Mark", "Dwg Object", "Edge Chamfer", "Grid"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}, selected="Reinforcement Single")
active_drawing_3 = ActiveDrawing(Toggle=boolean_toggle_4)
selected_model_objects = SelectedModelObjects(Toggle=boolean_toggle_5)
list_item = ListItem(List=null_item.NullFlags, Index=0, Wrap=True)
selected_objects = SelectedObjects(Toggle=boolean_toggle_6)
unit_z = UnitZ(Factor=1)
end_points = EndPoints(Curve=tekla_line)  # -> Start, End
part_view_types = PartViewTypes({"Front": "FrontView", "Top": "TopView", "Back": "BackView", "Bottom": "BottomView", "3d": "_3DView"}, selected="Front")
views_in_drawing = ViewsInDrawing(Drawing=active_drawing_2, All_objects=0)
gate_and = GateAnd(A=boolean_toggle, B=invert(list_item))
model_object_3 = ModelObject(selected_model_objects)
cross_product = CrossProduct(VectorA=tekla_line, VectorB=unit_z, Unitize=False)  # -> Vector, Length
drawing_source = DrawingSource(Drawing=active_drawing_2)
drawing_source_2 = DrawingSource(Drawing=active_drawing_3)

# ---- group: Query existing views
views_in_drawing_2 = ViewsInDrawing(Drawing=active_drawing, All_objects=0)
view_properties = ViewProperties(View=views_in_drawing_2)  # -> Type, Name, ViewCS, DisplayCS, RestrictionBox, Scale, Tags
view_names = Panel(view_properties.Name)
view_tags = Panel(view_properties.Tags)
view_types = Panel(view_properties.Type)

# ----
related_objects = RelatedObjects(DrawingObject=selected_objects)  # -> DrawingObject, Keys
search_using_key = SearchUsingKey(Values=model_object_3, Keys=model_object_3, Search="Assembly")
list_item_2 = ListItem(List=selected_objects, Index=0, Wrap=True)
drawing_to_model_object = DrawingToModelObject(DrawingPart=selected_objects)
view_properties_2 = ViewProperties(View=views_in_drawing)  # -> Type, Name, ViewCS, DisplayCS, RestrictionBox, Scale, Tags
dispatch = Dispatch(List=model_object, DispatchPattern=gate_and)  # -> ListA, ListB
negative = Negative(Value=cross_product.Vector)
part_view = PartView(
    Drawing=active_drawing_3,
    Type=part_view_types,
    Point="{340,300,0}",
    AttributesName="Front Without Dimensions",
    Attributes_by_macro=False,
    Remove_when_input_is_empty=False)
construct_date = ConstructDate(Year=2026, Month=5, Day=1, Hour=12, Minute=0, Second=0)
deconstruct_assembly = DeconstructAssembly(Assembly=drawing_source, ToleranceMm=0.6)  # -> Name, Type, MainPart, Secondaries, AllObjects
deconstruct_assembly_2 = DeconstructAssembly(Assembly=drawing_source_2, ToleranceMm=0.6)  # -> Name, Type, MainPart, Secondaries, AllObjects
father_view = FatherView(DrawingObject=list_item_2)
deconstruct_assembly_3 = DeconstructAssembly(Assembly=search_using_key, ToleranceMm=0.6)  # -> Name, Type, MainPart, Secondaries, AllObjects
uda_name = Panel("PRODUCT_DESCR")
convert_to_mesh = ConvertToMesh(TeklaObject=selected_model_objects, SolidType=2, ToleranceMm=0.6)  # disabled
separator = Panel("{0}-{1:d2}-{2:d2}")
x_axis = Vector(tekla_line)
y_axis = Vector(negative)
search_using_key_2 = SearchUsingKey(Values=related_objects.DrawingObject, Keys=related_objects.Keys, Search="Mark")
get_cog = GetCOG(GravityObject=drawing_to_model_object)
deconstruct_date = DeconstructDate(Date=construct_date)  # -> Year, Month, Day, Hour, Minute, Second
search_using_key_3 = SearchUsingKey(Values=views_in_drawing, Keys=view_properties_2.Type, Search="BottomView")
search_using_key_4 = SearchUsingKey(Values=dispatch.ListA, Keys=dispatch.ListA, Search="Assembly")
construct_plane = ConstructPlane(Origin=end_points.Start, XAxis=tekla_line, YAxis=negative)
part_lines = PartLines(ModelObject=deconstruct_assembly_3.MainPart, Skip_cuts_and_fittings=0)  # -> RefLine, CenterLine
group_objects = GroupObjects(ModelObject=deconstruct_assembly.Secondaries, Property=uda_name, Group_by_Assembly_Position=8)  # -> ModelObject, Keys
view_properties_3 = ViewProperties(View=father_view)  # -> Type, Name, ViewCS, DisplayCS, RestrictionBox, Scale, Tags
convert_to_brep = ConvertToBrep(TeklaObject=deconstruct_assembly_2.MainPart, SolidType=2, ToleranceMm=0.6)
convert_to_brep_2 = ConvertToBrep(TeklaObject=deconstruct_assembly_2.Secondaries, SolidType=2, ToleranceMm=0.6)
unit_z_2 = UnitZ(Factor=1)
flatten_tree = FlattenTree(Tree=convert_to_mesh, Path="{0}")  # disabled
file_path = FilePath("C:\temp\Sample Delivery\")
format = Format(Format=separator, Culture=127, Data0=deconstruct_date.Year, Data1=deconstruct_date.Month, Data2=deconstruct_date.Day)
search_using_key_5 = SearchUsingKey(Values=deconstruct_assembly.AllObjects, Keys=deconstruct_assembly.AllObjects, Search="Rebar Group")
list_item_3 = ListItem(List=search_using_key_3, Index=0, Wrap=True)
flatten_tree_2 = FlattenTree(Tree=search_using_key_2, Path="{0}")
phrase_to_look_for = Panel("Kulank.")
model_object_4 = ModelObject(search_using_key_4)
panel = Panel(file_path)

# ---- group: Filter needed view
search_using_key_6 = SearchUsingKey(Values=views_in_drawing_2, Keys=view_properties.Type, Search="_3DView")

# ----
bounding_box = BoundingBox(Content=flatten_tree, Plane=PlaneXY(0, 0, 0), UnionBox=True)  # -> Box, Box_2; disabled
get_property = GetProperty(TeklaObject=model_object_4, Name="ASSEMBLY_NAME", PropertyType=0, ValueType=0, ToleranceMm=0.6)
panel_2 = Panel(format)
flatten_tree_3 = FlattenTree(Tree=convert_to_brep_2, Path="{0}")
group_objects_2 = GroupObjects(ModelObject=model_object_2, Group_by_Assembly_Position=2)  # -> ModelObject, Keys
dot_product = DotProduct(VectorA=part_lines.RefLine, VectorB=unit_z_2, Unitize=True)
panel_3 = Panel("""COLUMN
BEAM
PANEL""")
match_text = MatchText(Text=group_objects.Keys, RegEx=phrase_to_look_for, Case=True)
uda_values = Panel(group_objects.Keys)
construct_plane_2 = ConstructPlane(Origin=end_points.Start, XAxis=tekla_line, YAxis=negative)
simple_orient = SimpleOrient(Geometry=get_cog, Plane=view_properties_3.DisplayCS)
view_properties_4 = ViewProperties(View=list_item_3)  # -> Type, Name, ViewCS, DisplayCS, RestrictionBox, Scale, Tags
group_objects_3 = GroupObjects(ModelObject=search_using_key_5, Property="SHAPE_INTERNAL", Group_by_Assembly_Position=16)  # -> ModelObject, Keys
panel_4 = Panel("100")  # disabled
stirrup_shape = Panel("14")
inflate_box = InflateBox(Box=bounding_box.Box, Amount=panel_4)  # disabled
negative_2 = Negative(Value=y_axis)
dispatch_2 = Dispatch(List=group_objects.ModelObject, DispatchPattern=match_text)  # -> ListA, ListB
match_result = Panel(match_text)
tekla_bounding_box = TeklaBoundingBox(TeklaObject=model_object_2, Plane=construct_plane_2, SolidType=2, CreateUnionBox=True, ToleranceMm=0.6)
absolute = Absolute(Value=dot_product)
concatenate = Concatenate(Fragment_A=panel, Fragment_B=panel_2, A="\")
stirrup_shape_2 = Panel("14")
negative_3 = Negative(Value=x_axis)
viewing_direction = ViewingDirection({"From Left": {1,0,0}, "From Right": {-1,0,0}, "From Bottom": {0,1,0}, "From Top": {0,-1,0}}, selected="From Bottom")
stirrup_shape_3 = Panel("14")
modify_mark = ModifyMark(Mark=flatten_tree_2, InsertionPoint=simple_orient)
stirrup_shape_4 = Panel("1")
viewing_direction_2 = ViewingDirection({"From Left": {1,0,0}, "From Right": {-1,0,0}, "From Bottom": {0,1,0}, "From Top": {0,-1,0}}, selected="From Right")
search_using_key_7 = SearchUsingKey(Values=model_object_4, Keys=get_property, Search=panel_3)

# ---- group: Movie 3D view to center
view_frame_geometry = ViewFrameGeometry(View=search_using_key_6)  # -> UpperLeft, UpperRight, LowerLeft, LowerRight, Rectangle, Width, Height, Origin
polygon_center = PolygonCenter(Polyline=view_frame_geometry.Rectangle)  # -> CenterV, CenterE, CenterA
target = Panel("{640,460,0}")
subtraction = Subtraction(A=target, B=polygon_center.CenterA)
move_view = MoveView(View=search_using_key_6, Vector=subtraction)

# ----
null_item_2 = NullItem(Item=inflate_box)  # -> NullFlags, InvalidFlags, Description; disabled

# ---- group: Roof plan
search_using_key_8 = SearchUsingKey(Values=group_objects_2.ModelObject, Keys=group_objects_2.Keys, Search="TOP CHORD")
tekla_bounding_box_2 = TeklaBoundingBox(TeklaObject=search_using_key_8, Plane=construct_plane, SolidType=2, CreateUnionBox=True, ToleranceMm=0.6)

# ---- group: Foundation plan
search_using_key_9 = SearchUsingKey(Values=group_objects_2.ModelObject, Keys=group_objects_2.Keys, Search="PAD-FOOTING")
tekla_bounding_box_3 = TeklaBoundingBox(TeklaObject=search_using_key_9, Plane=construct_plane, SolidType=2, CreateUnionBox=True, ToleranceMm=0.6)

# ----
xy_plane = XYPlane(Origin=Point(0, 0, 0))  # disabled
xy_plane_2 = XYPlane(Origin=Point(0, 0, 0))  # disabled
xz_plane = XZPlane(Origin=Point(0, 0, 0))  # disabled
search_using_key_10 = SearchUsingKey(Values=group_objects_3.ModelObject, Keys=group_objects_3.Keys, Search=stirrup_shape_2)
unit_z_3 = UnitZ(Factor=1)
unit_z_4 = UnitZ(Factor=1)
unit_z_5 = UnitZ(Factor=1)
unit_z_6 = UnitZ(Factor=1)
larger_than = LargerThan(FirstNumber=absolute, SecondNumber="0.99")  # -> LargerThan, OrEqualTo
inflate_box_2 = InflateBox(Box=tekla_bounding_box, Amount="1500")
view_name = Panel("Top view")  # disabled
view_name_2 = Panel("Front view")  # disabled
viewing_direction_3 = ViewingDirection({"From Left": {1,0,0}, "From Right": {-1,0,0}, "From Bottom": {0,1,0}, "From Top": {0,-1,0}}, selected="From Top")
viewing_direction_4 = ViewingDirection({"From Left": {1,0,0}, "From Right": {-1,0,0}, "From Bottom": {0,1,0}, "From Top": {0,-1,0}}, selected="From Left")
clean_tree = CleanTree(RemoveNulls=True, RemoveInvalid=True, RemoveEmpty=True, Tree=dispatch_2.ListA)
view_properties_5 = ViewProperties(View=part_view)  # -> Type, Name, ViewCS, DisplayCS, RestrictionBox, Scale, Tags
part_view_types_2 = PartViewTypes({"Front": "FrontView", "Top": "TopView", "Back": "BackView", "Bottom": "BottomView", "3d": "_3DView"}, selected="Front")

# ---- group: Each material plays by its own rules
model_object_5 = ModelObject(search_using_key_7)
get_property_2 = GetProperty(TeklaObject=model_object_5, Name="MATERIAL_TYPE", PropertyType=0, ValueType=0, ToleranceMm=0.6)
search_using_key_11 = SearchUsingKey(Values=model_object_5, Keys=get_property_2, Search="CONCRETE")
search_using_key_12 = SearchUsingKey(Values=model_object_5, Keys=get_property_2, Search="STEEL")

# ----
gate_not = GateNot(A=null_item_2.NullFlags)  # disabled
truss_tower = Panel("standard")  # disabled
attributes = Panel("standard")  # disabled
model_view = ModelView(Name=view_name, ViewCS=xy_plane, DisplayCS=xy_plane, RestrictionBox=inflate_box)  # disabled
model_view_2 = ModelView(Name=view_name_2, ViewCS=xy_plane_2, DisplayCS=xz_plane, RestrictionBox=inflate_box)  # disabled
reinforcement_properties = ReinforcementProperties(Reinforcement=search_using_key_10)  # -> Size, Grade, Name, Type, Shape, Geometry, BendingRadius
construct_plane_3 = ConstructPlane(Origin=end_points.Start, XAxis=x_axis, YAxis=unit_z_3)
construct_plane_4 = ConstructPlane(Origin=end_points.Start, XAxis=negative_3, YAxis=unit_z_4)
construct_plane_5 = ConstructPlane(Origin=end_points.Start, XAxis=negative_2, YAxis=unit_z_5)
construct_plane_6 = ConstructPlane(Origin=end_points.Start, XAxis=y_axis, YAxis=unit_z_6)
list_item_4 = ListItem(List=model_object_2, Index=0, Wrap=True)
get_coordinate_system = GetCoordinateSystem(TeklaObject=deconstruct_assembly_2.MainPart, AlignWithZ=False, ToleranceMm=0.6)  # -> Global, Local
simple_orient_2 = SimpleOrient(Geometry=convert_to_brep, Plane=get_coordinate_system.Global)
simple_orient_3 = SimpleOrient(Geometry=flatten_tree_3, Plane=get_coordinate_system.Global)

# ---- group: Truss members
secondaries_breps = Data(simple_orient_3)
tekla_secondaries = Data(deconstruct_assembly_2.Secondaries)
main_part_brep = Data(simple_orient_2)
bounding_box_2 = BoundingBox(Content=main_part_brep, Plane=PlaneXY(0, 0, 0))  # -> Box, Box_2
bounding_box_3 = BoundingBox(Content=secondaries_breps, Plane=PlaneXY(0, 0, 0))  # -> Box, Box_2
deconstruct_box = DeconstructBox(Box=bounding_box_2.Box)  # -> Plane, X, Y, Z
deconstruct_box_2 = DeconstructBox(Box=bounding_box_3.Box)  # -> Plane, X, Y, Z
deconstruct_domain = DeconstructDomain(Domain=deconstruct_box.Y)  # -> Start, End
deconstruct_domain_2 = DeconstructDomain(Domain=deconstruct_box_2.Y)  # -> Start, End
minx = Addition(A=deconstruct_domain.Start, _001=0.01)
maxx = Subtraction(A=deconstruct_domain.End, _001=0.01)
larger_than_2 = LargerThan(FirstNumber=deconstruct_domain_2.Start, SecondNumber=maxx)  # -> LargerThan, OrEqualTo
smaller_than = SmallerThan(FirstNumber=deconstruct_domain_2.End, SecondNumber=minx)  # -> SmallerThan, OrEqualTo
dispatch_3 = Dispatch(List=tekla_secondaries, DispatchPattern=smaller_than.SmallerThan)  # -> ListA, ListB
dispatch_4 = Dispatch(List=tekla_secondaries, DispatchPattern=larger_than_2.LargerThan)  # -> ListA, ListB
elements_below = ModelObject(dispatch_3.ListA)
elements_above = ModelObject(dispatch_4.ListA)

# ---- group: Find end plates
main_part_brep_2 = Data(simple_orient_2)
bounding_box_4 = BoundingBox(Content=main_part_brep_2, Plane=PlaneXY(0, 0, 0))  # -> Box, Box_2
deconstruct_box_3 = DeconstructBox(Box=bounding_box_4.Box)  # -> Plane, X, Y, Z
deconstruct_domain_3 = DeconstructDomain(Domain=deconstruct_box_3.X)  # -> Start, End
maxx_2 = Subtraction(A=deconstruct_domain_3.End, B=1)
minx_2 = Addition(A=deconstruct_domain_3.Start, B=1)

secondaries_breps_2 = Data(simple_orient_3)
tekla_secondaries_2 = Data(deconstruct_assembly_2.Secondaries)
bounding_box_5 = BoundingBox(Content=secondaries_breps_2, Plane=PlaneXY(0, 0, 0))  # -> Box, Box_2
deconstruct_box_4 = DeconstructBox(Box=bounding_box_5.Box)  # -> Plane, X, Y, Z
deconstruct_domain_4 = DeconstructDomain(Domain=deconstruct_box_4.X)  # -> Start, End
larger_than_3 = LargerThan(FirstNumber=deconstruct_domain_4.Start, SecondNumber=maxx_2)  # -> LargerThan, OrEqualTo
smaller_than_2 = SmallerThan(FirstNumber=deconstruct_domain_4.End, SecondNumber=minx_2)  # -> SmallerThan, OrEqualTo
dispatch_5 = Dispatch(List=tekla_secondaries_2, DispatchPattern=smaller_than_2.SmallerThan)  # -> ListA, ListB
dispatch_6 = Dispatch(List=tekla_secondaries_2, DispatchPattern=larger_than_3.LargerThan)  # -> ListA, ListB
start_plates = ModelObject(dispatch_5.ListA)
end_plates = ModelObject(dispatch_6.ListA)

# ---- group: Find Stiffener plates inside main part
secondaries_breps_3 = Data(simple_orient_3)
tekla_secondaries_3 = Data(deconstruct_assembly_2.Secondaries)
main_part_brep_3 = Data(simple_orient_2)
bounding_box_6 = BoundingBox(Content=main_part_brep_3, Plane=PlaneXY(0, 0, 0))  # -> Box, Box_2
deconstruct_box_5 = DeconstructBox(Box=bounding_box_6.Box)  # -> Plane, X, Y, Z
deconstruct_domain_5 = DeconstructDomain(Domain=deconstruct_box_5.Z)  # -> Start, End
subtraction_2 = Subtraction(A=deconstruct_domain_5.Start, B="0.5")
addition = Addition(A=deconstruct_domain_5.End, B="0.5")
construct_domain = ConstructDomain(DomainStart=subtraction_2, DomainEnd=addition)
domain_box = DomainBox(Base=deconstruct_box_5.Plane, X=deconstruct_box_5.X, Y=deconstruct_box_5.Y, Z=construct_domain)
shape_in_brep = ShapeInBrep(Brep=domain_box, Shape=secondaries_breps_3)
equality = Equality(FirstNumber=shape_in_brep, SecondNumber=0)  # -> Equality, Inequality
dispatch_7 = Dispatch(List=tekla_secondaries_3, DispatchPattern=equality.Equality)  # -> ListA, ListB
stiffener_plates = ModelObject(dispatch_7.ListA)

# ----
create_ga_drawing = CreateGADrawing(Toggle=gate_not, Name=truss_tower, AttributesName=attributes, Remove_when_input_is_empty=False)  # disabled
flatten_tree_4 = FlattenTree(Tree=clean_tree, Path="{0}")
dispatch_8 = Dispatch(List=search_using_key, DispatchPattern=larger_than.LargerThan)  # -> ListA, ListB
bounding_box_7 = Brep(inflate_box_2)
null_item_3 = NullItem(Item=list_item_4)  # -> NullFlags, InvalidFlags, Description
deconstruct_box_6 = DeconstructBox(Box=inflate_box_2)  # -> Plane, X, Y, Z
deconstruct_assembly_4 = DeconstructAssembly(Assembly=search_using_key_9, ToleranceMm=0.6)  # -> Name, Type, MainPart, Secondaries, AllObjects
entwine = Entwine(Branch00="Total-H", Branch01="Total-W", FlattenInputs=True)
get_cog_2 = GetCOG(GravityObject=flatten_tree_4)
construct_point = ConstructPoint(XCoordinate=0, YCoordinate=0, ZCoordinate=0)  # disabled
drawing_point = DrawingPoint(null, TeklaPoints="76.5514672937782;236.813886403479;0")
simple_orient_4 = SimpleOrient(Geometry=reinforcement_properties.Geometry, Plane=view_properties_4.DisplayCS)
model_object_6 = ModelObject(dispatch_8.ListA)
search_using_key_13 = SearchUsingKey(Values=part_view, Keys=view_properties_5.Type, Search=part_view_types_2)
open_drawing = OpenDrawing(Drawing=create_ga_drawing, Show=True)  # disabled
dimension_line_attributes = DimensionLineAttributes(AttributesName=entwine, PlacingType=0)
xy_plane_3 = XYPlane(Origin=Point(0, 0, 0))
drawing_name = Panel("Warehouse")
settings_to_use = Panel("Steel Warehouse")
get_property_3 = GetProperty(TeklaObject=model_object_6, Name="BOUNDING_BOX_MIN_Z", PropertyType=0, ValueType=0, ToleranceMm=0.6)
deconstruct = Deconstruct(Point=get_cog_2)  # -> XComponent, YComponent, ZComponent
flatten_tree_5 = FlattenTree(Tree=simple_orient_4, Path="{0}")
inflate_box_3 = InflateBox(Box=tekla_bounding_box_3, Amount="500")

# ---- group: Additional distincion for Walls
group_objects_4 = GroupObjects(ModelObject=search_using_key_11, Property="CAST_UNIT_PREFIX", Group_by_Assembly_Position=16)  # -> ModelObject, Keys
search_for_walls = SearchUsingKey(Values=group_objects_4.ModelObject, Keys=group_objects_4.Keys, Search="W")

# ----
model_view_3 = ModelView(Drawing=open_drawing, ModelView=model_view_2, Attributes_by_macro=False, Remove_when_input_is_empty=False)  # disabled
model_view_4 = ModelView(
    Drawing=open_drawing,
    ModelView=model_view,
    Point=construct_point,
    Attributes_by_macro=False,
    Remove_when_input_is_empty=False)  # disabled
round = Round(Number=get_property_3)  # -> Nearest, Floor, Ceiling
create_ga_drawing_2 = CreateGADrawing(
    Toggle=invert(null_item_3.NullFlags),
    Name=drawing_name,
    AttributesName=settings_to_use,
    Remove_when_input_is_empty=False)
view_properties_6 = ViewProperties(View=search_using_key_13)  # -> Type, Name, ViewCS, DisplayCS, RestrictionBox, Scale, Tags
sort_list = SortList(Keys=deconstruct.ZComponent, ValuesValuesA=flatten_tree_4)  # -> Keys, ValuesValuesA
create_set = CreateSet(List=round.Nearest)  # -> Set, Map
list_item_5 = ListItem(List=sort_list.ValuesValuesA, Index=0, Wrap=True)
view_name_3 = Panel("Roof plan")
open_drawing_2 = OpenDrawing(Drawing=create_ga_drawing_2, Show=True)
leader_type = AutoValueList({"NoLeaderLine": 0, "LeaderLine": 1, "AlongLine": 2, "BaseLine": 3}, selected="LeaderLine")
get_cog_3 = GetCOG(GravityObject=list_item_5)
simple_orient_5 = SimpleOrient(Geometry=bounding_box_7, Plane=construct_plane_4)
model_view_5 = ModelView(Name="Foundation plan", ViewCS=construct_plane, DisplayCS=construct_plane, RestrictionBox=inflate_box_3)
model_view_6 = ModelView(Name=view_name_3, ViewCS=construct_plane, DisplayCS=construct_plane, RestrictionBox=tekla_bounding_box_2)
simple_orient_6 = SimpleOrient(Geometry=bounding_box_7, Plane=construct_plane_6)
simple_orient_7 = SimpleOrient(Geometry=bounding_box_7, Plane=construct_plane_5)
brep_projection_border = BrepProjectionBorder(Brep=view_properties_6.RestrictionBox, Plane=view_properties_6.ViewCS)  # -> Boundary, Hole, UnionRectangle
simple_orient_8 = SimpleOrient(Geometry=bounding_box_7, Plane=construct_plane_3)
drawings_from_model_object = DrawingsFromModelObject(ModelObject=search_for_walls)
drawings_from_model_object_2 = DrawingsFromModelObject(ModelObject=search_using_key_12)
insertion_point = Panel("700,350,0")
view_attributes = Panel("GA Plan")
simple_orient_9 = SimpleOrient(Geometry=get_cog_3, Plane=view_properties_4.DisplayCS)
view_s_bounding_box = SimpleOrient(Geometry=view_properties_4.RestrictionBox, Plane=view_properties_4.DisplayCS)
unit_y = UnitY(Factor=1)
model_view_7 = ModelView(Name="Plan", ViewCS=deconstruct_box_6.Plane, DisplayCS=deconstruct_box_6.Plane, RestrictionBox=inflate_box_2)
model_view_8 = ModelView(Name="Elevation right", ViewCS=construct_plane_6, DisplayCS=construct_plane_6, RestrictionBox=simple_orient_6)
model_view_9 = ModelView(Name="Elevation left", ViewCS=construct_plane_5, DisplayCS=construct_plane_5, RestrictionBox=simple_orient_7)
model_view_10 = ModelView(Name="Elevation top", ViewCS=construct_plane_4, DisplayCS=construct_plane_4, RestrictionBox=simple_orient_5)
roof_view = ModelView(
    Drawing=open_drawing_2,
    ModelView=model_view_6,
    AttributesName=view_attributes,
    Point=insertion_point,
    Attributes_by_macro=False,
    Remove_when_input_is_empty=False)
clean_tree_2 = CleanTree(RemoveNulls=True, RemoveInvalid=True, RemoveEmpty=True, Tree=drawings_from_model_object_2)

# ---- group: Find unique steel drawings
flatten_tree_6 = FlattenTree(Tree=clean_tree_2, Path="{0}")
drawing_properties = DrawingProperties(Drawing=flatten_tree_6)  # -> Drawing, Name, Title1, Title2, Title3, Mark, SheetNumber
create_set_2 = CreateSet(List=drawing_properties.Mark)  # -> Set, Map
create_set_3 = CreateSet(List=create_set_2.Map)  # -> Set, Map
member_index = MemberIndex(Set=create_set_2.Map, Member=create_set_3.Set)  # -> Index, Count
list_item_6 = ListItem(List=flatten_tree_6, Index=member_index.Index, Wrap=True)
list_item_7 = ListItem(List=list_item_6, Index=0, Wrap=True)

# ----
model_view_11 = ModelView(Name="Elevation bottom", ViewCS=construct_plane_3, DisplayCS=construct_plane_3, RestrictionBox=simple_orient_8)
clean_tree_3 = CleanTree(RemoveNulls=True, RemoveInvalid=True, RemoveEmpty=True, Tree=drawings_from_model_object)
curve_closest_point = CurveClosestPoint(LifterCOG=simple_orient_9, StirrupsCurve=flatten_tree_5)  # -> Point, Parameter, Distance
line_sdl = LineSDL(Start=simple_orient_9, Direction=unit_y, Length=100)
foundation_view = ModelView(
    Drawing=open_drawing_2,
    ModelView=model_view_5,
    AttributesName="GA Plan",
    Point="{680,60,0}",
    Attributes_by_macro=False,
    Remove_when_input_is_empty=False)
viewing_direction_5 = ViewingDirection({"From Left": {1,0,0}, "From Right": {-1,0,0}, "From Bottom": {0,1,0}, "From Top": {0,-1,0}}, selected=["From Left", "From Bottom"])
convert_to_brep_3 = ConvertToBrep(TeklaObject=start_plates, SolidType=2, ToleranceMm=0.6)

# ---- group: Find unique drawings
flatten_tree_7 = FlattenTree(Tree=clean_tree_3, Path="{0}")
drawing_properties_2 = DrawingProperties(Drawing=flatten_tree_7)  # -> Drawing, Name, Title1, Title2, Title3, Mark, SheetNumber
create_set_4 = CreateSet(List=drawing_properties_2.Mark)  # -> Set, Map
create_set_5 = CreateSet(List=create_set_4.Map)  # -> Set, Map
member_index_2 = MemberIndex(Set=create_set_4.Map, Member=create_set_5.Set)  # -> Index, Count
list_item_8 = ListItem(List=flatten_tree_7, Index=member_index_2.Index, Wrap=True)
list_item_9 = ListItem(List=list_item_8, Index=0, Wrap=True)

# ----
sort_list_2 = SortList(Keys=curve_closest_point.Distance, ValuesValuesA=flatten_tree_5)  # -> Keys, ValuesValuesA
convert_to_brep_4 = ConvertToBrep(TeklaObject=deconstruct_assembly_4.MainPart, SolidType=2, ToleranceMm=0.6)

# ---- group: Filter by name
group_objects_5 = GroupObjects(ModelObject=elements_below, Group_by_Assembly_Position=2)  # -> ModelObject, Keys
search_using_key_14 = SearchUsingKey(Values=group_objects_5.ModelObject, Keys=group_objects_5.Keys, Search="BOTTOM CHORD")
search_using_key_15 = SearchUsingKey(Values=group_objects_5.ModelObject, Keys=group_objects_5.Keys, Search="DIAGONAL")

# ----
view_properties_7 = ViewProperties(View=foundation_view)  # -> Type, Name, ViewCS, DisplayCS, RestrictionBox, Scale, Tags
flatten_tree_8 = FlattenTree(Tree=convert_to_brep_3, Path="{0}")
plan = ModelView(
    Drawing=open_drawing_2,
    ModelView=model_view_7,
    AttributesName="GA Plan",
    Point="0,50,0",
    Attributes_by_macro=False,
    Remove_when_input_is_empty=False)
elevation_from_bottom = ModelView(
    Drawing=open_drawing_2,
    ModelView=model_view_11,
    AttributesName="GA Elevation",
    Point="0,-180,0",
    Attributes_by_macro=False,
    Remove_when_input_is_empty=False)
elevation_from_top = ModelView(
    Drawing=open_drawing_2,
    ModelView=model_view_10,
    AttributesName="GA Elevation",
    Point="0,330,0",
    Attributes_by_macro=False,
    Remove_when_input_is_empty=False)
elevation_from_left = ModelView(
    Drawing=open_drawing_2,
    ModelView=model_view_9,
    AttributesName="GA Elevation",
    Point="-280,50,0",
    Attributes_by_macro=False,
    Remove_when_input_is_empty=False)
elevation_from_right = ModelView(
    Drawing=open_drawing_2,
    ModelView=model_view_8,
    AttributesName="GA Elevation",
    Point="400,50,0",
    Attributes_by_macro=False,
    Remove_when_input_is_empty=False)
distances_from_lifter_cog_to_stirrups = Panel(sort_list_2.Keys)
create_grid_dimension_lines = CreateGridDimensionLines(relay_2=roof_view, relay=viewing_direction_5)
convert_to_brep_5 = ConvertToBrep(TeklaObject=elements_above, SolidType=2, ToleranceMm=0.6)
simple_orient_10 = SimpleOrient(Geometry=flatten_tree_8, Plane=view_properties_6.DisplayCS)
rotate_view = RotateView(View=elevation_from_top, Angle="180")
rotate_view_2 = RotateView(View=elevation_from_left, Angle="270")
rotate_view_3 = RotateView(View=elevation_from_right, Angle="90")
viewing_direction_6 = ViewingDirection({"From Left": {1,0,0}, "From Right": {-1,0,0}, "From Bottom": {0,1,0}, "From Top": {0,-1,0}}, selected=["From Right", "From Bottom"])
simple_orient_11 = SimpleOrient(Geometry=convert_to_brep_4, Plane=view_properties_7.DisplayCS)
shift_paths = ShiftPaths(Data=convert_to_brep_5, Offset=-1)
bounding_box_8 = BoundingBox(Content=simple_orient_10, Plane=PlaneXY(0, 0, 0), UnionBox=True)  # -> Box, Box_2
viewing_direction_7 = ViewingDirection({"From Left": {1,0,0}, "From Right": {-1,0,0}, "From Bottom": {0,1,0}, "From Top": {0,-1,0}}, selected=["From Left", "From Bottom"])
bounding_box_9 = BoundingBox(Content=sort_list_2.ValuesValuesA, Plane=PlaneXY(0, 0, 0))  # -> Box, Box_2
view_frame_geometry_2 = ViewFrameGeometry(View=plan)  # -> UpperLeft, UpperRight, LowerLeft, LowerRight, Rectangle, Width, Height, Origin
view_frame_geometry_3 = ViewFrameGeometry(View=elevation_from_bottom)  # -> UpperLeft, UpperRight, LowerLeft, LowerRight, Rectangle, Width, Height, Origin
view_frame_geometry_4 = ViewFrameGeometry(View=rotate_view)  # -> UpperLeft, UpperRight, LowerLeft, LowerRight, Rectangle, Width, Height, Origin
material_sub_dir = Panel("Steel\")
view_frame_geometry_5 = ViewFrameGeometry(View=rotate_view_3)  # -> UpperLeft, UpperRight, LowerLeft, LowerRight, Rectangle, Width, Height, Origin
view_frame_geometry_6 = ViewFrameGeometry(View=rotate_view_2)  # -> UpperLeft, UpperRight, LowerLeft, LowerRight, Rectangle, Width, Height, Origin
base_directory = Panel(concatenate)
simple_orient_12 = SimpleOrient(Geometry=shift_paths, Plane=get_coordinate_system.Global)
deconstruct_box_7 = DeconstructBox(Box=bounding_box_8.Box)  # -> Plane, X, Y, Z
list_item_10 = ListItem(List=bounding_box_9.Box, Index=0, Wrap=True)  # -> Item, Item1
brep_projection_border_2 = BrepProjectionBorder(Brep=simple_orient_11)  # -> Boundary, Hole, UnionRectangle
concatenate_2 = Concatenate(FragmentA=concatenate, FragmentB="Walls\")
convert_to_brep_6 = ConvertToBrep(TeklaObject=search_using_key_15, SolidType=2, ToleranceMm=0.6)
create_grid_dimension_lines_2 = CreateGridDimensionLines(relay_2=foundation_view, relay=viewing_direction_6)
brep_line = BrepLine(Brep=view_s_bounding_box, Line=line_sdl, LimitToFirst=False)  # -> Curves, Points
concatenate_3 = Concatenate(FragmentA=concatenate, FragmentB=material_sub_dir)
convert_to_brep_7 = ConvertToBrep(TeklaObject=search_using_key_14, SolidType=2, ToleranceMm=0.6)
file_typ_sub_dir = Panel("Dwgs\")
create_grid_dimension_lines_3 = CreateGridDimensionLines(relay_2=plan, relay=viewing_direction_7)
bounding_box_10 = BoundingBox(Content=simple_orient_12, Plane=PlaneXY(0, 0, 0))  # -> Box, Box_2
subtraction_3 = Subtraction(A=view_frame_geometry_2.LowerLeft, B=view_frame_geometry_3.UpperLeft)
deconstruct_domain_6 = DeconstructDomain(Domain=deconstruct_box_7.X)  # -> Start, End
deconstruct_domain_7 = DeconstructDomain(Domain=deconstruct_box_7.Y)  # -> Start, End
subtraction_4 = Subtraction(A=view_frame_geometry_2.LowerLeft, B=view_frame_geometry_6.LowerRight)
deconstruct_box_8 = DeconstructBox(Box=list_item_10.Item1)  # -> Plane, X, Y, Z
deconstruct_box_9 = DeconstructBox(Box=list_item_10.Item)  # -> Plane, X, Y, Z
subtraction_5 = Subtraction(A=view_frame_geometry_2.LowerRight, B=view_frame_geometry_5.LowerLeft)
sort_points = SortPoints(Points=brep_line.Points)  # -> Points, Indices
flatten_tree_9 = FlattenTree(Tree=convert_to_brep_6, Path="{0}")
concatenate_4 = Concatenate(FragmentA=concatenate_3, FragmentB=file_typ_sub_dir)
concatenate_5 = Concatenate(FragmentA=concatenate_2, FragmentB="Pdfs\")
deconstruct_vector = DeconstructVector(Vector=subtraction_3)  # -> XComponent, YComponent, ZComponent
flatten_tree_10 = FlattenTree(Tree=convert_to_brep_7, Path="{0}")
shift_paths_2 = ShiftPaths(Data=bounding_box_10.Box, Offset=-1)
subtraction_6 = Subtraction(A=view_frame_geometry_2.UpperLeft, B=view_frame_geometry_4.LowerLeft)
deconstruct_vector_2 = DeconstructVector(Vector=subtraction_4)  # -> XComponent, YComponent, ZComponent
deconstruct_domain_8 = DeconstructDomain(Domain=[deconstruct_box_9.X, deconstruct_box_8.X])  # -> Start, End
deconstruct_vector_3 = DeconstructVector(Vector=subtraction_5)  # -> XComponent, YComponent, ZComponent
deconstruct_2 = Deconstruct(Point=simple_orient_9)  # -> XComponent, YComponent, ZComponent
construct_point_2 = ConstructPoint(XCoordinate=deconstruct_domain_6.Start, YCoordinate=deconstruct_domain_7.Start, ZCoordinate=0)
construct_point_3 = ConstructPoint(XCoordinate=deconstruct_domain_6.Start, YCoordinate=deconstruct_domain_7.End, ZCoordinate=0)
simple_orient_13 = SimpleOrient(Geometry=flatten_tree_9, Plane=get_coordinate_system.Global)
subtraction_7 = Subtraction(A=deconstruct_domain_6.End, B=deconstruct_domain_6.Start)
list_item_11 = ListItem(List=sort_points.Points, Index=0, Wrap=True)  # -> Item, Item1
drawing_source_3 = DrawingSource(Drawing=list_item_9)
deconstruct_vector_4 = DeconstructVector(Vector=subtraction_6)  # -> XComponent, YComponent, ZComponent
simple_orient_14 = SimpleOrient(Geometry=flatten_tree_10, Plane=get_coordinate_system.Global)
output = Panel(concatenate_4)
deconstruct_box_10 = DeconstructBox(Box=shift_paths_2)  # -> Plane, X, Y, Z
vector_xyz = VectorXYZ(XComponent=0, YComponent=deconstruct_vector.YComponent, ZComponent=0)  # -> Vector, Length
merge = Merge(Data1=deconstruct_domain_8.Start, Data2=deconstruct_domain_8.End)
sort_list_3 = SortList(Keys=merge)  # -> Keys, ValuesValuesA
list_item_12 = ListItem(List=sort_list_3.Keys, Index=0, Wrap=True)  # -> Item1, Item
addition_2 = Addition(A=subtraction_7, _10=10)
vector_xyz_2 = VectorXYZ(XComponent=deconstruct_vector_2.XComponent, YComponent=0, ZComponent=0)  # -> Vector, Length
vector_xyz_3 = VectorXYZ(XComponent=deconstruct_vector_3.XComponent, YComponent=0, ZComponent=0)  # -> Vector, Length
brep_projection_border_3 = BrepProjectionBorder(Brep=simple_orient_13)  # -> Boundary, Hole, UnionRectangle
subtraction_8 = Subtraction(A=list_item_12.Item, B=deconstruct_2.XComponent, _20=20)
subtraction_9 = Subtraction(A=list_item_12.Item1, B=deconstruct_2.XComponent)
group_domains = GroupDomains(Domain=deconstruct_box_10.X)  # -> Domain, SummaryDomain, Path, Index
viewing_direction_8 = ViewingDirection({"From Left": {1,0,0}, "From Right": {-1,0,0}, "From Bottom": {0,1,0}, "From Top": {0,-1,0}}, selected="From Top")
viewing_direction_9 = ViewingDirection({"From Left": {1,0,0}, "From Right": {-1,0,0}, "From Bottom": {0,1,0}, "From Top": {0,-1,0}}, selected="From Bottom")
vector_xyz_4 = VectorXYZ(XComponent=0, YComponent=deconstruct_vector_4.YComponent, ZComponent=0)  # -> Vector, Length
get_property_4 = GetProperty(TeklaObject=drawing_source_3, Name="CAST_UNIT_POS", PropertyType=0, ValueType=0, ToleranceMm=0.6)
brep_projection_border_4 = BrepProjectionBorder(Brep=simple_orient_14)  # -> Boundary, Hole, UnionRectangle
move_view_2 = MoveView(View=elevation_from_bottom, Vector=vector_xyz.Vector)
section_view = SectionView(
    View=search_using_key_13,
    StartPoint=construct_point_3,
    EndPoint=construct_point_2,
    InsertionPoint="0,0,0",
    DepthUp=addition_2,
    DepthDown=0,
    ViewAttributes="Section-Manual Dimensions",
    Attributes_by_macro=False,
    Remove_when_input_is_empty=False)  # -> View, Mark; disabled
move_view_3 = MoveView(View=rotate_view_2, Vector=vector_xyz_2.Vector)
absolute_2 = Absolute(Value=subtraction_9)
absolute_3 = Absolute(Value=subtraction_8)
curve = Curve(brep_projection_border_3.Boundary)
move_view_4 = MoveView(View=rotate_view_3, Vector=vector_xyz_3.Vector)
concatenate_6 = Concatenate(Fragment_A=concatenate_5, Fragment_B=get_property_4, A=".pdf")
panel_5 = Panel(group_domains.SummaryDomain)
drawing_object = DrawingObject(move_view_2)
boundary_surfaces = BoundarySurfaces(Edges=brep_projection_border_4.Boundary)
move_view_5 = MoveView(View=rotate_view, Vector=vector_xyz_4.Vector)
tree_item = TreeItem(Tree=elements_above, Path=group_domains.Path, Index=group_domains.Index, Wrap=True)
find_visible_edges = FindVisibleEdges(Curve=curve, Vector=viewing_direction_8)  # -> Points, Edges, Extremes
find_visible_edges_2 = FindVisibleEdges(Curve=curve, Vector=viewing_direction_9)  # -> Points, Edges, Extremes
merge_2 = Merge(Data1=view_frame_geometry_6.Origin, Data2=view_frame_geometry_5.Origin)
objects_from_view = ObjectsFromView(View=section_view.View, All_objects=1)  # -> DrawingObject, Keys
model_to_drawing_object = ModelToDrawingObject(ViewBase=foundation_view, ModelObject=deconstruct_assembly_4.MainPart)
boundary_surfaces_2 = BoundarySurfaces(Edges=curve)
settings_to_use_2 = Panel("Steel Settings")
viewing_direction_10 = ViewingDirection({"From Left": {1,0,0}, "From Right": {-1,0,0}, "From Bottom": {0,1,0}, "From Top": {0,-1,0}}, selected=["From Right", "From Top"])
view_properties_8 = ViewProperties(View=section_view.View)  # -> Type, Name, ViewCS, DisplayCS, RestrictionBox, Scale, Tags
view_settings = Panel("Column Section")
viewing_direction_11 = ViewingDirection({"From Left": {1,0,0}, "From Right": {-1,0,0}, "From Bottom": {0,1,0}, "From Top": {0,-1,0}}, selected=["From Right", "From Bottom"])
mark_settings = Panel("Column Mark")
brep_join = BrepJoin(Breps=boundary_surfaces)  # -> Breps, Closed
settings_to_use_3 = Panel("Pad Footing")
insertion_point_2 = Panel("150,110,0")
settings_to_use_4 = Panel("Wall Settings")
subtraction_10 = Subtraction(A=view_frame_geometry_2.Origin, B=merge_2)
deconstruct_3 = Deconstruct(Point=find_visible_edges_2.Points)  # -> XComponent, YComponent, ZComponent
deconstruct_4 = Deconstruct(Point=find_visible_edges.Points)  # -> XComponent, YComponent, ZComponent
viewing_direction_12 = ViewingDirection({"From Left": {1,0,0}, "From Right": {-1,0,0}, "From Bottom": {0,1,0}, "From Top": {0,-1,0}}, selected="From Bottom")
brep_join_2 = BrepJoin(Breps=boundary_surfaces_2)  # -> Breps, Closed
dimension_line_attributes_2 = DimensionLineAttributes(AttributesName="Cover")
merge_3 = Merge(Data1=list_item_9, Data2=list_item_7)
input_drawings = Panel(list_item_7)
export_dwg = ExportDWG(Drawing=list_item_7, Path=concatenate_4, Settings=settings_to_use_2)
search_using_key_16 = SearchUsingKey(Values=objects_from_view.DrawingObject, Keys=objects_from_view.Keys, Search="Part")
section_view_2 = SectionView(
    View=list_item_3,
    StartPoint=list_item_11.Item1,
    EndPoint=list_item_11.Item,
    InsertionPoint=insertion_point_2,
    DepthUp=absolute_2,
    DepthDown=absolute_3,
    ViewAttributes=view_settings,
    MarkAttributes=mark_settings,
    Attributes_by_macro=False,
    Remove_when_input_is_empty=False)  # -> View, Mark
# Rebar section - straight rebar dimensions
section_view_3 = DrawingObject(section_view_2.View)
# Rebar section - stirrup mark
section_view_4 = DrawingObject(section_view_2.View)
# Rebar section - cover
section_view_5 = DrawingObject(section_view_2.View)
# Rebar section - lifter dimension
section_view_6 = DrawingObject(section_view_2.View)
# Rebar section - total dimensions
section_view_7 = DrawingObject(section_view_2.View)
objects_from_view_2 = ObjectsFromView(View=section_view_4, All_objects=0)  # -> DrawingObject, Keys
null_item_4 = NullItem(Item=section_view_3)  # -> NullFlags, InvalidFlags, Description
view_properties_9 = ViewProperties(View=section_view_6)  # -> Type, Name, ViewCS, DisplayCS, RestrictionBox, Scale, Tags
objects_from_view_3 = ObjectsFromView(View=section_view_6, All_objects=1)  # -> DrawingObject, Keys
objects_from_view_4 = ObjectsFromView(View=section_view_3, All_objects=0)  # -> DrawingObject, Keys
view_properties_10 = ViewProperties(View=section_view_3)  # -> Type, Name, ViewCS, DisplayCS, RestrictionBox, Scale, Tags
null_item_5 = NullItem(Item=section_view_5)  # -> NullFlags, InvalidFlags, Description
null_item_6 = NullItem(Item=section_view_6)  # -> NullFlags, InvalidFlags, Description
objects_from_view_5 = ObjectsFromView(View=section_view_5, All_objects=0)  # -> DrawingObject, Keys
view_properties_11 = ViewProperties(View=section_view_5)  # -> Type, Name, ViewCS, DisplayCS, RestrictionBox, Scale, Tags
null_item_7 = NullItem(Item=section_view_7)  # -> NullFlags, InvalidFlags, Description
match_text_2 = MatchText(Text=objects_from_view_2.Keys, Pattern="*Reinforcement*", Case=True)
active_drawing_4 = ActiveDrawing(Toggle=invert(null_item_4.NullFlags))
view_properties_12 = ViewProperties(View=section_view_7)  # -> Type, Name, ViewCS, DisplayCS, RestrictionBox, Scale, Tags
active_drawing_5 = ActiveDrawing(Toggle=invert(null_item_5.NullFlags))
active_drawing_6 = ActiveDrawing(Toggle=invert(null_item_6.NullFlags))
match_text_3 = MatchText(Text=objects_from_view_4.Keys, Pattern="*Reinforcement*", Case=True)
search_using_key_17 = SearchUsingKey(Values=objects_from_view_3.DrawingObject, Keys=objects_from_view_3.Keys, Search=drawing_object_types)
active_drawing_7 = ActiveDrawing(Toggle=invert(null_item_7.NullFlags))
dispatch_9 = Dispatch(List=objects_from_view_2.DrawingObject, DispatchPattern=match_text_2)  # -> ListA, ListB
drawing_source_4 = DrawingSource(Drawing=active_drawing_4)
search_using_key_18 = SearchUsingKey(Values=objects_from_view_5.DrawingObject, Keys=objects_from_view_5.Keys, Search=drawing_object_types_3)
search_using_key_19 = SearchUsingKey(Values=objects_from_view_5.DrawingObject, Keys=objects_from_view_5.Keys, Search=drawing_object_types_2)
drawing_source_5 = DrawingSource(Drawing=active_drawing_5)
drawing_source_6 = DrawingSource(Drawing=active_drawing_6)
drawing_to_model_object_2 = DrawingToModelObject(DrawingPart=search_using_key_17)
drawing_source_7 = DrawingSource(Drawing=active_drawing_7)
dispatch_10 = Dispatch(List=objects_from_view_4.DrawingObject, DispatchPattern=match_text_3)  # -> ListA, ListB
drawing_to_model_object_3 = DrawingToModelObject(DrawingPart=search_using_key_19)
drawing_to_model_object_4 = DrawingToModelObject(DrawingPart=search_using_key_18)
deconstruct_assembly_5 = DeconstructAssembly(Assembly=drawing_source_4, ToleranceMm=0.6)  # -> Name, Type, MainPart, Secondaries, AllObjects
flatten_tree_11 = FlattenTree(Tree=dispatch_9.ListA, Path="{0}")
deconstruct_assembly_6 = DeconstructAssembly(Assembly=drawing_source_5, ToleranceMm=0.6)  # -> Name, Type, MainPart, Secondaries, AllObjects
deconstruct_assembly_7 = DeconstructAssembly(Assembly=drawing_source_6, ToleranceMm=0.6)  # -> Name, Type, MainPart, Secondaries, AllObjects
list_item_13 = ListItem(List=flatten_tree_11, Index=0, Wrap=True)
deconstruct_assembly_8 = DeconstructAssembly(Assembly=drawing_source_7, ToleranceMm=0.6)  # -> Name, Type, MainPart, Secondaries, AllObjects
drawing_to_model_object_5 = DrawingToModelObject(DrawingPart=flatten_tree_11)
group_objects_6 = GroupObjects(ModelObject=drawing_to_model_object_2, Property="comment", Group_by_Assembly_Position=8)  # -> ModelObject, Keys
flatten_tree_12 = FlattenTree(Tree=dispatch_10.ListA, Path="{0}")
convert_to_brep_8 = ConvertToBrep(TeklaObject=deconstruct_assembly_5.MainPart, SolidType=2, ToleranceMm=0.6)
list_item_14 = ListItem(List=flatten_tree_12, Index=0, Wrap=True)
drawing_to_model_object_6 = DrawingToModelObject(DrawingPart=flatten_tree_12)
convert_to_brep_9 = ConvertToBrep(TeklaObject=deconstruct_assembly_7.MainPart, SolidType=2, ToleranceMm=0.6)
convert_to_brep_10 = ConvertToBrep(TeklaObject=deconstruct_assembly_6.MainPart, SolidType=2, ToleranceMm=0.6)
reinforcement_properties_2 = ReinforcementProperties(Reinforcement=drawing_to_model_object_4)  # -> Size, Grade, Name, Type, Shape, Geometry, BendingRadius
convert_to_brep_11 = ConvertToBrep(TeklaObject=deconstruct_assembly_8.MainPart, SolidType=2, ToleranceMm=0.6)
group_objects_7 = GroupObjects(ModelObject=drawing_to_model_object_5, Property="SHAPE_INTERNAL", Group_by_Assembly_Position=16)  # -> ModelObject, Keys
match_text_4 = MatchText(Text=group_objects_6.Keys, RegEx="^PTC_KA", Case=True)
group_objects_8 = GroupObjects(ModelObject=drawing_to_model_object_3, Property="SHAPE_INTERNAL", Group_by_Assembly_Position=16)  # -> ModelObject, Keys
simple_orient_15 = SimpleOrient(Geometry=convert_to_brep_8, Plane=view_properties_10.DisplayCS)
simple_orient_16 = SimpleOrient(Geometry=convert_to_brep_9, Plane=view_properties_9.DisplayCS)
simple_orient_17 = SimpleOrient(Geometry=convert_to_brep_10, Plane=view_properties_11.DisplayCS)
group_objects_9 = GroupObjects(ModelObject=drawing_to_model_object_6, Property="SHAPE_INTERNAL", Group_by_Assembly_Position=16)  # -> ModelObject, Keys
simple_orient_18 = SimpleOrient(Geometry=convert_to_brep_11, Plane=view_properties_12.DisplayCS)
dispatch_11 = Dispatch(List=group_objects_6.ModelObject, DispatchPattern=match_text_4)  # -> ListA, ListB
search_using_key_20 = SearchUsingKey(Values=group_objects_7.ModelObject, Keys=group_objects_7.Keys, Search=stirrup_shape)
brep_projection_border_5 = BrepProjectionBorder(Brep=simple_orient_15)  # -> Boundary, Hole, UnionRectangle
search_using_key_21 = SearchUsingKey(Values=group_objects_8.ModelObject, Keys=group_objects_8.Keys, Search=stirrup_shape_3)
brep_projection_border_6 = BrepProjectionBorder(Brep=simple_orient_16)  # -> Boundary, Hole, UnionRectangle
brep_projection_border_7 = BrepProjectionBorder(Brep=simple_orient_17)  # -> Boundary, Hole, UnionRectangle
brep_projection_border_8 = BrepProjectionBorder(Brep=simple_orient_18)  # -> Boundary, Hole, UnionRectangle
search_using_key_22 = SearchUsingKey(Values=group_objects_9.ModelObject, Keys=group_objects_9.Keys, Search=stirrup_shape_4)
flatten_tree_13 = FlattenTree(Tree=dispatch_11.ListA, Path="{0}")
model_to_drawing_object_2 = ModelToDrawingObject(ViewBase=section_view_4, ModelObject=search_using_key_20)
reinforcement_properties_3 = ReinforcementProperties(Reinforcement=search_using_key_21)  # -> Size, Grade, Name, Type, Shape, Geometry, BendingRadius
get_property_5 = GetProperty(TeklaObject=search_using_key_21, Name="DIAMETER_ACTUAL", PropertyType=0, ValueType=0, ToleranceMm=0.6)
explode = Explode(Curve=brep_projection_border_7.Boundary, Recursive=True)  # -> Segments, Vertices
model_to_drawing_object_3 = ModelToDrawingObject(ViewBase=section_view_6, ModelObject=flatten_tree_13)
part_lines_2 = PartLines(ModelObject=flatten_tree_13, Skip_cuts_and_fittings=0)  # -> RefLine, CenterLine
group_objects_10 = GroupObjects(ModelObject=search_using_key_22, Property="REBAR_POS", Group_by_Assembly_Position=16)  # -> ModelObject, Keys
find_visible_edges_3 = FindVisibleEdges(Curve=brep_projection_border_8.Boundary, Vector=viewing_direction)  # -> Points, Edges, Extremes
find_visible_edges_4 = FindVisibleEdges(Curve=brep_projection_border_8.Boundary, Vector=viewing_direction_2)  # -> Points, Edges, Extremes
list_item_15 = ListItem(List=reinforcement_properties_3.Geometry, Index=0, Wrap=True)
curve_middle = CurveMiddle(Curve=explode.Segments)
division = Division(A=get_property_5, B="2.0")
stirrup = DrawingObject(model_to_drawing_object_2)
find_visible_edges_5 = FindVisibleEdges(Curve=brep_projection_border_5.Boundary, Vector=viewing_direction_3)  # -> Points, Edges, Extremes
find_visible_edges_6 = FindVisibleEdges(Curve=brep_projection_border_5.Boundary, Vector=viewing_direction_4)  # -> Points, Edges, Extremes
reinforcement_properties_4 = ReinforcementProperties(Reinforcement=group_objects_10.ModelObject)  # -> Size, Grade, Name, Type, Shape, Geometry, BendingRadius
drawing_object_2 = DrawingObject(model_to_drawing_object_3)
simple_orient_19 = SimpleOrient(Geometry=list_item_15, Plane=view_properties_11.DisplayCS)
entwine_2 = Entwine(Branch00=find_visible_edges_4.Points, Branch01=find_visible_edges_3.Points, FlattenInputs=True)
simple_orient_20 = SimpleOrient(Geometry=part_lines_2.RefLine, Plane=view_properties_9.DisplayCS)
visible_rebars = VisibleRebars(Reinforcement=stirrup)  # -> Geometry, BendingRadius
entwine_3 = Entwine(Branch00=find_visible_edges_4.Edges, Branch01=find_visible_edges_3.Edges, FlattenInputs=True)
offset_curve = OffsetCurve(Curve=simple_orient_19, Distance=division, Plane=xy_plane_3, Corners=1)
end_points_2 = EndPoints(Curve=simple_orient_20)  # -> Start, End
end_points_3 = EndPoints(Curve=reinforcement_properties_4.Geometry)  # -> Start, End
simple_orient_21 = SimpleOrient(Geometry=end_points_3.Start, Plane=view_properties_10.DisplayCS)
find_visible_edges_7 = FindVisibleEdges(Curve=brep_projection_border_6.Boundary, Vector=simple_orient_20)  # -> Points, Edges, Extremes
bounding_box_11 = BoundingBox(Content=offset_curve, Plane=PlaneXY(0, 0, 0))  # -> Box, Box_2
list_item_16 = ListItem(List=visible_rebars.Geometry, Index=0, Wrap=True)
merge_4 = Merge(Data1=find_visible_edges_7.Points, Data2=end_points_2.Start)
deconstruct_5 = Deconstruct(Point=simple_orient_21)  # -> XComponent, YComponent, ZComponent
dimension_line_attributes_3 = DimensionLineAttributes(AttributesName="Embed Name", DrawingObject=drawing_object_2)
brep_projection_border_9 = BrepProjectionBorder(Brep=bounding_box_11.Box)  # -> Boundary, Hole, UnionRectangle
dimension_line_attributes_4 = DimensionLineAttributes(AttributesName="Rebar Diameter", DrawingObject=list_item_14)
flatten_tree_14 = FlattenTree(Tree=merge_4, Path="{0}")
curve_closest_point_2 = CurveClosestPoint(Point=drawing_point, Curve=list_item_16)  # -> Point, Parameter, Distance
curve_closest_point_3 = CurveClosestPoint(Point=curve_middle, Curve=brep_projection_border_9.Boundary)  # -> Point, Parameter, Distance
dimension_line = DimensionLine(
    View=section_view_7,
    Points=entwine_2,
    Location=entwine_3,
    DimensionLineAttributes=dimension_line_attributes,
    Insert_always=0,
    Remove_when_input_is_empty=False)
construct_point_4 = ConstructPoint(XCoordinate=deconstruct_5.XComponent, YCoordinate=deconstruct_5.YComponent, ZCoordinate=0)
graft_tree = GraftTree(Tree=curve_middle, IncludeEmptyLists=True, IncludeNullItems=True)
graft_tree_2 = GraftTree(Tree=curve_closest_point_3.Point, IncludeEmptyLists=True, IncludeNullItems=True)
curve_closest_point_4 = CurveClosestPoint(Point=construct_point_4, Curve=find_visible_edges_6.Edges)  # -> Point, Parameter, Distance
placing_type = PlacingType(LeaderType=leader_type, StartPoint=curve_closest_point_2.Point)
match_tree = MatchTree(Tree=graft_tree_2, Guide=graft_tree)
dimension_line_2 = DimensionLine(
    View=section_view_6,
    Points=flatten_tree_14,
    Location=find_visible_edges_7.Edges,
    DimensionLineAttributes=dimension_line_attributes_3,
    Insert_always=0,
    Remove_when_input_is_empty=False)
merge_5 = Merge(Data1=graft_tree, Data2=match_tree)
match_tree_2 = MatchTree(Tree=curve_closest_point_4.Distance, Guide=construct_point_4)
curve_closest_point_5 = CurveClosestPoint(Point=construct_point_4, Curve=find_visible_edges_5.Edges)  # -> Point, Parameter, Distance
explode_tree = ExplodeTree(Data=merge_5)  # -> Branch0, Branch1, Branch2, Branch3
reverse_list = ReverseList(List=merge_5)
panel_6 = Panel(merge_5)
mark_attributes = MarkAttributes(AttributesName="Stirrups", DrawingObject=stirrup)
polyline = PolyLine(Vertices=reverse_list, Closed=False)
match_tree_3 = MatchTree(Tree=curve_closest_point_5.Distance, Guide=construct_point_4)
smaller_than_3 = SmallerThan(FirstNumber=match_tree_2, SecondNumber="75")  # -> SmallerThan, OrEqualTo
flatten_tree_15 = FlattenTree(Tree=polyline, Path="{0}")
smaller_than_4 = SmallerThan(FirstNumber=match_tree_3, SecondNumber="75")  # -> SmallerThan, OrEqualTo
length = Length(Curve=flatten_tree_15)
associative_note = AssociativeNote(
    DrawingObject=stirrup,
    InsertionPoint=drawing_point,
    PlacingType=placing_type,
    MarkAttributes=mark_attributes,
    Remove_when_input_is_empty=False)
dispatch_12 = Dispatch(List=construct_point_4, DispatchPattern=smaller_than_3.SmallerThan)  # -> ListA, ListB
round_2 = Round(Number=length)  # -> Nearest, Floor, Ceiling
shift_paths_3 = ShiftPaths(Data=dispatch_12.ListA, Offset=-1)
deconstruct_mark = DeconstructMark(Mark=associative_note)  # -> DrawingObject, InsertionPoint, PlacingType, MarkAttributes, MarkType, AxisBox, ObjectBox, LeaderLine, IsValid, Content
dispatch_13 = Dispatch(List=construct_point_4, DispatchPattern=smaller_than_4.SmallerThan)  # -> ListA, ListB
create_set_6 = CreateSet(List=round_2.Nearest)  # -> Set, Map
insert_items = InsertItems(List=find_visible_edges_6.Points, Item=shift_paths_3, Indices="1", Wrap=True)
bounding_box_12 = BoundingBox(Content=deconstruct_mark.ObjectBox, Plane=PlaneXY(0, 0, 0))  # -> Box, Box_2
shift_paths_4 = ShiftPaths(Data=dispatch_13.ListA, Offset=-1)
list_length = ListLength(List=create_set_6.Set)
deconstruct_box_11 = DeconstructBox(Box=bounding_box_12.Box)  # -> Plane, X, Y, Z
dimension_line_3 = DimensionLine(
    View=section_view_3,
    Points=insert_items,
    Location=find_visible_edges_6.Edges,
    DimensionLineAttributes=dimension_line_attributes_4,
    Insert_always=0,
    Remove_when_input_is_empty=False)
equality_2 = Equality(FirstNumber=list_length, SecondNumber="1")  # -> Equality, Inequality
insert_items_2 = InsertItems(List=find_visible_edges_5.Points, Item=shift_paths_4, Indices="1", Wrap=True)
deconstruct_domain_9 = DeconstructDomain(Domain=deconstruct_box_11.X)  # -> Start, End
dimension_line_4 = DimensionLine(
    View=section_view_3,
    Points=insert_items_2,
    Location=find_visible_edges_5.Edges,
    DimensionLineAttributes=dimension_line_attributes_4,
    Insert_always=0,
    Remove_when_input_is_empty=False)
stream_gate = StreamGate(Stream=flatten_tree_15, Gate=equality_2.Equality)  # -> Target0, Target1
subtraction_11 = Subtraction(A=deconstruct_domain_9.Start, B=deconstruct_domain_9.End)
absolute_4 = Absolute(Value=subtraction_11)
list_item_17 = ListItem(List=stream_gate.Target1, Index=0, Wrap=True)
division_2 = Division(A=absolute_4, B="2")
relay = Relay([stream_gate.Target0, list_item_17])
unit_x = UnitX(Factor=division_2)
explode_2 = Explode(Curve=relay, Recursive=True)  # -> Segments, Vertices
graft_tree_3 = GraftTree(Tree=relay, IncludeEmptyLists=True, IncludeNullItems=True)
viewing_direction_13 = ViewingDirection({"From Left": {1,0,0}, "From Right": {-1,0,0}, "From Bottom": {0,1,0}, "From Top": {0,-1,0}}, selected="From Bottom")
input_drawings_2 = Panel(list_item_9)
brep_projection_border_10 = BrepProjectionBorder(Brep=brep_join.Breps)  # -> Boundary, Hole, UnionRectangle
deconstruct_vector_5 = DeconstructVector(Vector=subtraction_10)  # -> XComponent, YComponent, ZComponent
move = Move(Geometry=deconstruct_mark.InsertionPoint, Motion=unit_x)  # -> Geometry, Transform
mark_attributes_2 = MarkAttributes(AttributesName=settings_to_use_3, DrawingObject=model_to_drawing_object)
export_pdf = ExportPDF(Drawing=list_item_9, Path=concatenate_6, Settings=settings_to_use_4)
merge_6 = Merge(Data1=move_view_3, Data2=move_view_4)
brep_projection_border_11 = BrepProjectionBorder(Brep=brep_join_2.Breps)  # -> Boundary, Hole, UnionRectangle
placing_type_2 = PlacingType()
create_grid_dimension_lines_4 = CreateGridDimensionLines(relay_2=move_view_5, relay=viewing_direction_10)
volume = Volume(Geometry=flatten(simple_orient_11))  # -> Volume, Centroid
data_dam = DataDam(DataDataA=merge_3, BufferDelay=10000000, BufferMode=0)
flatten_tree_16 = FlattenTree(Tree=deconstruct_3.YComponent, Path="{0}")
drawing_to_model_object_7 = DrawingToModelObject(DrawingPart=search_using_key_16)
output_paths = Panel(export_dwg)
create_grid_dimension_lines_5 = CreateGridDimensionLines(relay_2=move_view_2, relay=viewing_direction_11)
flatten_tree_17 = FlattenTree(Tree=deconstruct_4.YComponent, Path="{0}")
c_script = CSharpScript(ModelObjects=tree_item, Plane=get_coordinate_system.Global)  # -> out, DistinctObjects; inputs ModelObjects: tree, Plane: Plane
# ---------- c_script: C# ----------
// Grasshopper Script Instance
#region Usings
using System;
#r "nuget: Tekla.Structures, 2025.0.0"
#r "nuget: Tekla.Structures.Model, 2025.0.0"
using System.Linq;
using System.Collections;
using System.Collections.Generic;

using Rhino;
using Rhino.Geometry;

using Grasshopper;
using Grasshopper.Kernel;
using Grasshopper.Kernel.Data;
using Grasshopper.Kernel.Types;

using TSM = Tekla.Structures.Model;
using TSG = Tekla.Structures.Geometry3d;
#endregion

public class Script_Instance : GH_ScriptInstance
{
    #region Notes
    /* 
      Members:
        RhinoDoc RhinoDocument
        GH_Document GrasshopperDocument
        IGH_Component Component
        int Iteration

      Methods (Virtual & overridable):
        Print(string text)
        Print(string format, params object[] args)
        Reflect(object obj)
        Reflect(object obj, string method_name)
    */
    #endregion

    private void RunScript(
		DataTree<object> ModelObjects,
		Plane Plane,
		ref object DistinctObjects)
    {
        var teklaObjects = ConvertInput(ModelObjects, Plane);

        var sorted = SortByXCoord(teklaObjects);
        var reducedDuplicates = ReduceLists(teklaObjects);

        var outputTree = new DataTree<TSM.Part>();
        var idx = 0;
        foreach (var result in reducedDuplicates)
        {
            outputTree.AddRange(result.Select(r=>r.Part), new GH_Path(idx));
            idx++;
        }


        DistinctObjects = outputTree;
    }

    private List<List<TeklaPartWithProperties>> ConvertInput(DataTree<object> ModelObjects, Rhino.Geometry.Plane Plane)
    {        
        var teklaObjects = new List<List<TeklaPartWithProperties>>();
        
        foreach (var branch in ModelObjects.Branches)
        {
            var modelObjects = branch.Select(b=> TeklaPartWithProperties.Create(b as TSM.Part, Plane)).ToList();
            teklaObjects.Add(modelObjects);
        }

        return teklaObjects;
    }

    private List<List<TeklaPartWithProperties>> SortByXCoord(List<List<TeklaPartWithProperties>> lists)
    {
        var result = new List<List<TeklaPartWithProperties>>();
        
        return result.OrderBy(r=>r.Min(o=>o.StartPoint.Location.X)).ToList();
    }

    private List<List<TeklaPartWithProperties>> ReduceLists(List<List<TeklaPartWithProperties>> lists)
    {
        var result = new List<List<TeklaPartWithProperties>>();

        foreach (var candidate in lists)
        {
            // Check if this candidate is already represented in the result
            bool alreadyExists = result.Any(existing => existing.First().IsTheSame(candidate.First()));
            if (!alreadyExists)
            {
                result.Add(candidate);
            }
        }

        return result;
    }

    private class TeklaPartWithProperties
    {
        public TSM.Part Part {get; }
        public string PartPosition {get;}
        public Point StartPoint {get;}
         
        private TeklaPartWithProperties(TSM.Part part, string position, Point startPoint)
        {
            Part = part;
            PartPosition = position;
            StartPoint = startPoint;
        }

        public bool IsTheSame(TeklaPartWithProperties other)
        {
            var tolerance = 1;

            return other.PartPosition == this.PartPosition &&
                Math.Abs(other.StartPoint.Location.Y - this.StartPoint.Location.Y) < tolerance &&
                Math.Abs(other.StartPoint.Location.Z - this.StartPoint.Location.Z) < tolerance;
        }

        public static TeklaPartWithProperties Create(TSM.Part part, Plane transformation)
        {
            var position = string.Empty;
            part.GetReportProperty("PART_POS", ref position);

            var originPoint = part.GetCenterLine(true)[0] as TSG.Point;
            var rhinoPoint = new Point(new Point3d(originPoint.X, originPoint.Y, originPoint.Z));
            var matrix = new Grasshopper.Kernel.Types.Transforms.Orientation(transformation, Plane.WorldXY).ToMatrix();
            rhinoPoint.Transform(matrix);

            return new TeklaPartWithProperties(part, position, rhinoPoint);
        }
    }
}
# ---------- end c_script ----------
panel_7 = Panel(tree_item)
output_paths_2 = Panel(export_pdf)
vector_xyz_5 = VectorXYZ(XComponent=0, YComponent=deconstruct_vector_5.YComponent, ZComponent=0)  # -> Vector, Length
find_visible_edges_8 = FindVisibleEdges(Curve=brep_projection_border_10.Boundary, Vector=viewing_direction_12)  # -> Points, Edges, Extremes
modify_mark_2 = ModifyMark(Mark=associative_note, InsertionPoint=move.Geometry)
sort_list_4 = SortList(Keys=flatten_tree_16)  # -> Keys, ValuesValuesA
sort_list_5 = SortList(Keys=flatten_tree_17)  # -> Keys, ValuesValuesA
flatten_tree_18 = FlattenTree(Tree=data_dam, Path="{0}")
find_visible_edges_9 = FindVisibleEdges(Curve=brep_projection_border_11.Boundary, Vector=viewing_direction_13)  # -> Points, Edges, Extremes
tekla_index = TeklaIndex(Set=drawing_to_model_object_7, MainPart=deconstruct_assembly_2.MainPart)  # -> Index, Count
bottom_chord_points = Point(find_visible_edges_8.Points)
associative_note_2 = AssociativeNote(
    DrawingObject=model_to_drawing_object,
    InsertionPoint=volume.Centroid,
    PlacingType=placing_type_2,
    MarkAttributes=mark_attributes_2,
    Remove_when_input_is_empty=False)
drawing_source_8 = DrawingSource(Drawing=flatten_tree_18)
panel_8 = Panel(c_script.DistinctObjects)
move_view_6 = MoveView(View=merge_6, Vector=vector_xyz_5.Vector)
list_item_18 = ListItem(List=sort_list_4.Keys, Index=0, Wrap=True)  # -> Item1, Item
list_item_19 = ListItem(List=sort_list_5.Keys, Index=0, Wrap=True)  # -> Item1, Item
search_using_key_23 = SearchUsingKey(Values=drawing_to_model_object_7, Keys=drawing_to_model_object_7, ContourPlate="Contour Plate")
dimension_line_5 = DimensionLine(
    View=section_view_5,
    Points=explode_2.Vertices,
    Location=graft_tree_3,
    DimensionLineAttributes=dimension_line_attributes_2,
    Insert_always=0,
    Remove_when_input_is_empty=False)
get_children = GetChildren(TeklaObject=drawing_to_model_object_7, ToleranceMm=0.6)
list_item_20 = ListItem(List=drawing_to_model_object_7, Index=tekla_index.Index, Wrap=True)
similarity = Similarity(FirstNumber=list_item_18.Item, SecondNumber=deconstruct_3.YComponent, Threshold=0.1)  # -> Similarity, AbsoluteDifference
loop_keeper = LoopKeeper(Data=model_object_4, Swimlanes=[export_pdf, export_dwg])
similarity_2 = Similarity(FirstNumber=list_item_19.Item1, SecondNumber=deconstruct_4.YComponent, Threshold=0.1)  # -> Similarity, AbsoluteDifference
concatenate_7 = Concatenate(FragmentA=concatenate, FragmentB="Ifcs\")
select_model_object = SelectModelObject(ModelObject=drawing_source_8)
deconstruct_plate = DeconstructPlate(Plate=search_using_key_23, ToleranceMm=0.6)  # -> Boundary, Profile, Attributes, Position, Numbering, Type
convert_to_brep_12 = ConvertToBrep(TeklaObject=list_item_20, SolidType=2, ToleranceMm=0.6)
brep_projection_border_12 = BrepProjectionBorder(MainPartBrep=simple_orient_2)  # -> Boundary, Hole, UnionRectangle
panel_9 = Panel("""#pragma warning disable 1633 // Unrecognized #pragma directive
#pragma reference "Tekla.Macros.Wpf.Runtime"
#pragma reference "Tekla.Macros.Runtime"
#pragma warning restore 1633 // Unrecognized #pragma directive

namespace UserMacros {
    public sealed class Macro {
        [Tekla.Macros.Runtime.MacroEntryPointAttribute()]
        public static void Run(Tekla.Macros.Runtime.IMacroRuntime runtime) {
            Tekla.Macros.Wpf.Runtime.IWpfMacroHost wpf = runtime.Get<Tekla.Macros.Wpf.Runtime.IWpfMacroHost>();
            wpf.InvokeCommand("CommandRepository", "Drawing.DrawingList");
            wpf.View("DocumentManager.MainWindow").Find("AID_DOCMAN_ButtonSelectDrawings").As.Button.Invoke();
        }
    }
}""")
search_using_key_24 = SearchUsingKey(Values=get_children, Keys=get_children, Search="Bolt Array")
viewing_direction_14 = ViewingDirection({"From Left": {1,0,0}, "From Right": {-1,0,0}, "From Bottom": {0,1,0}, "From Top": {0,-1,0}}, selected="From Left")
viewing_direction_15 = ViewingDirection({"From Left": {1,0,0}, "From Right": {-1,0,0}, "From Bottom": {0,1,0}, "From Top": {0,-1,0}}, selected="From Left")
concatenate_8 = Concatenate(FragmentA=concatenate_7, FragmentB="Delivery.ifc")
loop_keeper_2 = LoopKeeper(Data=drawing_source_8, Swimlanes=select_model_object)
concatenate_9 = Concatenate(FragmentA=concatenate, FragmentB="Drawing List.txt")
dispatch_14 = Dispatch(List=find_visible_edges_2.Points, DispatchPattern=similarity.Similarity)  # -> ListA, ListB
simple_orient_22 = SimpleOrient(Geometry=deconstruct_plate.Boundary, Plane=view_properties_8.DisplayCS)
simple_orient_23 = SimpleOrient(Geometry=convert_to_brep_12, Plane=view_properties_8.DisplayCS)
dispatch_15 = Dispatch(List=find_visible_edges.Points, DispatchPattern=similarity_2.Similarity)  # -> ListA, ListB
viewing_direction_16 = ViewingDirection({"From Left": {1,0,0}, "From Right": {-1,0,0}, "From Bottom": {0,1,0}, "From Top": {0,-1,0}}, selected=["From Left", "From Top"])
negative_4 = Negative(Value=viewing_direction_16)
multiplication = Multiplication(A=negative_4, B="500")
clean_tree_4 = CleanTree(RemoveNulls=True, RemoveInvalid=True, RemoveEmpty=True, Tree=search_using_key_24)
list_item_21 = ListItem(List=loop_keeper_2, Index=0, Wrap=True)
brep_projection_border_13 = BrepProjectionBorder(Brep=simple_orient_22)  # -> Boundary, Hole, UnionRectangle
brep_projection_border_14 = BrepProjectionBorder(Brep=simple_orient_23)  # -> Boundary, Hole, UnionRectangle
sort_by_vector = SortByVector(Geometry=dispatch_14.ListA, Vector=viewing_direction_14)  # -> Geometry, Indices
sort_by_vector_2 = SortByVector(Geometry=dispatch_15.ListA, Vector=viewing_direction_15)  # -> Geometry, Indices
bolt_properties = BoltProperties(Bolt=clean_tree_4)  # -> Size, Standard, Type, Positions, Direction
null_item_8 = NullItem(Item=list_item_21)  # -> NullFlags, InvalidFlags, Description
settings_to_use_5 = Panel("Complete Data")
settings_to_use_6 = Panel("Concrete")
input_objects = Panel(loop_keeper)
find_visible_edges_10 = FindVisibleEdges(Curve=brep_projection_border_2.Boundary, Vector=viewing_direction_16)  # -> Points, Edges, Extremes
tree_statistics = TreeStatistics(Tree=find_visible_edges_10.Edges)  # -> Paths, Length, Count
repeat_data = RepeatData(Data=multiplication, Length=tree_statistics.Count)
graft_tree_4 = GraftTree(Tree=repeat_data, IncludeEmptyLists=True, IncludeNullItems=True)
match_tree_4 = MatchTree(Tree=graft_tree_4, Guide=find_visible_edges_10.Edges)
list_length_2 = ListLength(List=loop_keeper)
viewing_direction_17 = ViewingDirection({"From Left": {1,0,0}, "From Right": {-1,0,0}, "From Bottom": {0,1,0}, "From Top": {0,-1,0}}, selected=["From Right", "From Top"])
dimension_line_attributes_5 = DimensionLineAttributes(AttributesName=settings_to_use_6)
simple_orient_24 = SimpleOrient(Geometry=view_properties_8.RestrictionBox, Plane=view_properties_8.DisplayCS)
list_item_22 = ListItem(List=sort_by_vector.Geometry, Index=0, Wrap=True)
region_union = RegionUnion(Curves=brep_projection_border_13.Boundary)
list_item_23 = ListItem(List=sort_by_vector_2.Geometry, Index=0, Wrap=True)
flatten_tree_19 = FlattenTree(Tree=brep_projection_border_14.UnionRectangle, Path="{0}")
viewing_direction_18 = ViewingDirection({"From Left": {1,0,0}, "From Right": {-1,0,0}, "From Bottom": {0,1,0}, "From Top": {0,-1,0}}, selected="From Bottom")
export_ifc = ExportIFC(ModelObject=loop_keeper, Path=concatenate_8, Settings=settings_to_use_5, Export_mode=0)
run_macro = RunMacro(Run=invert(null_item_8.NullFlags), Macro=panel_9, Modeling_macro=2)
move_2 = Move(Geometry=find_visible_edges_10.Edges, Motion=match_tree_4)  # -> Geometry, Transform
top_diagonal_points = Point(list_item_23)
flatten_tree_20 = FlattenTree(Tree=region_union, Path="{0}")
dimension_box = DimensionBox(Rectangle=brep_projection_border.UnionRectangle)
dimension_box_2 = DimensionBox(Rectangle=simple_orient_24)
no_of_exported_assemblies = Panel(list_length_2)
output_paths_3 = Panel(export_ifc)
bottom_diagonal_points = Point(list_item_22)
null_item_9 = NullItem(Item=run_macro)  # -> NullFlags, InvalidFlags, Description
find_visible_edges_11 = FindVisibleEdges(Curve=flatten_tree_20, Vector=viewing_direction_17)  # -> Points, Edges, Extremes
find_visible_edges_12 = FindVisibleEdges(Curve=flatten_tree_19, Vector=viewing_direction_17)  # -> Points, Edges, Extremes
find_visible_edges_13 = FindVisibleEdges(Curve=brep_projection_border_12.Boundary, Vector=viewing_direction_18)  # -> Points, Edges, Extremes
attributes_2 = Panel("Running Dimension")
attributes_3 = Panel("Dual Dimensions")
pad_footing_dimension = DimensionLine(
    View=foundation_view,
    Points=find_visible_edges_10.Points,
    Location=move_2.Geometry,
    DimensionLineAttributes=dimension_line_attributes_5,
    Insert_always=0,
    Remove_when_input_is_empty=False)
loop_keeper_3 = LoopKeeper(
    Data=foundation_view,
    Swimlanes=[pad_footing_dimension, associative_note_2, create_grid_dimension_lines_5, create_grid_dimension_lines_4, create_grid_dimension_lines, create_grid_dimension_lines_3, create_grid_dimension_lines_2])
viewing_direction_19 = ViewingDirection({"From Left": {1,0,0}, "From Right": {-1,0,0}, "From Bottom": {0,1,0}, "From Top": {0,-1,0}}, selected="From Top")
find_visible_edges_14 = FindVisibleEdges(Curve=brep_projection_border_12.Boundary, Vector=viewing_direction_19)  # -> Points, Edges, Extremes
merge_7 = Merge(Data1=find_visible_edges_14.Points, Data2=top_diagonal_points)
flatten_tree_21 = FlattenTree(Tree=merge_7, Path="{0}")
find_visible_edges_15 = FindVisibleEdges(Curve=dimension_box_2, Vector=viewing_direction_17)  # -> Points, Edges, Extremes
dispatch_16 = Dispatch(List="Drawing_List", DispatchPattern=invert(null_item_9.NullFlags))  # -> ListA, ListB
attributes_4 = Panel("Running Dimension")
multiplication_2 = Multiplication(A=viewing_direction_17, B="-50")
merge_8 = Merge(Data1=find_visible_edges_11.Points, Data2=find_visible_edges_12.Points)
find_visible_edges_16 = FindVisibleEdges(Curve=dimension_box, Vector=viewing_direction_18)  # -> Points, Edges, Extremes
merge_9 = Merge(Data1=bottom_diagonal_points, Data2=find_visible_edges_13.Points)
dimension_line_attributes_6 = DimensionLineAttributes(AttributesName=attributes_2)
graft_tree_5 = GraftTree(Tree=multiplication_2, IncludeEmptyLists=True, IncludeNullItems=True)
dimension_line_attributes_7 = DimensionLineAttributes(AttributesName=attributes_4)
flatten_tree_22 = FlattenTree(Tree=merge_9, Path="{0}")
find_visible_edges_17 = FindVisibleEdges(Curve=dimension_box, Vector=viewing_direction_19)  # -> Points, Edges, Extremes
export_report = ExportReport(ModelObject=list_item_21, Path=concatenate_9, Template=dispatch_16.ListA, Export_mode=0)
move_3 = Move(Geometry=find_visible_edges_15.Edges, Motion=graft_tree_5)  # -> Geometry, Transform
deconstruct_6 = Deconstruct(Point=flatten_tree_22)  # -> XComponent, YComponent, ZComponent
top_dimension_line = DimensionLine(
    View=search_using_key_13,
    Points=flatten_tree_21,
    Location=find_visible_edges_17.Edges,
    DimensionLineAttributes=dimension_line_attributes_6,
    Insert_always=0,
    Remove_when_input_is_empty=False)
dimension_line_6 = DimensionLine(View=section_view.View, Points=merge_8, Location=move_3.Geometry, Insert_always=0, Remove_when_input_is_empty=False)
sort_list_6 = SortList(Keys=deconstruct_6.XComponent, ValuesValuesA=flatten_tree_22)  # -> Keys, ValuesValuesA

# ---- group: Positioning wrt to drawing space
merge_10 = Merge(Data1=roof_view, Data2=loop_keeper_3, Data3=move_view_6, Data4=move_view_2, Data5=move_view_5, Data6=plan)
view_frame_geometry_7 = ViewFrameGeometry(View=merge_10)  # -> UpperLeft, UpperRight, LowerLeft, LowerRight, Rectangle, Width, Height, Origin
drawing_size = DrawingSize(Drawing=open_drawing_2)  # -> Width, Height, Rectangle
flatten_tree_23 = FlattenTree(Tree=view_frame_geometry_7.Rectangle, Path="{0}")
box_corners = BoxCorners(Box=drawing_size.Rectangle)  # -> CornerA, CornerB, CornerC, CornerD, CornerE, CornerF, CornerG, CornerH
bounding_box_13 = BoundingBox(Content=flatten_tree_23, Plane=PlaneXY(0, 0, 0), UnionBox=True)  # -> Box, Box_2
box_corners_2 = BoxCorners(Box=bounding_box_13.Box)  # -> CornerA, CornerB, CornerC, CornerD, CornerE, CornerF, CornerG, CornerH
addition_3 = Addition(A=box_corners.CornerD, B="{10,-10,0}")
subtraction_12 = Subtraction(A=addition_3, B=box_corners_2.CornerD)
move_view_7 = MoveView(View=merge_10, Vector=subtraction_12)

# ----
bottom_dimension_line = DimensionLine(
    View=search_using_key_13,
    Points=sort_list_6.ValuesValuesA,
    Location=find_visible_edges_16.Edges,
    DimensionLineAttributes=dimension_line_attributes_7,
    Insert_always=0,
    Remove_when_input_is_empty=False)
viewing_direction_20 = ViewingDirection({"From Left": {1,0,0}, "From Right": {-1,0,0}, "From Bottom": {0,1,0}, "From Top": {0,-1,0}}, selected="From Bottom")
dimension_box_3 = DimensionBox(Rectangle=dimension_box, Lines=find_visible_edges_16.Edges)
find_visible_edges_18 = FindVisibleEdges(Curve=brep_projection_border_12.Boundary, Vector=viewing_direction_18)  # -> Points, Edges, Extremes
find_visible_edges_19 = FindVisibleEdges(Curve=dimension_box_3, Vector=viewing_direction_20)  # -> Points, Edges, Extremes
merge_11 = Merge(Data1=bottom_chord_points, Data2=find_visible_edges_18.Points)  # -> flatten(Result)
deconstruct_7 = Deconstruct(Point=merge_11)  # -> XComponent, YComponent, ZComponent
sort_list_7 = SortList(Keys=deconstruct_7.XComponent, ValuesValuesA=merge_11)  # -> Keys, ValuesValuesA
bottom_chord_dimension_line = DimensionLine(
    View=search_using_key_13,
    Points=sort_list_7.ValuesValuesA,
    Location=find_visible_edges_19.Edges,
    DimensionLineAttributes=dimension_line_attributes_7,
    Insert_always=0,
    Remove_when_input_is_empty=False)

# ---- group: Position formwork views
search_using_key_25 = SearchUsingKey(Values=views_in_drawing_2, Keys=view_properties.Type, Search="FrontView")
view_properties_13 = ViewProperties(View=search_using_key_25)  # -> Type, Name, ViewCS, DisplayCS, RestrictionBox, Scale, Tags
anchor = AutoValueList({"LowerLeft": 0, "UpperLeft": 1, "UpperRight": 2, "LowerRight": 3, "OriginHorizontally": 4, "OriginVertically": 5}, selected="UpperLeft")
search_using_key_26 = SearchUsingKey(Values=search_using_key_25, Keys=view_properties_13.Name, Search="Front formwork")
move_view_to_point = MoveViewToPoint(View=search_using_key_26, Point="5,589,0", Anchor=anchor)
view_frame_geometry_8 = ViewFrameGeometry(View=move_view_to_point)  # -> UpperLeft, UpperRight, LowerLeft, LowerRight, Rectangle, Width, Height, Origin
anchor_2 = AutoValueList({"LowerLeft": 0, "UpperLeft": 1, "UpperRight": 2, "LowerRight": 3, "OriginHorizontally": 4, "OriginVertically": 5}, selected="UpperLeft")
anchor_3 = AutoValueList({"LowerLeft": 0, "UpperLeft": 1, "UpperRight": 2, "LowerRight": 3, "OriginHorizontally": 4, "OriginVertically": 5}, selected="OriginHorizontally")
target_2 = Panel("{200,460,0}")

# ---- group: Position rebar views
search_using_key_27 = SearchUsingKey(Values=views_in_drawing_2, Keys=view_properties.Type, Search="SectionView")
view_properties_14 = ViewProperties(View=search_using_key_27)  # -> Type, Name, ViewCS, DisplayCS, RestrictionBox, Scale, Tags
list_item_24 = ListItem(List=view_properties_14.Tags, Index=0, Wrap=True)
flatten_tree_24 = FlattenTree(Tree=list_item_24, Path="{0}")
search_using_key_28 = SearchUsingKey(Values=search_using_key_27, Keys=flatten_tree_24, Search="REINFORCEMENT")
search_using_key_29 = SearchUsingKey(Values=search_using_key_25, Keys=view_properties_13.Name, Search="Front reinforcement")
search_using_key_30 = SearchUsingKey(Values=search_using_key_27, Keys=flatten_tree_24, Search="FORMWORK")
anchor_4 = AutoValueList({"LowerLeft": 0, "UpperLeft": 1, "UpperRight": 2, "LowerRight": 3, "OriginHorizontally": 4, "OriginVertically": 5}, selected="UpperLeft")
move_view_to_point_2 = MoveViewToPoint(View=search_using_key_29, Point="5,292,0", Anchor=anchor_4)
view_frame_geometry_9 = ViewFrameGeometry(View=move_view_to_point_2)  # -> UpperLeft, UpperRight, LowerLeft, LowerRight, Rectangle, Width, Height, Origin
anchor_5 = AutoValueList({"LowerLeft": 0, "UpperLeft": 1, "UpperRight": 2, "LowerRight": 3, "OriginHorizontally": 4, "OriginVertically": 5}, selected="UpperLeft")
anchor_6 = AutoValueList({"LowerLeft": 0, "UpperLeft": 1, "UpperRight": 2, "LowerRight": 3, "OriginHorizontally": 4, "OriginVertically": 5}, selected="OriginHorizontally")
move_view_to_point_3 = MoveViewToPoint(View=search_using_key_28, Point=view_frame_geometry_9.UpperRight, Anchor=anchor_5)
move_view_to_point_4 = MoveViewToPoint(View=move_view_to_point_3, Point=view_frame_geometry_9.Origin, Anchor=anchor_6)
merge_12 = Merge(Data1=move_view_to_point_2, Data2=move_view_to_point_4)
view_frame_geometry_10 = ViewFrameGeometry(View=merge_12)  # -> UpperLeft, UpperRight, LowerLeft, LowerRight, Rectangle, Width, Height, Origin
bounding_box_14 = BoundingBox(Content=view_frame_geometry_10.Rectangle, Plane=PlaneXY(0, 0, 0), UnionBox=True)  # -> Box, Box_2
area = Area(Geometry=bounding_box_14.Box)  # -> Area, Centroid
target_3 = Panel("{200,180,0}")
subtraction_13 = Subtraction(A=target_3, B=area.Centroid)
deconstruct_vector_6 = DeconstructVector(Vector=subtraction_13)  # -> XComponent, YComponent, ZComponent
vector_xyz_6 = VectorXYZ(XComponent=deconstruct_vector_6.XComponent, YComponent=0, ZComponent=0)  # -> Vector, Length
move_view_8 = MoveView(View=merge_12, Vector=vector_xyz_6.Vector)

# ---- group: Position formwork views (continued)
move_view_to_point_5 = MoveViewToPoint(View=search_using_key_30, Point=view_frame_geometry_8.UpperRight, Anchor=anchor_2)
move_view_to_point_6 = MoveViewToPoint(View=move_view_to_point_5, Point=view_frame_geometry_8.Origin, Anchor=anchor_3)
merge_13 = Merge(Data1=move_view_to_point, Data2=move_view_to_point_6)
view_frame_geometry_11 = ViewFrameGeometry(View=merge_13)  # -> UpperLeft, UpperRight, LowerLeft, LowerRight, Rectangle, Width, Height, Origin
bounding_box_15 = BoundingBox(Content=view_frame_geometry_11.Rectangle, Plane=PlaneXY(0, 0, 0), UnionBox=True)  # -> Box, Box_2
area_2 = Area(Geometry=bounding_box_15.Box)  # -> Area, Centroid
subtraction_14 = Subtraction(A=target_2, B=area_2.Centroid)
deconstruct_vector_7 = DeconstructVector(Vector=subtraction_14)  # -> XComponent, YComponent, ZComponent
vector_xyz_7 = VectorXYZ(XComponent=deconstruct_vector_7.XComponent, YComponent=0, ZComponent=0)  # -> Vector, Length
move_view_9 = MoveView(View=merge_13, Vector=vector_xyz_7.Vector)

# ==== cluster CreateGridDimensionLines
relay = ClusterInput()
relay_2 = ClusterInput()
objects_from_view = ObjectsFromView(View=relay_2, All_objects=0)  # -> DrawingObject, Keys
view_properties = ViewProperties(View=relay_2)  # -> Type, Name, ViewCS, DisplayCS, RestrictionBox, Scale, Tags
search_using_key = SearchUsingKey(Values=objects_from_view.DrawingObject, Keys=objects_from_view.Keys, Search="Grid")  # -> flatten(Match)
list_item = ListItem(List=search_using_key, Index=0, Wrap=True)
drawing_to_model_object = DrawingToModelObject(DrawingPart=list_item)
grid_properties = GridProperties(Grid=drawing_to_model_object)  # -> Surface, Label, XYSurface, XYLabel, NotXYSurface, NotXYLabel
simple_orient = SimpleOrient(Geometry=grid_properties.Surface, Plane=view_properties.DisplayCS)
unit_z = UnitZ(Factor=1)
deconstruct_plane = DeconstructPlane(Plane=simple_orient)  # -> Origin, XAxis, YAxis, ZAxis
dot_product = DotProduct(VectorA=deconstruct_plane.ZAxis, VectorB=unit_z, Unitize=False)
absolute = Absolute(Value=dot_product)
smaller_than = SmallerThan(FirstNumber=absolute, SecondNumber="0.95")  # -> SmallerThan, OrEqualTo
dispatch = Dispatch(List=simple_orient, DispatchPattern=smaller_than.SmallerThan)  # -> ListA, ListB
simple_orient_2 = SimpleOrient(Geometry=view_properties.RestrictionBox, Plane=view_properties.DisplayCS)
plane_plane = PlanePlane(PlaneA=graft(dispatch.ListA), PlaneB=dispatch.ListA)
brep_line = BrepLine(Brep=simple_orient_2, Line=plane_plane, LimitToFirst=False)  # -> Curves, Points
clean_tree = CleanTree(RemoveNulls=True, RemoveInvalid=True, RemoveEmpty=True, Tree=brep_line.Points)
brep_projection_border = BrepProjectionBorder(Brep=simple_orient_2)  # -> Boundary, Hole, UnionRectangle
find_visible_edges = FindVisibleEdges(Curve=brep_projection_border.Boundary, Vector=relay)  # -> Points, Edges, Extremes
negative = Negative(Value=relay)
entwine = Entwine(Branch00=clean_tree, Branch01=clean_tree, FlattenInputs=True)
multiplication = Multiplication(A=negative, B="0")  # -> graft(Result)
move = Move(Geometry=find_visible_edges.Edges, Motion=multiplication)  # -> Geometry, Transform
dimension_line = DimensionLine(View=relay_2, Points=entwine, Location=move.Geometry, Insert_always=0, Remove_when_input_is_empty=False)
dimension_line_2 = ClusterOutput(dimension_line)
