# Grasshopper definition Sample bridge - DRAWING.gh (Grasshopper 1.0.7)
# plug-ins: Grasshopper-Tekla Link 2025.1.19, Grasshopper-Tekla drawing Link 2.23, Pufferfish

create_ga_drawing = BooleanToggle(True)
limit_model_to_needed_parts = ModelObject(
    ModelID="Ponte Pianco - Brazil.db1",
    ModelObjectInfos=["Tekla.Structures.Model.Beam, Tekla.Structures.Model, Version=2025.0.0.0, Culture=neutral, PublicKeyToken=2f04dbe497b71114;15501878-c1a5-47f4-884a-164f2b76ecbd", "Tekla.Structures.Model.Beam, Tekla.Structures.Model, Version=2025.0.0.0, Culture=neutral, PublicKeyToken=2f04dbe497b71114;ef8bc450-2db4-4ff1-9d7f-1c703fc95f06", "Tekla.Structures.Model.Beam, Tekla.Structures.Model, Version=2025.0.0.0, Culture=neutral, PublicKeyToken=2f04dbe497b71114;19a3c3e2-d9aa-465a-8a3e-158c8eb95623", "Tekla.Structures.Model.Beam, Tekla.Structures.Model, Version=2025.0.0.0, Culture=neutral, PublicKeyToken=2f04dbe497b71114;c87fa443-612d-4943-98bf-fa170916ed22", "Tekla.Structures.Model.Beam, Tekla.Structures.Model, Version=2025.0.0.0, Culture=neutral, PublicKeyToken=2f04dbe497b71114;b9270422-4a52-4019-8a1f-c0a839b89d0e", "Tekla.Structures.Model.Beam, Tekla.Structures.Model, Version=2025.0.0.0, Culture=neutral, PublicKeyToken=2f04dbe497b71114;01a7c823-9c8c-43a4-89bf-79c4ca732050"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])
restriction_boxes = ColourSwatch(SwatchColor=RGB(0, 101, 232))
filtering_drawing_objects = ColourSwatch(SwatchColor=RGB(232, 231, 167))
view_positioning = ColourSwatch(SwatchColor=RGB(167, 216, 232))
synchronization = ColourSwatch(SwatchColor=RGB(232, 165, 217))
# This Grasshopper definition
# was developed by Grzegorz Olszewski
# 09. DRAWING LINK
drawing_creation = ColourSwatch(SwatchColor=RGB(167, 178, 232))
view_plane_creation = ColourSwatch(SwatchColor=RGB(0, 232, 135))
grid_dimensions = ColourSwatch(SwatchColor=RGB(167, 232, 168))
view_creation = ColourSwatch(SwatchColor=RGB(232, 207, 167))
dimensioning = ColourSwatch(SwatchColor=RGB(187, 165, 232))
pick_longitudinal_axis = TeklaLine(
    null,
    TeklaLines="-78921.4131181279;-20771.8405348439;-9.09494701772928E-13;-68795.1045863279;-6193.76802568823;-9.09494701772928E-13")
tekla_bounding_box = TeklaBoundingBox(TeklaObject=limit_model_to_needed_parts, SolidType=2, CreateUnionBox=False, ToleranceMm=0.6)

# ---- group: Construct elevation view plane
longitudinal_line = Data(pick_longitudinal_axis)  # disabled
unit_z = UnitZ(Factor=1)  # disabled
end_points = EndPoints(Curve=longitudinal_line)  # -> Start, End; disabled
construct_plane = ConstructPlane(Origin=end_points.Start, XAxis=longitudinal_line, YAxis=unit_z)  # disabled
elevation_view_plane = Data(construct_plane)  # disabled

# ---- group: Create GA drawing
toggle = Data(create_ga_drawing)  # disabled
panel = Panel("standard")  # disabled
panel_2 = Panel("Bridge")  # disabled
create_ga_drawing_2 = CreateGADrawing(Toggle=toggle, Name=panel_2, AttributesName=panel, Remove_when_input_is_empty=False)  # disabled
open_drawing = OpenDrawing(Drawing=create_ga_drawing_2, Show=True)  # disabled
drawing = Data(open_drawing)  # disabled

# ---- group: Calculate restriction box in local CS
tekla_bounding_boxes = Data(tekla_bounding_box)  # disabled
view_plane = Data(elevation_view_plane)  # disabled
simple_orient = SimpleOrient(Geometry=tekla_bounding_boxes, Plane=view_plane)  # disabled
bounding_box = BoundingBox(Content=simple_orient, Plane=PlaneXY(0, 0, 0), UnionBox=True)  # -> Box, Box_2; disabled
restriction_box_for_top_view = Data(bounding_box.Box)  # disabled

# ---- group: Insert elevation view
drawing_2 = Data(drawing)  # disabled
top_view_plane = Data(elevation_view_plane)  # disabled
restriction_box = Data(restriction_box_for_top_view)  # disabled
panel_3 = Panel("ELEVATION")  # disabled
model_view = ModelView(Name=panel_3, ViewCS=top_view_plane, DisplayCS=top_view_plane, RestrictionBox=restriction_box)  # disabled
panel_4 = Panel("ELEVATION")  # disabled
model_view_2 = ModelView(
    Drawing=drawing_2,
    ModelView=model_view,
    AttributesName=panel_4,
    Attributes_by_macro=False,
    Remove_when_input_is_empty=False)  # disabled
elevation_view = Data(model_view_2)  # disabled

# ---- group: Construct top view plane
longitudinal_line_2 = Data(pick_longitudinal_axis)  # disabled
unit_z_2 = UnitZ(Factor=1)  # disabled
end_points_2 = EndPoints(Curve=longitudinal_line_2)  # -> Start, End; disabled
negative = Negative(Value=unit_z_2)  # disabled
cross_product = CrossProduct(VectorA=longitudinal_line_2, VectorB=negative, Unitize=False)  # -> Vector, Length; disabled
construct_plane_2 = ConstructPlane(Origin=end_points_2.Start, XAxis=longitudinal_line_2, YAxis=cross_product.Vector)  # disabled
top_plane = Data(construct_plane_2)  # disabled

# ---- group: Calculate restriction box in local CS
tekla_bounding_boxes_2 = Data(tekla_bounding_box)  # disabled
view_plane_2 = Data(top_plane)  # disabled
simple_orient_2 = SimpleOrient(Geometry=tekla_bounding_boxes_2, Plane=view_plane_2)  # disabled
bounding_box_2 = BoundingBox(Content=simple_orient_2, Plane=PlaneXY(0, 0, 0), UnionBox=True)  # -> Box, Box_2; disabled
restriction_box_for_top_view_2 = Data(bounding_box_2.Box)  # disabled

# ---- group: Grouping parts by name
drawing_object_types = DrawingObjectTypes({"Arc", "Bolt", "Circle", "Cloud", "Connection", "Container View", "Detail Mark", "Dwg Object", "Edge Chamfer", "Grid"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}, selected="Part")  # disabled
view = Data(elevation_view)  # disabled
objects_from_view = ObjectsFromView(View=view, All_objects=0)  # -> DrawingObject, Keys; disabled
search_using_key = SearchUsingKey(Values=objects_from_view.DrawingObject, Keys=objects_from_view.Keys, Search=drawing_object_types)  # disabled
drawing_to_model_object = DrawingToModelObject(DrawingPart=search_using_key)  # disabled
group_objects = GroupObjects(ModelObject=drawing_to_model_object, Group_by_Assembly_Position=2)  # -> ModelObject, Keys; disabled
model_object = Data(group_objects.ModelObject)  # disabled
keys = Data(group_objects.Keys)  # disabled

# ---- group: Grid dimensions
drawing_object_types_2 = DrawingObjectTypes({"Arc", "Bolt", "Circle", "Cloud", "Connection", "Container View", "Detail Mark", "Dwg Object", "Edge Chamfer", "Grid"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}, selected="Grid")  # disabled
view_2 = Data(elevation_view)  # disabled
objects_from_view_2 = ObjectsFromView(View=view_2, All_objects=0)  # -> DrawingObject, Keys; disabled
search_using_key_2 = SearchUsingKey(Values=objects_from_view_2.DrawingObject, Keys=objects_from_view_2.Keys, Search=drawing_object_types_2)  # disabled
drawing_to_model_object_2 = DrawingToModelObject(DrawingPart=search_using_key_2)  # disabled
view_properties = ViewProperties(View=view_2)  # -> Type, Name, ViewCS, DisplayCS, RestrictionBox, Scale, Tags; disabled
grid_properties = GridProperties(Grid=drawing_to_model_object_2)  # -> Surface, Label, XYSurface, XYLabel, NotXYSurface, NotXYLabel; disabled
simple_orient_3 = SimpleOrient(Geometry=grid_properties.NotXYSurface, Plane=view_properties.DisplayCS)  # disabled
brep_projection_border = BrepProjectionBorder(Brep=view_properties.RestrictionBox, Plane=view_properties.DisplayCS)  # -> Boundary, Hole, UnionRectangle; disabled
unit_x = UnitX(Factor=1)  # disabled
deconstruct_plane = DeconstructPlane(Plane=simple_orient_3)  # -> Origin, XAxis, YAxis, ZAxis; disabled
number_slider = Slider(4885, range=0..10000)  # disabled
dot_product = DotProduct(VectorA=deconstruct_plane.ZAxis, VectorB=unit_x, Unitize=False)  # disabled
panel_5 = Panel("0.95")  # disabled
negative_2 = Negative(Value=number_slider)  # disabled
larger_than = LargerThan(FirstNumber=expr("abs(x)", dot_product), SecondNumber=panel_5)  # -> LargerThan, OrEqualTo; disabled
offset_curve = OffsetCurve(Curve=brep_projection_border.Boundary, Plane=PlaneXY(0, 0, 0), Distance=negative_2, BothSides=0, Kinks=0, CapType=1)  # disabled
dispatch = Dispatch(List=deconstruct_plane.Origin, DispatchPattern=larger_than.LargerThan)  # -> ListA, ListB; disabled
viewing_direction = ViewingDirection({"From Left": {1,0,0}, "From Right": {-1,0,0}, "From Bottom": {0,1,0}, "From Top": {0,-1,0}}, selected="From Top")  # disabled
unit_x_2 = UnitX(Factor=1)  # disabled
sort_by_vector = SortByVector(Geometry=dispatch.ListA, Vector=unit_x_2)  # -> Geometry, Indices; disabled
find_visible_edges = FindVisibleEdges(Curve=offset_curve, Vector=viewing_direction)  # -> Points, Edges, Extremes; disabled
dimension_line_attributes = DimensionLineAttributes(DimType=1, ExtensionLineType=1)  # disabled
dimension_line = DimensionLine(
    View=view_2,
    Points=sort_by_vector.Geometry,
    Location=find_visible_edges.Edges,
    DimensionLineAttributes=dimension_line_attributes,
    Insert_always=0,
    Remove_when_input_is_empty=False)  # disabled
dimension_line_2 = Data(dimension_line)  # disabled
geometry = Data(sort_by_vector.Geometry)  # disabled

# ---- group: Insert top view
drawing_3 = Data(drawing)  # disabled
elevation_plane = Data(top_plane)  # disabled
restriction_box_2 = Data(restriction_box_for_top_view_2)  # disabled
panel_6 = Panel("TOP")  # disabled
model_view_3 = ModelView(Name=panel_6, ViewCS=elevation_plane, DisplayCS=elevation_plane, RestrictionBox=restriction_box_2)  # disabled
panel_7 = Panel("PLAN")  # disabled
model_view_4 = ModelView(
    Drawing=drawing_3,
    ModelView=model_view_3,
    AttributesName=panel_7,
    Attributes_by_macro=False,
    Remove_when_input_is_empty=False)  # disabled
model_view_5 = Data(model_view_3)  # disabled
view_3 = Data(model_view_4)  # disabled

# ---- group: Insert foundation view
model_view_6 = Data(model_view_5)  # disabled
drawing_4 = Data(drawing)  # disabled
panel_8 = Panel("PLAN-FDT")  # disabled
model_view_7 = ModelView(
    Drawing=drawing_4,
    ModelView=model_view_6,
    AttributesName=panel_8,
    Attributes_by_macro=False,
    Remove_when_input_is_empty=False)  # disabled
foundation_view = Data(model_view_7)  # disabled

# ---- group: Foundation thickness dimensions
view_4 = Data(elevation_view)  # disabled
values = Data(model_object)  # disabled
keys_2 = Data(keys)  # disabled
panel_9 = Panel("FOUNDATION")  # disabled
search_using_key_3 = SearchUsingKey(Values=values, Keys=keys_2, Search=panel_9)  # disabled
view_properties_2 = ViewProperties(View=view_4)  # -> Type, Name, ViewCS, DisplayCS, RestrictionBox, Scale, Tags; disabled
convert_to_brep = ConvertToBrep(TeklaObject=search_using_key_3, SolidType=2, ToleranceMm=0.6)  # disabled
simple_orient_4 = SimpleOrient(Geometry=convert_to_brep, Plane=view_properties_2.DisplayCS)  # disabled
viewing_direction_2 = ViewingDirection({"From Left": {1,0,0}, "From Right": {-1,0,0}, "From Bottom": {0,1,0}, "From Top": {0,-1,0}}, selected="From Left")  # disabled
brep_projection_border_2 = BrepProjectionBorder(Brep=simple_orient_4)  # -> Boundary, Hole, UnionRectangle; disabled
number_slider_2 = Slider(1887, range=0..10000)  # disabled
negative_3 = Negative(Value=viewing_direction_2)  # disabled
find_visible_edges_2 = FindVisibleEdges(Curve=brep_projection_border_2.Boundary, Vector=viewing_direction_2)  # -> Points, Edges, Extremes; disabled
multiplication = Multiplication(A=negative_3, B=number_slider_2)  # disabled
move = Move(Geometry=find_visible_edges_2.Edges, Motion=multiplication)  # -> Geometry, Transform; disabled
dimension_line_3 = DimensionLine(
    View=view_4,
    Points=find_visible_edges_2.Points,
    Location=move.Geometry,
    Insert_always=0,
    Remove_when_input_is_empty=False)  # disabled
dimension_line_4 = Data(dimension_line_3)  # disabled

# ---- group: Pile level markings
view_5 = Data(elevation_view)  # disabled
values_2 = Data(model_object)  # disabled
keys_3 = Data(keys)  # disabled
panel_10 = Panel("PILE")  # disabled
search_using_key_4 = SearchUsingKey(Values=values_2, Keys=keys_3, Search=panel_10)  # disabled
view_properties_3 = ViewProperties(View=view_5)  # -> Type, Name, ViewCS, DisplayCS, RestrictionBox, Scale, Tags; disabled
graft_tree = GraftTree(Tree=search_using_key_4, IncludeEmptyLists=True, IncludeNullItems=True)  # disabled
part_lines = PartLines(ModelObject=graft_tree, Skip_cuts_and_fittings=0)  # -> RefLine, CenterLine; disabled
simple_orient_5 = SimpleOrient(Geometry=part_lines.CenterLine, Plane=view_properties_3.DisplayCS)  # disabled
end_points_3 = EndPoints(Curve=simple_orient_5)  # -> Start, End; disabled
unit_y = UnitY(Factor=1)  # disabled
merge = Merge(Data1=end_points_3.Start, Data2=end_points_3.End)  # disabled
sort_by_vector_2 = SortByVector(Geometry=merge, Vector=unit_y)  # -> Geometry, Indices; disabled
list_item = ListItem(List=sort_by_vector_2.Geometry, Index=0, Wrap=True)  # disabled
flatten_tree = FlattenTree(Tree=list_item, Path="{0}")  # disabled
deconstruct = Deconstruct(Point=flatten_tree)  # -> XComponent, YComponent, ZComponent; disabled
number_slider_3 = Slider(1615, range=0..10000)  # disabled
number_slider_4 = Slider(771, range=0..10000)  # disabled
construct_point = ConstructPoint(XCoordinate=deconstruct.XComponent, YCoordinate=deconstruct.YComponent, ZCoordinate=0)  # disabled
panel_11 = Panel("10")  # disabled
negative_4 = Negative(Value=number_slider_4)  # disabled
point_groups = PointGroups(Points=construct_point, Distance=panel_11)  # -> Groups, Indices; disabled
vector_xyz = VectorXYZ(XComponent=number_slider_3, YComponent=negative_4, ZComponent=0)  # -> Vector, Length; disabled
list_item_2 = ListItem(List=point_groups.Groups, Index=0, Wrap=True)  # disabled
move_2 = Move(Geometry=list_item_2, Motion=vector_xyz.Vector)  # -> Geometry, Transform; disabled
level_mark = LevelMark(View=view_5, BasePoint=list_item_2, InsertionPoint=move_2.Geometry, Remove_when_input_is_empty=False)  # disabled
level_marks = Data(level_mark)  # disabled

# ---- group: Foundation dimensions
drawing_object_types_3 = DrawingObjectTypes({"Arc", "Bolt", "Circle", "Cloud", "Connection", "Container View", "Detail Mark", "Dwg Object", "Edge Chamfer", "Grid"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}, selected="Part")  # disabled
view_6 = Data(foundation_view)  # disabled
objects_from_view_3 = ObjectsFromView(View=view_6, All_objects=0)  # -> DrawingObject, Keys; disabled
search_using_key_5 = SearchUsingKey(Values=objects_from_view_3.DrawingObject, Keys=objects_from_view_3.Keys, Search=drawing_object_types_3)  # disabled
drawing_to_model_object_3 = DrawingToModelObject(DrawingPart=search_using_key_5)  # disabled
group_objects_2 = GroupObjects(ModelObject=drawing_to_model_object_3, Group_by_Assembly_Position=2)  # -> ModelObject, Keys; disabled
view_properties_4 = ViewProperties(View=view_6)  # -> Type, Name, ViewCS, DisplayCS, RestrictionBox, Scale, Tags; disabled
panel_12 = Panel("FOUNDATION")  # disabled
search_using_key_6 = SearchUsingKey(Values=group_objects_2.ModelObject, Keys=group_objects_2.Keys, Search=panel_12)  # disabled
convert_to_brep_2 = ConvertToBrep(TeklaObject=search_using_key_6, SolidType=2, ToleranceMm=0.6)  # disabled
simple_orient_6 = SimpleOrient(Geometry=convert_to_brep_2, Plane=view_properties_4.DisplayCS)  # disabled
viewing_direction_3 = ViewingDirection({"From Left": {1,0,0}, "From Right": {-1,0,0}, "From Bottom": {0,1,0}, "From Top": {0,-1,0}}, selected=["From Left", "From Bottom"])  # disabled
brep_projection_border_3 = BrepProjectionBorder(Brep=simple_orient_6)  # -> Boundary, Hole, UnionRectangle; disabled
number_slider_5 = Slider(2500, range=0..10000)  # disabled
find_visible_edges_3 = FindVisibleEdges(Curve=brep_projection_border_3.Boundary, Vector=viewing_direction_3)  # -> Points, Edges, Extremes; disabled
negative_5 = Negative(Value=viewing_direction_3)  # disabled
tree_statistics = TreeStatistics(Tree=find_visible_edges_3.Edges)  # -> Paths, Length, Count; disabled
multiplication_2 = Multiplication(A=negative_5, B=number_slider_5)  # disabled
repeat_data = RepeatData(Data=multiplication_2, Length=tree_statistics.Count)  # disabled
graft_tree_2 = GraftTree(Tree=repeat_data, IncludeEmptyLists=True, IncludeNullItems=True)  # disabled
move_3 = Move(Geometry=find_visible_edges_3.Edges, Motion=graft_tree_2)  # -> Geometry, Transform; disabled
dimension_line_5 = DimensionLine(
    View=view_6,
    Points=find_visible_edges_3.Points,
    Location=move_3.Geometry,
    Insert_always=0,
    Remove_when_input_is_empty=False)  # disabled
trim_tree = TrimTree(Tree=dimension_line_5, Depth=1)  # disabled
dimension_link = DimensionLink(DimensionLine=trim_tree, Remove_when_input_is_empty=False)  # disabled
dimension_line_6 = Data(dimension_link)  # disabled

# ---- group: Synchronization for Elevation view
merge_2 = Merge(Data1=dimension_line_2, Data2=dimension_line_4, Data3=level_marks)  # disabled
loop_keeper = LoopKeeper(ElevationView=elevation_view, Swimlanes=merge_2)  # disabled

# ---- group: Elevation view positioning
elevation_view_2 = Data(loop_keeper)  # disabled
null_item = NullItem(Item=elevation_view_2)  # -> NullFlags, InvalidFlags, Description; disabled
active_drawing = ActiveDrawing(Toggle=invert(null_item.NullFlags))  # disabled
drawing_size = DrawingSize(Drawing=active_drawing)  # -> Width, Height, Rectangle; disabled
construct_point_2 = ConstructPoint(XCoordinate=0, YCoordinate=drawing_size.Height, ZCoordinate=0)  # disabled
panel_13 = Panel("5,-5,0")  # disabled
move_4 = Move(Geometry=construct_point_2, Motion=panel_13)  # -> Geometry, Transform; disabled
anchor = AutoValueList({"LowerLeft": 0, "UpperLeft": 1, "UpperRight": 2, "LowerRight": 3, "OriginHorizontally": 4, "OriginVertically": 5}, selected="UpperLeft")  # disabled
move_view_to_point = MoveViewToPoint(View=elevation_view_2, Point=move_4.Geometry, Anchor=anchor)  # disabled
elevation_view_3 = Data(move_view_to_point)  # disabled

# ---- group: Synchronization for foundation view
loop_keeper_2 = LoopKeeper(FoundationView=foundation_view, Swimlanes=dimension_line_6)  # disabled

# ---- group: Mid-deck section
elevation_view_4 = Data(elevation_view)  # disabled
view_properties_5 = ViewProperties(View=elevation_view_4)  # -> Type, Name, ViewCS, DisplayCS, RestrictionBox, Scale, Tags; disabled
simple_orient_7 = SimpleOrient(Geometry=view_properties_5.RestrictionBox, Plane=view_properties_5.DisplayCS)  # disabled
deconstruct_box = DeconstructBox(Box=simple_orient_7)  # -> Plane, X, Y, Z; disabled
number_slider_6 = Slider(6081, range=0..10000)  # disabled
number_slider_7 = Slider(8000, range=0..20000)  # disabled
deconstruct_domain = DeconstructDomain(Domain=deconstruct_box.Y)  # -> Start, End; disabled
unit_y_2 = UnitY(Factor=number_slider_6)  # disabled
construct_point_3 = ConstructPoint(XCoordinate=number_slider_7, YCoordinate=deconstruct_domain.End, ZCoordinate=0)  # disabled
negative_6 = Negative(Value=unit_y_2)  # disabled
move_5 = Move(Geometry=construct_point_3, Motion=negative_6)  # -> Geometry, Transform; disabled
construct_point_4 = ConstructPoint(XCoordinate=0, YCoordinate=0, ZCoordinate=0)  # disabled
panel_14 = Panel("300")  # disabled
panel_15 = Panel("CROSS-SECTION")  # disabled
section_view = SectionView(
    View=elevation_view_4,
    StartPoint=construct_point_3,
    EndPoint=move_5.Geometry,
    InsertionPoint=construct_point_4,
    DepthUp=panel_14,
    DepthDown=panel_14,
    ViewAttributes=panel_15,
    Attributes_by_macro=True,
    Remove_when_input_is_empty=False)  # -> View, Mark; disabled
mid_deck_section_view = Data(section_view.View)  # disabled

# ---- group: Pier section
grid_axis_points = Data(geometry)  # disabled
elevation_view_5 = Data(elevation_view)  # disabled
view_properties_6 = ViewProperties(View=elevation_view_5)  # -> Type, Name, ViewCS, DisplayCS, RestrictionBox, Scale, Tags; disabled
list_item_3 = ListItem(List=grid_axis_points, Index=0, Wrap=True)  # -> Item, Item1; disabled
simple_orient_8 = SimpleOrient(Geometry=view_properties_6.RestrictionBox, Plane=view_properties_6.DisplayCS)  # disabled
deconstruct_box_2 = DeconstructBox(Box=simple_orient_8)  # -> Plane, X, Y, Z; disabled
deconstruct_2 = Deconstruct(Point=list_item_3.Item1)  # -> XComponent, YComponent, ZComponent; disabled
deconstruct_domain_2 = DeconstructDomain(Domain=deconstruct_box_2.Y)  # -> Start, End; disabled
construct_point_5 = ConstructPoint(XCoordinate=deconstruct_2.XComponent, YCoordinate=deconstruct_domain_2.End, ZCoordinate=0)  # disabled
construct_point_6 = ConstructPoint(XCoordinate=deconstruct_2.XComponent, YCoordinate=deconstruct_domain_2.Start, ZCoordinate=0)  # disabled
construct_point_7 = ConstructPoint(XCoordinate=0, YCoordinate=0, ZCoordinate=0)  # disabled
panel_16 = Panel("CROSS-SECTION")  # disabled
panel_17 = Panel("1200")  # disabled
section_view_2 = SectionView(
    View=elevation_view_5,
    StartPoint=construct_point_5,
    EndPoint=construct_point_6,
    InsertionPoint=construct_point_7,
    DepthUp=panel_17,
    DepthDown=panel_17,
    ViewAttributes=panel_16,
    Attributes_by_macro=False,
    Remove_when_input_is_empty=False)  # -> View, Mark; disabled
pier_section_view = Data(section_view_2.View)  # disabled

# ---- group: Top view positioning
top_view = Data(view_3)  # disabled
elevation_view_6 = Data(elevation_view_3)  # disabled
view_frame_geometry = ViewFrameGeometry(ElevationView=elevation_view_6)  # -> UpperLeft, UpperRight, LowerLeft, LowerRight, Rectangle, Width, Height, Origin; disabled
anchor_2 = AutoValueList({"LowerLeft": 0, "UpperLeft": 1, "UpperRight": 2, "LowerRight": 3, "OriginHorizontally": 4, "OriginVertically": 5}, selected="UpperLeft")  # disabled
move_view_to_point_2 = MoveViewToPoint(View=top_view, Point=view_frame_geometry.LowerLeft, Anchor=anchor_2)  # disabled
top_view_2 = Data(move_view_to_point_2)  # disabled

# ---- group: Pier-crosshead filtering
pier_section_view_2 = Data(pier_section_view)  # disabled
objects_from_view_4 = ObjectsFromView(View=pier_section_view_2, All_objects=0)  # -> DrawingObject, Keys; disabled
panel_18 = Panel("Part")  # disabled
search_using_key_7 = SearchUsingKey(Values=objects_from_view_4.DrawingObject, Keys=objects_from_view_4.Keys, Search=panel_18)  # disabled
drawing_to_model_object_4 = DrawingToModelObject(DrawingPart=search_using_key_7)  # disabled
group_objects_3 = GroupObjects(ModelObject=drawing_to_model_object_4, Group_by_Assembly_Position=2)  # -> ModelObject, Keys; disabled
panel_19 = Panel("PIER-CROSSHEAD")  # disabled
search_using_key_8 = SearchUsingKey(Values=group_objects_3.ModelObject, Keys=group_objects_3.Keys, Search=panel_19)  # disabled
tekla_objects = Data(search_using_key_8)  # disabled

# ---- group: Parts grouping by name
mid_deck_section_view_2 = Data(mid_deck_section_view)  # disabled
drawing_object_types_4 = DrawingObjectTypes({"Arc", "Bolt", "Circle", "Cloud", "Connection", "Container View", "Detail Mark", "Dwg Object", "Edge Chamfer", "Grid"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}, selected="Part")  # disabled
objects_from_view_5 = ObjectsFromView(View=mid_deck_section_view_2, All_objects=0)  # -> DrawingObject, Keys; disabled
search_using_key_9 = SearchUsingKey(Values=objects_from_view_5.DrawingObject, Keys=objects_from_view_5.Keys, Search=drawing_object_types_4)  # disabled
drawing_to_model_object_5 = DrawingToModelObject(DrawingPart=search_using_key_9)  # disabled
group_objects_4 = GroupObjects(ModelObject=drawing_to_model_object_5, Group_by_Assembly_Position=2)  # -> ModelObject, Keys; disabled
model_object_2 = Data(group_objects_4.ModelObject)  # disabled
keys_4 = Data(group_objects_4.Keys)  # disabled

# ---- group: Foundation view positioning
foundation_view_2 = Data(loop_keeper_2)  # disabled
top_view_3 = Data(top_view_2)  # disabled
view_frame_geometry_2 = ViewFrameGeometry(TopView=top_view_3)  # -> UpperLeft, UpperRight, LowerLeft, LowerRight, Rectangle, Width, Height, Origin; disabled
anchor_3 = AutoValueList({"LowerLeft": 0, "UpperLeft": 1, "UpperRight": 2, "LowerRight": 3, "OriginHorizontally": 4, "OriginVertically": 5}, selected="UpperLeft")  # disabled
move_view_to_point_3 = MoveViewToPoint(View=foundation_view_2, Point=view_frame_geometry_2.LowerLeft, Anchor=anchor_3)  # disabled
view_frame_geometry_3 = ViewFrameGeometry(View=move_view_to_point_3)  # -> UpperLeft, UpperRight, LowerLeft, LowerRight, Rectangle, Width, Height, Origin; disabled
deconstruct_3 = Deconstruct(Point=view_frame_geometry_3.Origin)  # -> XComponent, YComponent, ZComponent; disabled
deconstruct_4 = Deconstruct(Point=view_frame_geometry_2.Origin)  # -> XComponent, YComponent, ZComponent; disabled
subtraction = Subtraction(A=deconstruct_4.XComponent, B=deconstruct_3.XComponent)  # disabled
construct_point_8 = ConstructPoint(XCoordinate=subtraction, YCoordinate=0, ZCoordinate=0)  # disabled
move_view = MoveView(View=move_view_to_point_3, Vector=construct_point_8)  # disabled
view_frame_geometry_4 = ViewFrameGeometry(View=move_view)  # -> UpperLeft, UpperRight, LowerLeft, LowerRight, Rectangle, Width, Height, Origin; disabled
lower_left_of_foundation_view = Data(view_frame_geometry_4.LowerLeft)  # disabled

# ---- group: Pier-crosshead dimensions
pier_section_view_3 = Data(pier_section_view)  # disabled
tekla_object = Data(tekla_objects)  # disabled
view_properties_7 = ViewProperties(View=pier_section_view_3)  # -> Type, Name, ViewCS, DisplayCS, RestrictionBox, Scale, Tags; disabled
convert_to_brep_3 = ConvertToBrep(TeklaObject=tekla_object, SolidType=2, ToleranceMm=0.6)  # disabled
simple_orient_9 = SimpleOrient(Geometry=convert_to_brep_3, Plane=view_properties_7.DisplayCS)  # disabled
viewing_direction_4 = ViewingDirection({"From Left": {1,0,0}, "From Right": {-1,0,0}, "From Bottom": {0,1,0}, "From Top": {0,-1,0}}, selected="From Right")  # disabled
brep_projection_border_4 = BrepProjectionBorder(Brep=simple_orient_9)  # -> Boundary, Hole, UnionRectangle; disabled
find_visible_edges_4 = FindVisibleEdges(Curve=brep_projection_border_4.Boundary, Vector=viewing_direction_4)  # -> Points, Edges, Extremes; disabled
panel_20 = Panel("{0,0,0}")  # disabled
split_geometry = SplitGeometry(Geometry=find_visible_edges_4.Points, Point=panel_20, Vector=viewing_direction_4)  # -> GeometryA, GeometryB; disabled
find_visible_edges_5 = FindVisibleEdges(Curve=brep_projection_border_4.UnionRectangle, Vector=viewing_direction_4)  # -> Points, Edges, Extremes; disabled
entwine = Entwine(Branch00=split_geometry.GeometryA, Branch01=find_visible_edges_4.Extremes, FlattenInputs=True)  # disabled
tree_statistics_2 = TreeStatistics(Tree=entwine)  # -> Paths, Length, Count; disabled
panel_21 = Panel("-400")  # disabled
panel_22 = Panel("-400")  # disabled
series = Series(Start=panel_22, Step=panel_21, Count=tree_statistics_2.Count)  # disabled
graft_tree_3 = GraftTree(Tree=series, IncludeEmptyLists=True, IncludeNullItems=True)  # disabled
multiplication_3 = Multiplication(A=viewing_direction_4, B=graft_tree_3)  # disabled
move_6 = Move(Geometry=find_visible_edges_5.Edges, Motion=multiplication_3)  # -> Geometry, Transform; disabled
dimension_line_7 = DimensionLine(View=pier_section_view_3, Points=entwine, Location=move_6.Geometry, Insert_always=0, Remove_when_input_is_empty=False)  # disabled

# ---- group: Deck dimensions
keys_5 = Data(keys_4)  # disabled
mid_deck_section_view_3 = Data(mid_deck_section_view)  # disabled
model_object_3 = Data(model_object_2)  # disabled
panel_23 = Panel("DECK")  # disabled
view_properties_8 = ViewProperties(View=mid_deck_section_view_3)  # -> Type, Name, ViewCS, DisplayCS, RestrictionBox, Scale, Tags; disabled
search_using_key_10 = SearchUsingKey(Values=model_object_3, Keys=keys_5, Search=panel_23)  # disabled
convert_to_mesh = ConvertToMesh(TeklaObject=search_using_key_10, SolidType=2, ToleranceMm=0.6)  # disabled
mesh_intersection = MeshIntersection(MeshesA=convert_to_mesh, MeshesB=view_properties_8.RestrictionBox)  # disabled
simple_orient_10 = SimpleOrient(Geometry=mesh_intersection, Plane=view_properties_8.DisplayCS)  # disabled
viewing_direction_5 = ViewingDirection({"From Left": {1,0,0}, "From Right": {-1,0,0}, "From Bottom": {0,1,0}, "From Top": {0,-1,0}}, selected="From Bottom")  # disabled
mesh_projection_border = MeshProjectionBorder(Mesh=simple_orient_10)  # -> Boundary, Hole, UnionRectangle; disabled
find_visible_edges_6 = FindVisibleEdges(Curve=mesh_projection_border.Boundary, Vector=viewing_direction_5)  # -> Points, Edges, Extremes; disabled
find_visible_edges_7 = FindVisibleEdges(Curve=mesh_projection_border.UnionRectangle, Vector=viewing_direction_5)  # -> Points, Edges, Extremes; disabled
entwine_2 = Entwine(Branch00=find_visible_edges_6.Points, Branch01=find_visible_edges_6.Extremes, FlattenInputs=True)  # disabled
number_slider_8 = Slider(500, range=0..2000)  # disabled
number_slider_9 = Slider(370, range=0..2000)  # disabled
tree_statistics_3 = TreeStatistics(Tree=entwine_2)  # -> Paths, Length, Count; disabled
series_2 = Series(Start=number_slider_8, Step=number_slider_9, Count=tree_statistics_3.Count)  # disabled
graft_tree_4 = GraftTree(Tree=series_2, IncludeEmptyLists=True, IncludeNullItems=True)  # disabled
panel_24 = Panel("-1")  # disabled
multiplication_4 = Multiplication(A=viewing_direction_5, B=panel_24, C=graft_tree_4)  # disabled
move_7 = Move(Geometry=find_visible_edges_7.Edges, Motion=multiplication_4)  # -> Geometry, Transform; disabled
dimension_line_8 = DimensionLine(
    View=mid_deck_section_view_3,
    Points=entwine_2,
    Location=move_7.Geometry,
    Insert_always=0,
    Remove_when_input_is_empty=False)  # disabled
dimension_line_9 = Data(dimension_line_8)  # disabled

# ---- group: Synchronization for Pier section view
loop_keeper_3 = LoopKeeper(PierSectionView=pier_section_view, Swimlanes=dimension_line_7)  # disabled

# ---- group: Synchronization for Mid-deck section
loop_keeper_4 = LoopKeeper(MidDeckSectionView=mid_deck_section_view, Swimlanes=dimension_line_9)  # disabled

# ---- group: Mid-deck section positioning
lower_left_of_foundation_view_2 = Data(lower_left_of_foundation_view)  # disabled
mid_deck_section_view_4 = Data(loop_keeper_4)  # disabled
anchor_4 = AutoValueList({"LowerLeft": 0, "UpperLeft": 1, "UpperRight": 2, "LowerRight": 3, "OriginHorizontally": 4, "OriginVertically": 5}, selected="UpperLeft")  # disabled
move_view_to_point_4 = MoveViewToPoint(View=mid_deck_section_view_4, Point=lower_left_of_foundation_view_2, Anchor=anchor_4)  # disabled
view_frame_geometry_5 = ViewFrameGeometry(View=move_view_to_point_4)  # -> UpperLeft, UpperRight, LowerLeft, LowerRight, Rectangle, Width, Height, Origin; disabled
upper_right_of_mid_deck_section = Data(view_frame_geometry_5.UpperRight)  # disabled

# ---- group: Pier section view positioning
upper_right_of_mid_deck_section_2 = Data(upper_right_of_mid_deck_section)  # disabled
pier_section_view_4 = Data(loop_keeper_3)  # disabled
anchor_5 = AutoValueList({"LowerLeft": 0, "UpperLeft": 1, "UpperRight": 2, "LowerRight": 3, "OriginHorizontally": 4, "OriginVertically": 5}, selected="UpperLeft")  # disabled
move_view_to_point_5 = MoveViewToPoint(View=pier_section_view_4, Point=upper_right_of_mid_deck_section_2, Anchor=anchor_5)  # disabled
