# Grasshopper definition Sample bridge - MODEL.gh (Grasshopper 1.0.8)
# plug-ins: Grasshopper-Tekla Link 2025.1.20

deck_height_at_support = Slider(3450, range=1..20000)
transision_exponent = Slider(2, range=0..10)
transision_length = Slider(8000, range=0..20000)
support_length = Slider(4000, range=0..10000)
deck_height = Slider(2000, range=0..10000)

abutment_length = Slider(8000, range=0..20000)
end = Slider(280000, range=0..1000000)
pier_location = Slider(140000, range=0..1000000)
pier_location_2 = Slider(190000, range=0..1000000)
# Variable section params
pier_location_3 = Slider(240000, range=0..1000000)
# Ponte Pianco - Brazil
# Metric units: This example was created using metric (mm) units in the Rhino model. If it is used with imperial units you need to adjust the slider values and referenced geometry to something sensible.
# Default profiles and materials: The profiles and materials used in this example are from the Default environment. If they are missing from the environment you're using, some members might not show up correctly. In that case just change the profiles and materials.
# Pier and pile custom components: The pier and pile custom components are included in the Tekla example model or can be imported separately.
# 2. Stations
# Main stations
start = Slider(100000, range=0..1000000)

# ---- group: Start
number = Number(start)

# ---- group: End
number_2 = Number(end)

# ---- group: Pier Locations
number_3 = Number([pier_location, pier_location_2, pier_location_3])

# ---- group: Abutment length
number_4 = Number(abutment_length)

# ---- group: Section Height
number_5 = Number(deck_height)

# ---- group: Section Height at Support
number_6 = Number(deck_height_at_support)

# ---- group: Support Length
number_7 = Number(support_length)

# ---- group: Transition Length
number_8 = Number(transision_length)

# ---- group: Transition Exponent
number_9 = Number(transision_exponent)

# ---- group: Default section height
number_10 = Number(number_5)

# ---- group: Pier Locations
number_11 = Number(number_3)

# ---- group: Road Alignment Curve / Internalized from Rhino
curve = Curve(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)

# ---- group: Road Alignment Curve / Select in Tekla
constr_polycurve = ConstrPolycurve(
    null,
    ModelID="Ponte Pianco - Brazil.db1",
    ModelObjectInfos="Tekla.Structures.Model.ControlPolycurve, Tekla.Structures.Model, Version=2025.0.0.0, Culture=neutral, PublicKeyToken=2f04dbe497b71114;42e71416-5b66-4235-807f-bfc2e531f001")

# ----
abutment_bearing_location = Slider(-500, range=-10000..10000)
abutment_location_piles = Slider(1500, range=0..10000)
abutment_location_1b = Slider(-999, range=-10000..10000)
abutment_location_1a = Slider(-1000, range=-10000..10000)
abutment_location_2 = Slider(-1500, range=-10000..10000)
abutment_location_0 = Slider(0, range=0..1)
abutment_location_1 = Slider(500, range=1..10000)
abutment_location_2_2 = Slider(2000, range=1..10000)
abutment_location_3 = Slider(3000, range=1..10000)
number_12 = Number(abutment_location_2)
number_13 = Number(abutment_location_1a)
number_14 = Number(abutment_location_1b)
number_15 = Number(abutment_location_0)
number_16 = Number(abutment_location_1)
number_17 = Number(abutment_location_2_2)
number_18 = Number(abutment_location_3)
number_19 = Number(abutment_bearing_location)
number_20 = Number(abutment_location_piles)

# ---- group: Road Alignment Curve
curve_2 = Curve(curve)

# ---- group: Abutment length
number_21 = Number(number_4)

# ---- group: Start
number_22 = Number(number)

# ---- group: End
number_23 = Number(number_2)

# ----
# Abutment locations
merge = Merge(
    Data1=number_12,
    Data2=number_13,
    Data3=number_14,
    Data4=number_15,
    Data5=number_16,
    Data6=number_17,
    Data7=number_18,
    Data8=number_21)  # -> reverse(Result)
subtraction = Subtraction(A=number_23, B=number_21)
addition = Addition(A=number_22, B=number_21)
subtraction_2 = Subtraction(A=addition, B=merge)
addition_2 = Addition(A=subtraction, B=merge)
subtraction_3 = Subtraction(A=addition, B=number_20)
addition_3 = Addition(A=subtraction, B=number_20)
subtraction_4 = Subtraction(A=addition, B=number_19)
addition_4 = Addition(A=subtraction, B=number_19)
entwine = Entwine(Branch00=subtraction_2, Branch01=addition_2, FlattenInputs=True)
entwine_2 = Entwine(Branch00=subtraction_3, Branch01=addition_3, FlattenInputs=True)
entwine_3 = Entwine(Branch00=subtraction_4, Branch01=addition_4, FlattenInputs=True)

# ---- group: Abutment length
number_24 = Number(number_4)

# ---- group: Start
number_25 = Number(number)

# ---- group: End
number_26 = Number(number_2)

# ---- group: Default section height
number_27 = Number(number_10)

# ----
step_size = Slider(2000, range=0..10000)
step_size_2 = Number(step_size)

# ---- group: Start
number_28 = Number(number_25)

# ---- group: End
number_29 = Number(number_26)

# ---- group: Abutment Locations
number_30 = Number(entwine)

# ---- group: Abutment Pile Locations
number_31 = Number(entwine_2)

# ---- group: Abutment Bearing Locations
number_32 = Number(entwine_3)

# ---- group: Start
number_33 = Number(number)

# ---- group: End
number_34 = Number(number_2)

# ---- group: Pier Locations
number_35 = Number(number_3)

# ----
# Parapets
parapet_width = Slider(750, range=1..10000)
integer = Integer(parapet_width)

# ----
# Abutments
height = Slider(2500, range=1..10000)
height_2 = Slider(2500, range=1..10000)
height_3 = Slider(5000, range=1..10000)
side_width = Slider(500, range=1..1000)
height_4 = Slider(5000, range=1..10000)
height_5 = Slider(1500, range=1..10000)
height_6 = Slider(2300, range=1..10000)
height_7 = Slider(1440, range=1..10000)
height_8 = Slider(2300, range=1..10000)
height_9 = Slider(690, range=1..10000)
integer_2 = Integer(side_width)
integer_3 = Integer(height_5)
integer_4 = Integer([height, height_2, height_4, height_3])
integer_5 = Integer([height_7, height_9])
integer_6 = Integer([height_6, height_8])

# ---- group: Abutment locations
number_36 = Number(number_30)

# ---- group: Pier Locations
number_37 = Number(number_35)

# ----
# Loft options
type = AutoValueList({"Normal": 0, "Loose": 1, "Tight": 2, "Straight": 3, "Uniform": 5}, selected="Straight")
closed = AutoValueList({"True", "False"}, selected="False")
loft_options = LoftOptions(Closed=closed, Adjust=False, Rebuild=0, Refit=0, Type=type)

# ---- group: Pier Locations
number_38 = Number(number_3)

# ---- group: Abutment Bearing Locations
number_39 = Number(number_32)

# ---- group: Pier Locations
number_40 = Number(number_3)

# ---- group: Abutment Pile Locations
number_41 = Number(number_31)

# ---- group: Abutment Bearing Locations
number_42 = Number(number_32)

# ----
steps = Slider(6, range=0..10)
number_43 = Number(number_8)
range = Range(Domain=number_43, Steps=steps)
division = Division(A=number_7, B="2")

# ---- group: Height curve for transition to the supports
image_resource = ImageResource("C:\Users\slindho1\Documents\Rhino\___ Ponte Pianco - Brazil\PN.png")
expression = Expression(x=range, L=number_43, b=number_9, H=number_5, A=number_6, Expression="H + (A-H)*(x/L)^b")

# ---- group: Transition locations
number_44 = Number(range)

# ---- group: Support Length Half
number_45 = Number(division)

# ---- group: Transition section heights
number_46 = Number(expression)

# ----
addition_5 = Addition(A=number_45, B=number_44)
negative = Negative(Value=addition_5)
reverse_list = ReverseList(List=number_46)
reverse_list_2 = ReverseList(List=negative)
merge_2 = Merge(Data1=number_46, Data2=reverse_list)
merge_3 = Merge(Data1=reverse_list_2, Data2=addition_5)

# ---- group: Pier section locations - Relative
number_47 = Number(merge_3)

# ---- group: Pier section heights
number_48 = Number(merge_2)

# ---- group: Pier section locations - Relative
number_49 = Number(number_47)

# ---- group: Pier section heights
number_50 = Number(number_48)

# ----
list_length = ListLength(List=number_11)
duplicate_data = DuplicateData(Data=graft(number_50), Number=list_length, Order=True)
addition_6 = Addition(A=graft(number_11), B=number_49)
flip_matrix = FlipMatrix(Data=duplicate_data)

# ---- group: All pier section heights
number_51 = Number(flip_matrix)

# ---- group: All pier section locations - Absolute
number_52 = Number(addition_6)

# ---- group: All pier section heights
number_53 = Number(number_51)

# ---- group: All pier section locations - Absolute
number_54 = Number(number_52)

number_55 = Number(number_54)

# ----
# Deck section heights
entwine_4 = Entwine(Branch0X=number_27, Branch1X=number_53, Branch2X=number_27, FlattenInputs=False)

# ---- group: Section Heights
number_56 = Number(entwine_4)

number_57 = Number(flatten(number_56))

# ----
# Deck
hole_bottom_chamfer_height = Slider(300, range=0..3000)
hole_bottom_chamfer_width = Slider(783, range=0..3000)
hole_top_chamfer_height = Slider(400, range=0..3000)
hole_top_chamfer_width = Slider(700, range=0..3000)
support_chamfer_height = Slider(200, range=0..2000)
support_chamfer_width = Slider(400, range=0..2000)
support_bottom_width = Slider(4000, range=0..10000)
support_top_width = Slider(5200, range=1..30000)
support_height = Slider(2000, range=1..20000)
deck_thickness = Slider(350, range=1..2000)
crossfall_angle = Slider(1.5, range=0..20)
bottom_angle = Slider(4.1, range=0..20)
deck_width = Slider(11000, range=1..50000)
hole_cover = Slider(500, range=1..3000)
integer_7 = Integer(deck_width)
number_58 = Number(crossfall_angle)
integer_8 = Integer(support_top_width)
integer_9 = Integer(support_chamfer_height)
integer_10 = Integer(support_bottom_width)
integer_11 = Integer(hole_top_chamfer_height)
integer_12 = Integer(hole_bottom_chamfer_height)
integer_13 = Integer(deck_thickness)
number_59 = Number(bottom_angle)
integer_14 = Integer(support_chamfer_width)
integer_15 = Integer(number_56)
integer_16 = Integer(hole_cover)
integer_17 = Integer(hole_top_chamfer_width)
integer_18 = Integer(hole_bottom_chamfer_width)

# ---- group: Deck Width
integer_19 = Integer(integer_7)

# ---- group: Crossfall Angle
number_60 = Number(number_58)

# ---- group: Deck Width
integer_20 = Integer(integer_7)

integer_21 = Integer(integer_7)

# ----
# 4. Profiles
radians = Radians(Degrees=number_60)
division_2 = Division(A=integer_21, B="2")
division_3 = Division(A=integer_20, B="2")
tangent = Tangent(Value=radians)
integer_22 = Integer(height)
integer_23 = Integer(height_2)
integer_24 = Integer(height_8)
multiplication = Multiplication(A=division_3, B=tangent)
integer_25 = Integer(integer_24)
profile_catalog = ProfileCatalog(Profile="TT2000*10000-1500-300-4800-0.24-1000-0.25", ToleranceMm=0.6)
merge_4 = Merge(Data1=integer_3, Data2=integer_25, Data3=integer_25)
construct_point = ConstructPoint(XCoordinate=0, YCoordinate=expr("-x", division_2), ZCoordinate=0)
construct_point_2 = ConstructPoint(XCoordinate=expr("-x", multiplication), YCoordinate=expr("-x", division_3), ZCoordinate=0)
construct_point_3 = ConstructPoint(XCoordinate=expr("-x", multiplication), YCoordinate=division_3, ZCoordinate=0)
construct_point_4 = ConstructPoint(XCoordinate=0, YCoordinate=division_2, ZCoordinate=0)
construct_point_5 = ConstructPoint(XCoordinate=0, YCoordinate=0, ZCoordinate=0)
addition_7 = Addition(A=integer_24, B=integer_22)
cluster = Cluster(
    deck_width=integer_7,
    crossfall_angle=number_58,
    deck_thickness=integer_13,
    support_top_width=integer_8,
    bottom_angle_3=number_59,
    support_chamfer_width=integer_14,
    support_chamfer_height=integer_9,
    support_bottom_width=integer_10,
    support_height=integer_15,
    hole_cover=integer_16,
    hole_top_chamfer_height=integer_11,
    hole_top_chamfer_width=integer_17,
    hole_bottom_chamfer_height=integer_12,
    hole_bottom_chamfer_width=integer_18)  # -> flatten(outline_2), flatten(hole_2)
cluster_2 = Cluster_4(deck_width=integer_7, side_width=integer_2, top_offset=integer_24, height=integer_4)
cluster_3 = Cluster_2(deck_width=integer_7, crossfall_angle=number_58, parapet_width=integer)  # -> parapet_1_outline_2, parapet_2_outline_2
cluster_4 = Cluster_3(deck_width=integer_7, crossfall_angle=number_58, height=integer_6)
cluster_5 = Cluster_3(deck_width=integer_7, crossfall_angle=number_58, height=integer_5)
cluster_6 = Cluster_5(deck_width=integer_7, side_width=integer_2, crossfall_angle=number_58, height=merge_4)  # -> side_1_outline_2, side_2_outline_2
number_61 = Number(addition_7)
merge_5 = Merge(Data1=construct_point, Data2=construct_point_4)
merge_6 = Merge(Data1=construct_point_2, Data2=construct_point_5)
merge_7 = Merge(Data1=construct_point_5, Data2=construct_point_3)
entwine_5 = Entwine(Branch00=merge_6, Branch01=merge_7, FlattenInputs=True)
entwine_6 = Entwine(Branch00=cluster_3.parapet_1_outline_2, Branch01=cluster_3.parapet_2_outline_2, FlattenInputs=True)
entwine_7 = Entwine(Branch00=cluster_6.side_1_outline_2, Branch01=cluster_6.side_2_outline_2, FlattenInputs=True)

# ---- group: Abutment Table outlines
hole = Curve(cluster_2)

# ---- group: Abutment Side Outlines
hole_2 = Curve(entwine_7)

# ---- group: Outlines
outline = Curve(cluster.outline_2)

# ---- group: Abutment piece 1 outlines
hole_3 = Curve(cluster_4)

# ---- group: Abutment piece 2 outlines
hole_4 = Curve(cluster_5)

# ---- group: Approach Slab Points
point = Point(merge_5)

# ---- group: Deck Plate Points
point_2 = Point(entwine_5)

# ---- group: Holes
hole_5 = Curve(cluster.hole_2)

# ---- group: Parapet Outlines
hole_6 = Curve(entwine_6)

hole_7 = Curve(hole_6)

# ---- group: Abutment piece 1 outlines
hole_8 = Curve(hole_3)

# ---- group: Abutment piece 2 outlines
hole_9 = Curve(hole_4)

# ---- group: Abutment Side Outlines
hole_10 = Curve(hole_2)

# ---- group: Abutment Table outlines
hole_11 = Curve(hole)

# ---- group: Approach Slab Points
point_3 = Point(point)

# ---- group: Deck Plate Points
point_4 = Point(point_2)

# ---- group: Abutment Height
number_62 = Number(number_61)

number_63 = Number(integer_24)

# ----
# 1. Road Alignment
explode = Explode(Curve=curve_2, Recursive=True)  # -> Segments, Vertices

# ---- group: Project onto XY plane if a planar alignment is desired
xy_plane = XYPlane(Origin=Point(0, 0, 0))
project = Project(Geometry=explode.Vertices, Plane=xy_plane)  # -> Geometry, Transform

# ----
interpolate = Interpolate(Vertices=project.Geometry, Degree=3, Periodic=False, KnotStyle=1)  # -> Curve, Length, Domain
construction_object = ConstructionObject(
    Geometry=interpolate.Curve,
    Color=0,
    LineType=2,
    Remove_when_input_is_empty=False,
    Remove_while_inputs_are_being_modified=False,
    Run_in_background=True,
    ToleranceMm=0.6)

# ---- group: Road Alignment
curve_3 = Curve(interpolate.Curve)

# ---- group: Roadline
curve_4 = Curve(curve_3)

# ---- group: Road Alignment
curve_5 = Curve(curve_3)

# ---- group: Roadline
curve_6 = Curve(curve_5)  # disabled

curve_7 = Curve(curve_3)

curve_8 = Curve(curve_3)

curve_9 = Curve(curve_3)

curve_10 = Curve(curve_3)

curve_11 = Curve(curve_4)

curve_12 = Curve(curve_3)

# ---- group: Road Alignment
curve_13 = Curve(curve_3)

# ----
# Piers
evaluate_length = EvaluateLength(Curve=curve_12, Length=number_38, Normalized=False)  # -> Point, Tangent, Parameter
unit_y = UnitY(Factor=1)
angle = Angle(VectorA=evaluate_length.Tangent, VectorB=unit_y)  # -> Angle, Reflex
degrees = Degrees(Radians=angle.Angle)
position = Position(PlaneOffset=0, RotationOffset=degrees, DepthOffset=0, Position="Center, Mid", ToleranceMm=0.6)
component_catalog = ComponentCatalog(CName="Pier-V1-C", CNumber=-1, CType="CUSTOM_PART", ToleranceMm=0.6, UIName="Pier-V1-C")
component = Component(
    Name=component_catalog,
    Position=flatten(position),
    Line=flatten(evaluate_length.Point),
    Remove_when_input_is_empty=False,
    Remove_while_inputs_are_being_modified=True,
    Run_in_background=True,
    ToleranceMm=0.6)

# ----
# Grid
merge_8 = Merge(Data1=flatten(number_39), Data2=flatten(number_40))
evaluate_curve = EvaluateCurve(Curve=curve_13, Parameter=merge_8)  # -> Point, Tangent, Angle
list_item = ListItem(List=evaluate_curve.Point, Index=0, Wrap=True)  # -> Item, Item1
line = Line(StartPoint=list_item.Item, EndPoint=list_item.Item1)
construct_plane = ConstructPlane(Origin=list_item.Item, XAxis=line, YAxis=Vector(0, 1, 0))
R = Slider(-6000, range=-10000..10000)
cl = Slider(0, range=0..100)
L = Slider(6000, range=0..10000)
curve_closest_point = CurveClosestPoint(Point=evaluate_curve.Point, Curve=line)  # -> Point, Parameter, Distance
deconstruct_plane = DeconstructPlane(Plane=construct_plane)  # -> Origin, XAxis, YAxis, ZAxis
amplitude = Amplitude(Vector=deconstruct_plane.YAxis, Amplitude=[R, cl, L])
move = Move(Geometry=curve_closest_point.Point, Motion=graft(amplitude))  # -> Geometry, Transform
xy_plane_2 = XYPlane(Origin=Point(0, 0, 0))
project_2 = Project(Geometry=move.Geometry, Plane=xy_plane_2)  # -> Geometry, Transform
project_3 = Project(Geometry=construct_plane, Plane=xy_plane_2)  # -> Geometry, Transform
grid = Grid(
    Points=flatten(project_2.Geometry),
    Plane=project_3.Geometry,
    LabelsX="Abt1 P1 P2 P3 Abt2",
    LabelsY="R CL L",
    Remove_when_input_is_empty=False,
    Remove_while_inputs_are_being_modified=False,
    Run_in_background=True,
    ToleranceMm=0.6)

# ---- group: Roadline
curve_14 = Curve(curve_3)

curve_15 = Curve(curve_3)

# ----
# Pour break locations
panel = Panel("{2;*}")
start_offset = Slider(1500, range=0..10000)

# ----
# Deck section locations
addition_8 = Addition(A=number_25, B=number_24)
subtraction_5 = Subtraction(A=number_26, B=number_24)

# ---- group: Deck Start
number_64 = Number(addition_8)

# ---- group: Deck End
number_65 = Number(subtraction_5)

# ----
entwine_8 = Entwine(Branch0X=number_64, Branch1X=number_55, Branch2X=number_65, FlattenInputs=False)
entwine_9 = Entwine(Branch0X=number_28, Branch1X=number_64, Branch2X=number_55, Branch3X=number_65, Branch4X=number_29, FlattenInputs=False)

# ---- group: Section Locations
number_66 = Number(entwine_8)

# ----
split_tree = SplitTree(Data=number_66, Masks=flatten("{0;*}"))  # -> Positive, Negative
split_tree_2 = SplitTree(Data=number_66, Masks=flatten("{1;*}"))  # -> Positive, Negative
split_tree_3 = SplitTree(Data=number_66, Masks=flatten(panel))  # -> Positive, Negative
addition_9 = Addition(A=split_tree.Positive, B=start_offset)
list_item_2 = ListItem(List=split_tree_2.Positive, Index=0, Wrap=True)  # -> Item1, Item
subtraction_6 = Subtraction(A=split_tree_3.Positive, B=start_offset)
entwine_10 = Entwine(Branch0X=addition_9, Branch1X=list_item_2.Item1, Branch2X=subtraction_6, FlattenInputs=False)

# ---- group: Add locations evenly along the roadline - use this for curved bridges!
cluster_7 = Cluster_6(section_locations=entwine_8, section_heights=entwine_4, step_size=step_size_2)  # -> section_locations_4, section_heights_5

# ---- group: Parapet Locations
number_67 = Number(flatten(entwine_9))

# ---- group: Section Locations
number_68 = Number(flatten(entwine_8))

# ---- group: Pour break locations
number_69 = Number(flatten(entwine_10))

# ---- group: Section Heights for curved alignments
number_70 = Number(cluster_7.section_heights_5)

# ---- group: Section Locations for curved alignments
number_71 = Number(cluster_7.section_locations_4)

# ---- group: Section Locations
number_72 = Number(flatten(number_68))

# ---- group: Deck Start
number_73 = Number(addition_8)

# ---- group: Deck End
number_74 = Number(subtraction_5)

# ---- group: Locations
number_75 = Number(number_72)  # disabled

# ---- group: Section Locations
number_76 = Number(number_68)

# ---- group: Pour break locations
number_77 = Number(number_69)

# ---- group: Parapet Locations
number_78 = Number(number_67)

# ----
# 3. Transformation
evaluate_length_2 = EvaluateLength(Curve=curve_6, Length=number_75, Normalized=False)  # -> Point, Tangent, Parameter; disabled
unit_z = UnitZ(Factor=1)  # disabled
perp_frame = PerpFrame(Curve=curve_6, Parameter=evaluate_length_2.Parameter)  # disabled
align_plane = AlignPlane(Plane=perp_frame, Direction=unit_z)  # -> Plane, Angle; disabled
xy_plane_3 = XYPlane(Origin=Point(0, 0, 0))  # disabled
orient = Orient(Source=xy_plane_3, Target=align_plane.Plane)  # -> Geometry, Transform; disabled

# ----
# 3. Transformations
evaluate_length_3 = EvaluateLength(Curve=curve_8, Length=number_76, Normalized=False)  # -> Point, Tangent, Parameter
evaluate_length_4 = EvaluateLength(Curve=curve_7, Length=number_77, Normalized=False)  # -> Point, Tangent, Parameter
evaluate_length_5 = EvaluateLength(Curve=curve_9, Length=number_78, Normalized=False)  # -> Point, Tangent, Parameter
evaluate_length_6 = EvaluateLength(Curve=curve_10, Length=number_36, Normalized=False)  # -> Point, Tangent, Parameter
unit_z_2 = UnitZ(Factor=1)
perp_frame_2 = PerpFrame(Curve=curve_8, Parameter=evaluate_length_3.Parameter)
unit_z_3 = UnitZ(Factor=1)
unit_z_4 = UnitZ(Factor=1)
perp_frame_3 = PerpFrame(Curve=curve_9, Parameter=evaluate_length_5.Parameter)
perp_frame_4 = PerpFrame(Curve=curve_10, Parameter=evaluate_length_6.Parameter)
perp_frame_5 = PerpFrame(Curve=curve_7, Parameter=evaluate_length_4.Parameter)
unit_z_5 = UnitZ(Factor=1)
align_plane_2 = AlignPlane(Plane=perp_frame_2, Direction=unit_z_2)  # -> Plane, Angle
align_plane_3 = AlignPlane(Plane=perp_frame_5, Direction=unit_z_5)  # -> Plane, Angle
align_plane_4 = AlignPlane(Plane=perp_frame_3, Direction=unit_z_3)  # -> Plane, Angle
align_plane_5 = AlignPlane(Plane=perp_frame_4, Direction=unit_z_4)  # -> Plane, Angle
xy_plane_4 = XYPlane(Origin=Point(0, 0, 0))
xy_plane_5 = XYPlane(Origin=Point(0, 0, 0))
xy_plane_6 = XYPlane(Origin=Point(0, 0, 0))
xy_plane_7 = XYPlane(Origin=Point(0, 0, 0))
orient_2 = Orient(Source=xy_plane_4, Target=align_plane_2.Plane)  # -> Geometry, Transform
orient_3 = Orient(Source=xy_plane_5, Target=align_plane_3.Plane)  # -> Geometry, Transform
orient_4 = Orient(Source=xy_plane_6, Target=align_plane_4.Plane)  # -> Geometry, Transform
orient_5 = Orient(Source=xy_plane_7, Target=align_plane_5.Plane)  # -> Geometry, Transform

# ---- group: Sections
transform = Transform(orient_2.Transform)

transform_2 = Transform(orient.Transform)  # disabled

# ----
# 4. Profile
# 1. Road Alignment
# 2. Stations
panel_2 = Panel("TT[WIDTH]*10000-1500-300-4800-0.24-1000-0.25")
panel_3 = Panel("TT2000*10000-1500-300-4800-0.24-1000-0.25")
panel_4 = Panel(number_57)
profile_catalog_2 = ProfileCatalog(Profile="TT2000*10000-1500-300-4800-0.24-1000-0.25", ToleranceMm=0.6)
replace_text = ReplaceText(Text=panel_2, Find="[WIDTH]", Replace=panel_4, RecursiveReplace=False)
panel_5 = Panel(replace_text)
profile_contour = ProfileContour(Profile=panel_5, ProfileContourHighAccuracy=False, ToleranceMm=0.6)  # -> Outline, Holes; disabled
transform_3 = Transform(Geometry=profile_contour.Outline, Transform=transform_2)  # disabled
loft = Loft(Curves=transform_3, Options={Adjust=False, Closed=False, LoftEnds=0, LoftSimp=0, LoftType=3, Rebuild=10, Refit=0.01})  # disabled
cap_holes = CapHoles(Brep=loft)  # disabled
item = Item(
    Geometry=cap_holes,
    MeshingCoarse=True,
    MeshingJagged=False,
    MeshingMinimal=False,
    MeshingSmooth=False,
    Remove_when_input_is_empty=False,
    Remove_while_inputs_are_being_modified=False,
    Run_in_background=True,
    Show_internal_lines_in_Tekla=False,
    ToleranceMm=0.6)  # disabled

# ---- group: Splitters
transform_4 = Transform(orient_3.Transform)

# ---- group: Parapets
transform_5 = Transform(orient_4.Transform)

# ---- group: Abutments
transform_6 = Transform(orient_5.Transform)

# ----
# Abutments
index = Slider(1, range=0..10)
index_2 = Slider(0, range=0..10)
index_3 = Slider(1, range=0..10)
index_4 = Slider(1, range=0..10)
index_5 = Slider(3, range=0..10)
transform_7 = Transform(transform_6)
transform_8 = Transform(transform_6)
transform_9 = Transform(transform_6)
transform_10 = Transform(transform_6)
transform_11 = Transform(transform_6)
entwine_11 = Entwine(Branch00=point_3, Branch01=reverse(point_3), FlattenInputs=True)
list_item_3 = ListItem(List=transform_8, Index=index_2, Wrap=True)  # -> Item1, Item, Item1_2
list_item_4 = ListItem(List=transform_9, Index=index_3, Wrap=True)  # -> Item, Item1, Item2, Item3, Item4, Item5, Item6
list_item_5 = ListItem(List=transform_7, Index=index, Wrap=True)  # -> Item, Item1, Item2
list_item_6 = ListItem(List=transform_10, Index=index_4, Wrap=True)
list_item_7 = ListItem(List=transform_11, Index=index_5, Wrap=True)
explode_tree = ExplodeTree(Data=hole_10)  # -> flatten(Branch0), flatten(Branch1)
entwine_12 = Entwine(Branch0X=transform_7, Branch1X=transform_7, Branch2X=transform_8, Branch3X=transform_8, FlattenInputs=False)
explode_tree_2 = ExplodeTree(Data=list_item_7)  # -> Branch0, Branch1
merge_9 = Merge(Data1=list_item_3.Item, Data2=list_item_3.Item1_2, Data3=list_item_3.Item1)
merge_10 = Merge(Data1=list_item_4.Item, Data2=list_item_4.Item4, Data3=list_item_4.Item5, Data4=list_item_4.Item6)
merge_11 = Merge(Data1=list_item_5.Item, Data2=list_item_5.Item1)
merge_12 = Merge(Data1=list_item_5.Item1, Data2=list_item_5.Item2)
transform_12 = Transform(Geometry=entwine_11, Transform=list_item_6)
point_5 = Point(Point(0, 0, 0))
point_6 = Point(Point(0, 0, 0))
transform_13 = Transform(Geometry=point_4, Transform=explode_tree_2.Branch0)
transform_14 = Transform(Geometry=point_4, Transform=explode_tree_2.Branch1)
transform_15 = Transform(Geometry=point_5, Transform=entwine_12)
transform_16 = Transform(Geometry=explode_tree.Branch0, Transform=merge_9)
transform_17 = Transform(Geometry=explode_tree.Branch1, Transform=merge_9)
transform_18 = Transform(Geometry=point_6, Transform=transform_9)
transform_19 = Transform(Geometry=hole_11, Transform=merge_10)
transform_20 = Transform(Geometry=hole_8, Transform=merge_11)
transform_21 = Transform(Geometry=hole_9, Transform=merge_12)
polyline = PolyLine(Vertices=transform_12, Closed=False)
class = Slider(3, range=0..100)
class_2 = Slider(44, range=0..100)
polyline_2 = PolyLine(Vertices=reverse(transform_14), Closed=False)
unit_z_6 = UnitZ(Factor=Slider(-475, range=-1000..0))
polyline_3 = PolyLine(Vertices=transform_13, Closed=False)
polyline_4 = PolyLine(Vertices=transform_15, Closed=False)
polyline_5 = PolyLine(Vertices=transform_18, Closed=False)
loft_2 = Loft(Curves=transform_17, Options=loft_options)
loft_3 = Loft(Curves=transform_19, Options=loft_options)
loft_4 = Loft(Curves=transform_16, Options=loft_options)
loft_5 = Loft(Curves=transform_20, Options=loft_options)
loft_6 = Loft(Curves=transform_21, Options=loft_options)
move_2 = Move(Geometry=polyline, Motion=unit_z_6)  # -> Geometry, Transform
merge_13 = Merge(Data1=polyline_3, Data2=polyline_2)
cap_holes_2 = CapHoles(Brep=loft_5)
cap_holes_3 = CapHoles(Brep=loft_6)
cap_holes_4 = CapHoles(Brep=[loft_4, loft_2])
cap_holes_5 = CapHoles(Brep=loft_3)
trim_tree = TrimTree(Tree=polyline_4, Depth=1)
part_attributes = PartAttributes(Name="ABUTMENT", Class=class, ToleranceMm=0.6)
part_attributes_2 = PartAttributes(Name="DECK", Class=class_2, ToleranceMm=0.6)
class_3 = Slider(10, range=0..100)
class_4 = Slider(10, range=0..100)
rotation = AutoValueList({"FRONT": 0, "TOP": 1, "BACK": 2, "BELOW": 3}, selected="FRONT")
brep = Brep(cap_holes_2)
brep_2 = Brep(cap_holes_3)
brep_3 = Brep(cap_holes_4)
brep_4 = Brep(cap_holes_5)
line_2 = Line(move_2.Geometry)
line_3 = Line(merge_13)
flip_matrix_2 = FlipMatrix(Data=trim_tree)
position_2 = Position(PlaneOffset=0, Rotation=rotation, RotationOffset=0, DepthOffset=0, Position="Left, Bottom", ToleranceMm=0.6)
position_3 = Position(PlaneOffset=0, RotationOffset=Slider(5, range=0..45), DepthOffset=0, Position="Right, Top", ToleranceMm=0.6)
position_4 = Position(PlaneOffset=0, RotationOffset=0, DepthOffset=Slider(30, range=0..100), Position="Right, Bottom", ToleranceMm=0.6)
part_attributes_3 = PartAttributes(Name="ABUTMENT", Class=class_3, ToleranceMm=0.6)
part_attributes_4 = PartAttributes(Name="ABUTMENT-TABLE", Class=class_4, ToleranceMm=0.6)
merge_14 = Merge(Data1=brep, Data2=brep_2, Data3=brep_3)
merge_15 = Merge(Data1=brep_4)
profile_catalog_3 = ProfileCatalog(Profile="TRPBL200*7500*0*7500", ToleranceMm=0.6)
profile_catalog_4 = ProfileCatalog(Profile="TRPBL300*300*0*150", ToleranceMm=0.6)
profile_catalog_5 = ProfileCatalog(Profile="500*75", ToleranceMm=0.6)
beam = Beam(
    Curve=line_2,
    Profile=profile_catalog_4,
    Attributes=part_attributes,
    Position=position_4,
    Remove_when_input_is_empty=False,
    Remove_while_inputs_are_being_modified=False,
    Run_in_background=True,
    ToleranceMm=0.6)
beam_2 = Beam(
    Curve=line_3,
    Profile=profile_catalog_5,
    Attributes=part_attributes_2,
    Position=position_2,
    Remove_when_input_is_empty=False,
    Remove_while_inputs_are_being_modified=False,
    Run_in_background=True,
    ToleranceMm=0.6)
beam_3 = Beam(
    Curve=line_2,
    Profile=profile_catalog_3,
    Attributes=part_attributes,
    Position=position_3,
    Remove_when_input_is_empty=False,
    Remove_while_inputs_are_being_modified=False,
    Run_in_background=True,
    ToleranceMm=0.6)
item_2 = Item(
    Geometry=merge_15,
    Line=polyline_5,
    Attributes=part_attributes_4,
    MeshingCoarse=True,
    MeshingJagged=False,
    MeshingMinimal=False,
    MeshingSmooth=False,
    Remove_when_input_is_empty=False,
    Remove_while_inputs_are_being_modified=False,
    Run_in_background=True,
    Show_internal_lines_in_Tekla=False,
    ToleranceMm=0.6)
item_3 = Item(
    Geometry=merge_14,
    Line=flip_matrix_2,
    Attributes=part_attributes_3,
    MeshingCoarse=True,
    MeshingJagged=False,
    MeshingMinimal=False,
    MeshingSmooth=False,
    Remove_when_input_is_empty=False,
    Remove_while_inputs_are_being_modified=False,
    Run_in_background=True,
    Show_internal_lines_in_Tekla=False,
    ToleranceMm=0.6)

# ---- group: Splitters
transform_22 = Transform(transform_4)

# ----
# Parapets
post_length_secondary = Slider(210, range=0..1000)
post_length_main = Slider(710, range=0..1000)
construct_domain = ConstructDomain(DomainStart=number_33, DomainEnd=number_34)
divisions = Slider(20, range=0..100)
sub_curve = SubCurve(BaseCurve=curve_4, Domain=construct_domain)
unit_z_7 = UnitZ(Factor=1)
perp_frames = PerpFrames(Curve=sub_curve, Count=divisions, Align=True)  # -> Frames, Parameters
perp_frame_6 = PerpFrame(Curve=curve_11, Parameter=number_37)
align_plane_6 = AlignPlane(Plane=perp_frames.Frames, Direction=unit_z_7)  # -> Plane, Angle
division_4 = Division(A=integer_19, B="2")
deconstruct_plane_2 = DeconstructPlane(Plane=align_plane_6.Plane)  # -> Origin, XAxis, YAxis, ZAxis
negative_2 = Negative(Value=division_4)
amplitude_2 = Amplitude(Vector=deconstruct_plane_2.YAxis, Amplitude=graft([division_4, negative_2]))
move_3 = Move(Geometry=deconstruct_plane_2.Origin, Motion=amplitude_2)  # -> Geometry, Transform
baluster_spacing = Slider(750, range=0..1000)
baluster_width = Slider(220, range=0..1000)
polyline_6 = PolyLine(Vertices=move_3.Geometry, Closed=False)
class_5 = Slider(13, range=0..100)
part_attributes_5 = PartAttributes(Name="PARAPET", Class=class_5, ToleranceMm=0.6)
offset = Slider(170, range=0..1000)
offset_2 = Slider(135, range=0..1000)
offset_3 = Slider(130, range=0..1000)
offset_4 = Slider(505, range=0..1000)
offset_5 = Slider(165, range=0..1000)
offset_6 = Slider(90, range=0..1000)
offset_7 = Slider(0, range=0..1000)
offset_8 = Slider(120, range=0..1000)
offset_9 = Slider(0, range=0..1000)
panel_6 = Panel("""LEFT
RIGHT""")
panel_7 = Panel("""LEFT
RIGHT""")
panel_8 = Panel("""LEFT
RIGHT""")
panel_9 = Panel("""LEFT
RIGHT""")
panel_10 = Panel("""LEFT
RIGHT""")
position_5 = Position(Plane=panel_6, PlaneOffset=offset_2, RotationOffset=0, DepthOffset=0, Position="Center, Top", ToleranceMm=0.6)
position_6 = Position(Plane=panel_7, PlaneOffset=offset_3, RotationOffset=0, DepthOffset=offset_4, Position="Center, Top", ToleranceMm=0.6)
position_7 = Position(Plane=panel_8, PlaneOffset=offset_5, RotationOffset=0, DepthOffset=offset, Position="Center, Top", ToleranceMm=0.6)
position_8 = Position(Plane=panel_9, PlaneOffset=offset_6, RotationOffset=0, DepthOffset=offset_7, Position="Center, Top", ToleranceMm=0.6)
position_9 = Position(Plane=panel_10, PlaneOffset=offset_8, RotationOffset=0, DepthOffset=offset_9, Position="Center, Top", ToleranceMm=0.6)
profile_catalog_6 = ProfileCatalog(Profile="PCTRI170*170*120*30", ToleranceMm=0.6)
profile_catalog_7 = ProfileCatalog(Profile="RCDL120*240-180*180", ToleranceMm=0.6)
profile_catalog_8 = ProfileCatalog(Profile="335*110", ToleranceMm=0.6)
profile_catalog_9 = ProfileCatalog(Profile="900*265", ToleranceMm=0.6)
profile_catalog_10 = ProfileCatalog(Profile="785*200", ToleranceMm=0.6)

# ---- group: Post Length Main
number_79 = Number(post_length_main)

# ---- group: Post Length Secondary
number_80 = Number(post_length_secondary)

# ---- group: Post Length Main
number_81 = Number(number_79)

# ---- group: Post Length Secondary
number_82 = Number(number_80)

# ---- group: Edge lines
curve_16 = Curve(polyline_6)

curve_17 = Curve(curve_16)

# ---- group: Baluster Spacing
number_83 = Number(baluster_spacing)

# ---- group: Baluster Width
number_84 = Number(baluster_width)

# ----
addition_10 = Addition(A=number_79, B=number_80)
curve_plane = CurvePlane(Curve=curve_17, Plane=perp_frame_6)  # -> Points, ParamsC, ParamsP
trim_tree_2 = TrimTree(Tree=curve_plane.ParamsC, Depth=1)
evaluate_curve_2 = EvaluateCurve(Curve=reparameterize(curve_17), Parameter="0")  # -> Point, Tangent, Angle
evaluate_curve_3 = EvaluateCurve(Curve=reparameterize(curve_17), Parameter="1")  # -> Point, Tangent, Angle
evaluate_curve_4 = EvaluateCurve(Curve=curve_17, Parameter=trim_tree_2)  # -> Point, Tangent, Angle
negative_3 = Negative(Value=number_81)
division_5 = Division(A=number_81, B="2")
negative_4 = Negative(Value=division_5)
line_sdl = LineSDL(Start=evaluate_curve_2.Point, Direction=evaluate_curve_2.Tangent, Length=number_81)
line_sdl_2 = LineSDL(Start=evaluate_curve_3.Point, Direction=evaluate_curve_3.Tangent, Length=negative_3)
line_sdl_3 = LineSDL(Start=evaluate_curve_4.Point, Direction=evaluate_curve_4.Tangent, Length=division_5)
line_sdl_4 = LineSDL(Start=evaluate_curve_4.Point, Direction=evaluate_curve_4.Tangent, Length=negative_4)
merge_16 = Merge(Data1=line_sdl, Data2=line_sdl_3)
merge_17 = Merge(Data1=line_sdl_2, Data2=line_sdl_4)
merge_18 = Merge(Data1=graft(line_sdl_4), Data2=graft(line_sdl_3))
flip_curve = FlipCurve(Curve=line_sdl_2)  # -> Curve, Flag
number_85 = Number(number_82)
end_points = EndPoints(Curve=merge_16)  # -> Start, End
end_points_2 = EndPoints(Curve=merge_17)  # -> Start, End
join_curves = JoinCurves(Curves=merge_18, Preserve=False)
line_sdl_5 = LineSDL(Start=end_points.End, Direction=merge_16, Length=number_85)
line_sdl_6 = LineSDL(Start=end_points_2.End, Direction=merge_17, Length=number_85)
trim_tree_3 = TrimTree(Tree=join_curves, Depth=2)
merge_19 = Merge(Data1=line_sdl, Data2=flip_curve.Curve, Data3=trim_tree_3)
flip_curve_2 = FlipCurve(Curve=line_sdl_6)  # -> Curve, Flag
merge_20 = Merge(Data1=line_sdl_5, Data2=flip_curve_2.Curve)
curve_18 = Curve(merge_20)
list_length_2 = ListLength(List=curve_18)
curve_19 = Curve(merge_19)
list_length_3 = ListLength(List=curve_19)
duplicate_data_2 = DuplicateData(Data=graft(position_8), Number=list_length_3, Order=True)
duplicate_data_3 = DuplicateData(Data=graft(position_9), Number=list_length_2, Order=True)
beam_4 = Beam(
    Curve=curve_19,
    Profile=profile_catalog_9,
    Attributes=part_attributes_5,
    Position=duplicate_data_2,
    Remove_when_input_is_empty=False,
    Remove_while_inputs_are_being_modified=False,
    Run_in_background=True,
    ToleranceMm=0.6)
beam_5 = Beam(
    Curve=curve_18,
    Profile=profile_catalog_10,
    Attributes=part_attributes_5,
    Position=duplicate_data_3,
    Remove_when_input_is_empty=False,
    Remove_while_inputs_are_being_modified=False,
    Run_in_background=True,
    ToleranceMm=0.6)

# ---- group: Post Length
number_86 = Number(addition_10)

# ----
negative_5 = Negative(Value=number_86)
extend_curve = ExtendCurve(Curve=curve_16, Type=0, Start=negative_5, End=negative_5)
curve_20 = Curve(extend_curve)
divide_length = DivideLength(Curve=curve_20, Length=number_83)  # -> Points, Tangents, Parameters
line_sdl_7 = LineSDL(Start=divide_length.Points, Direction=divide_length.Tangents, Length=number_84)
curve_21 = Curve(curve_20)
curve_22 = Curve(line_sdl_7)
list_length_4 = ListLength(List=curve_22)
curve_23 = Curve(curve_20)
duplicate_data_4 = DuplicateData(Data=graft(position_7), Number=list_length_4, Order=True)
beam_6 = Beam(
    Curve=curve_21,
    Profile=profile_catalog_6,
    Attributes=part_attributes_5,
    Position=position_5,
    Remove_when_input_is_empty=False,
    Remove_while_inputs_are_being_modified=False,
    Run_in_background=True,
    ToleranceMm=0.6)
beam_7 = Beam(
    Curve=curve_23,
    Profile=profile_catalog_7,
    Attributes=part_attributes_5,
    Position=position_6,
    Remove_when_input_is_empty=False,
    Remove_while_inputs_are_being_modified=False,
    Run_in_background=True,
    ToleranceMm=0.6)
beam_8 = Beam(
    Curve=curve_22,
    Profile=profile_catalog_8,
    Attributes=part_attributes_5,
    Position=duplicate_data_4,
    Remove_when_input_is_empty=False,
    Remove_while_inputs_are_being_modified=False,
    Run_in_background=True,
    ToleranceMm=0.6)

# ----
# Deck
transform_23 = Transform(transform_5)
outline_2 = Curve(outline)
hole_12 = Curve(hole_5)
transform_24 = Transform(transform)
point_7 = Point(Point(0, 0, 0))
point_8 = Point(Point(0, 0, 0))
transform_25 = Transform(Geometry=point_7, Transform=transform_24)
transform_26 = Transform(Geometry=hole_12, Transform=transform_24)
transform_27 = Transform(Geometry=outline_2, Transform=transform_24)
transform_28 = Transform(Geometry=point_8, Transform=transform_23)
transform_29 = Transform(Geometry=hole_7, Transform=transform_23)
rectangle = Rectangle(Plane=PlaneXY(0, 0, 0), XSize="-20000 to 20000", YSize="-20000 to 20000", Radius=0)  # -> Rectangle, Length
polyline_7 = PolyLine(Vertices=transform_25, Closed=False)
transform_30 = Transform(Geometry=rectangle.Rectangle, Transform=transform_22)
polyline_8 = PolyLine(Vertices=transform_28, Closed=False)
loft_7 = Loft(Curves=transform_29, Options=loft_options)
loft_8 = Loft(Curves=transform_26, Options=loft_options)
loft_9 = Loft(Curves=transform_27, Options=loft_options)
curve_plane_2 = CurvePlane(Curve=polyline_7, Plane=transform_30)  # -> flatten(Points), ParamsC, ParamsP
end_points_3 = EndPoints(Curve=polyline_7)  # -> Start, End
cap_holes_6 = CapHoles(Brep=loft_7)
split_brep_multiple = SplitBrepMultiple(Brep=loft_9, Cutters=transform_30)
split_brep_multiple_2 = SplitBrepMultiple(Brep=loft_8, Cutters=transform_30)
merge_21 = Merge(Data1=flatten(end_points_3.Start), Data2=flatten(curve_plane_2.Points), Data3=flatten(end_points_3.End))
cap_holes_7 = CapHoles(Brep=split_brep_multiple_2)
cap_holes_8 = CapHoles(Brep=split_brep_multiple)
polyline_9 = PolyLine(Vertices=merge_21, Closed=False)
class_6 = Slider(13, range=0..100)
solid_difference = SolidDifference(BrepsA=cap_holes_8, BrepsB=cap_holes_7)
explode_2 = Explode(Curve=polyline_9, Recursive=True)  # -> Segments, Vertices
brep_5 = Brep(solid_difference)
brep_6 = Brep(cap_holes_6)
part_attributes_6 = PartAttributes(Name="PARAPET", Class=class_6, ToleranceMm=0.6)
part_attributes_7 = PartAttributes(Name="DECK", ToleranceMm=0.6)
item_4 = Item(
    Geometry=brep_6,
    Line=polyline_8,
    Attributes=part_attributes_6,
    MeshingCoarse=True,
    MeshingJagged=False,
    MeshingMinimal=False,
    MeshingSmooth=False,
    Remove_when_input_is_empty=False,
    Remove_while_inputs_are_being_modified=False,
    Run_in_background=True,
    Show_internal_lines_in_Tekla=False,
    ToleranceMm=0.6)

# ---- group: Find the reference line that's closest to each brep, since Split Brep Multiple isn't deterministic
volume = Volume(Geometry=cap_holes_7)  # -> Volume, Centroid
curve_middle = CurveMiddle(Curve=explode_2.Segments)
closest_point = ClosestPoint(Point=volume.Centroid, Cloud=curve_middle)  # -> ClosestPoint, CPIndex, Distance
list_item_8 = ListItem(List=explode_2.Segments, Index=closest_point.CPIndex, Wrap=True)

# ----
item_5 = Item(
    Geometry=brep_5,
    Line=list_item_8,
    Attributes=part_attributes_7,
    MeshingCoarse=True,
    MeshingJagged=False,
    MeshingMinimal=False,
    MeshingSmooth=False,
    Remove_when_input_is_empty=False,
    Remove_while_inputs_are_being_modified=False,
    Run_in_background=True,
    Show_internal_lines_in_Tekla=False,
    ToleranceMm=0.6)

# ----
# Piles
number_of_piles = Slider(5, range=0..10)
pile_spacing = Slider(2250, range=0..10000)
negative_6 = Negative(Value=number_62)
evaluate_length_7 = EvaluateLength(Curve=curve_14, Length=number_41, Normalized=False)  # -> Point, Tangent, Parameter
unit_y_2 = UnitY(Factor=1)
unit_z_8 = UnitZ(Factor=negative_6)
angle_2 = Angle(VectorA=evaluate_length_7.Tangent, VectorB=unit_y_2)  # -> Angle, Reflex
move_4 = Move(Geometry=evaluate_length_7.Point, Motion=unit_z_8)  # -> Geometry, Transform
degrees_2 = Degrees(Radians=angle_2.Angle)
component_catalog_2 = ComponentCatalog(CName="PilesV1", CNumber=-1, CType="CUSTOM_PART", ToleranceMm=0.6, UIName="PilesV1")

# ---- group: Number of Piles
integer_26 = Integer(number_of_piles)

# ---- group: Pile Spacing
number_87 = Number(pile_spacing)

# ----
subtraction_7 = Subtraction(A=integer_26, B="1")
multiplication_2 = Multiplication(A=number_87, B=subtraction_7)
division_6 = Division(A=multiplication_2, B="2")
negative_7 = Negative(Value=division_6)
series = Series(Start=negative_7, Step=number_87, Count=integer_26)
duplicate_data_5 = DuplicateData(Data=move_4.Geometry, Number=integer_26, Order=True)
position_10 = Position(PlaneOffset=0, RotationOffset=degrees_2, DepthOffset=series, Position="Center, Mid", ToleranceMm=0.6)
component_2 = Component(
    Name=component_catalog_2,
    Position=flatten(position_10),
    Line=flatten(duplicate_data_5),
    Remove_when_input_is_empty=False,
    Remove_while_inputs_are_being_modified=True,
    Run_in_background=True,
    ToleranceMm=0.6)

# ----
# Bearings
number_of_bearings = Slider(3, range=0..10)
bearing_spacing = Slider(1700, range=0..10000)
negative_8 = Negative(Value=number_63)
evaluate_length_8 = EvaluateLength(Curve=curve_15, Length=number_42, Normalized=False)  # -> Point, Tangent, Parameter
unit_y_3 = UnitY(Factor=1)
unit_z_9 = UnitZ(Factor=negative_8)
angle_3 = Angle(VectorA=evaluate_length_8.Tangent, VectorB=unit_y_3)  # -> Angle, Reflex
move_5 = Move(Geometry=evaluate_length_8.Point, Motion=unit_z_9)  # -> Geometry, Transform
degrees_3 = Degrees(Radians=angle_3.Angle)
component_catalog_3 = ComponentCatalog(CName="BEARING2", CNumber=-1, CType="CUSTOM_PART", ToleranceMm=0.6, UIName="BEARING2")

# ---- group: Number of Bearings
integer_27 = Integer(number_of_bearings)

# ---- group: Bearing Spacing
number_88 = Number(bearing_spacing)

# ----
subtraction_8 = Subtraction(A=integer_27, B="1")
multiplication_3 = Multiplication(A=number_88, B=subtraction_8)
division_7 = Division(A=multiplication_3, B="2")
negative_9 = Negative(Value=division_7)
series_2 = Series(Start=negative_9, Step=number_88, Count=integer_27)
duplicate_data_6 = DuplicateData(Data=move_5.Geometry, Number=integer_27, Order=True)
position_11 = Position(PlaneOffset=0, RotationOffset=degrees_3, DepthOffset=series_2, Position="Center, Mid", ToleranceMm=0.6)
component_3 = Component(
    Name=component_catalog_3,
    Position=flatten(position_11),
    Line=flatten(duplicate_data_6),
    Remove_when_input_is_empty=False,
    Remove_while_inputs_are_being_modified=True,
    Run_in_background=True,
    ToleranceMm=0.6)

# ==== cluster Cluster
support_top_width = ClusterInput()
support_height = ClusterInput()

# ---- group: Make the support top width change as the profile depth changes / Support Height
bottom_angle = Number(support_height)

# ---- group: Make the support top width change as the profile depth changes
support_top_width_2 = Integer(support_top_width)
bounds = Bounds(Numbers=bottom_angle)
factor = Slider(0.13, range=0..1)
deconstruct_domain = DeconstructDomain(Domain=bounds)  # -> Start, End
division = Division(A=bottom_angle, B=deconstruct_domain.Start)
subtraction = Subtraction(A=division, B="1")
multiplication = Multiplication(A=subtraction, B=factor)
addition = Addition(A=multiplication, B="1")
multiplication_2 = Multiplication(A=support_top_width_2, B=addition)

# ---- group: Make the support top width change as the profile depth changes / Support Top Width
bottom_angle_2 = Number(multiplication_2)

# ----
deck_width = ClusterInput()
crossfall_angle = ClusterInput()
deck_thickness = ClusterInput()
bottom_angle_3 = ClusterInput()
support_chamfer_width = ClusterInput()
support_chamfer_height = ClusterInput()
support_bottom_width = ClusterInput()
hole_cover = ClusterInput()
hole_top_chamfer_height = ClusterInput()
hole_top_chamfer_width = ClusterInput()
hole_bottom_chamfer_height = ClusterInput()
hole_bottom_chamfer_width = ClusterInput()
deck_width_2 = Integer(deck_width)
crossfall_angle_2 = Number(crossfall_angle)
deck_thickness_2 = Integer(deck_thickness)
bottom_angle_4 = Number(bottom_angle_3)
support_top_width_3 = Integer(bottom_angle_2)
support_chamfer_width_2 = Integer(support_chamfer_width)
support_chamfer_height_2 = Integer(support_chamfer_height)
support_bottom_width_2 = Integer(support_bottom_width)
support_height_2 = Integer(support_height)
hole_cover_2 = Integer(hole_cover)
hole_top_chamfer_height_2 = Integer(hole_top_chamfer_height)
hole_top_chamfer_width_2 = Integer(hole_top_chamfer_width)
hole_bottom_chamfer_height_2 = Integer(hole_bottom_chamfer_height)
hole_bottom_chamfer_width_2 = Integer(hole_bottom_chamfer_width)
radians = Radians(Degrees=bottom_angle_4)
radians_2 = Radians(Degrees=crossfall_angle_2)
subtraction_2 = Subtraction(A=support_height_2, B=hole_cover_2)
division_2 = Division(A=support_bottom_width_2, B="2")

# ---- group: y1, y2
division_3 = Division(A=deck_width_2, B="2")

# ----
tangent = Tangent(Value=radians)
tangent_2 = Tangent(Value=radians_2)

# ---- group: xh4
number = Number(subtraction_2)

# ----
division_4 = Division(A=support_top_width_3, B="2")
number_2 = Number(division_3)
subtraction_3 = Subtraction(A=number_2, B=division_4)

# ---- group: x1
multiplication_3 = Multiplication(A=division_3, B=tangent_2)

# ----
multiplication_4 = Multiplication(A=subtraction_3, B=tangent)
subtraction_4 = Subtraction(A=subtraction_3, B=support_chamfer_width_2)

# ---- group: x2
addition_2 = Addition(A=multiplication_3, B=deck_thickness_2)

# ---- group: x virtual
addition_3 = Addition(A=addition_2, B=multiplication_4)

# ---- group: y virtual
number_3 = Number(division_4)

# ---- group: x5
number_4 = Number(support_height_2)

# ---- group: y5
number_5 = Number(division_2)

# ---- group: Chamfer points
construct_point = ConstructPoint(XCoordinate=expr("-x", addition_3), YCoordinate=expr("-x", number_3), ZCoordinate=0)
construct_point_2 = ConstructPoint(XCoordinate=expr("-x", addition_3), YCoordinate=number_3, ZCoordinate=0)

# ----
subtraction_5 = Subtraction(A=number_3, B=hole_cover_2)
multiplication_5 = Multiplication(A=subtraction_4, B=tangent)

# ---- group: dy
subtraction_6 = Subtraction(A=number_3, B=division_2)

# ---- group: dx
subtraction_7 = Subtraction(A=number_4, B=addition_3)

# ---- group: x3
addition_4 = Addition(A=addition_2, B=multiplication_5)

# ---- group: y3
addition_5 = Addition(A=division_4, B=support_chamfer_width_2)

# ---- group: k4-5
division_5 = Division(A=subtraction_6, B=subtraction_7)

# ----
multiplication_6 = Multiplication(A=division_5, B=hole_top_chamfer_height_2)
multiplication_7 = Multiplication(A=division_5, B=support_chamfer_height_2)

# ---- group: xh2
addition_6 = Addition(A=hole_cover_2, B=hole_top_chamfer_height_2)

# ---- group: yh2
subtraction_8 = Subtraction(A=subtraction_5, B=multiplication_6)

# ---- group: xh3
subtraction_9 = Subtraction(A=number, B=hole_bottom_chamfer_height_2)

# ----
subtraction_10 = Subtraction(A=number, B=subtraction_9)
subtraction_11 = Subtraction(A=subtraction_9, B=addition_6)
multiplication_8 = Multiplication(A=division_5, B=subtraction_10)
multiplication_9 = Multiplication(A=division_5, B=subtraction_11)

# ---- group: yh3
subtraction_12 = Subtraction(A=subtraction_8, B=multiplication_9)

# ---- group: yh virtual
subtraction_13 = Subtraction(A=subtraction_12, B=multiplication_8)

# ---- group: yh4
subtraction_14 = Subtraction(A=subtraction_13, B=hole_bottom_chamfer_width_2)

# ----
subtraction_15 = Subtraction(A=subtraction_5, B=hole_top_chamfer_width_2)

# ---- group: x4
addition_7 = Addition(A=support_chamfer_height_2, B=addition_3)

# ---- group: y4
subtraction_16 = Subtraction(A=number_3, B=multiplication_7)

# ----
construct_point_3 = ConstructPoint(XCoordinate=expr("-x", hole_cover_2), YCoordinate=0, ZCoordinate=0)
construct_point_4 = ConstructPoint(XCoordinate=expr("-x", hole_cover_2), YCoordinate=expr("-x", subtraction_15), ZCoordinate=0)
construct_point_5 = ConstructPoint(XCoordinate=expr("-x", hole_cover_2), YCoordinate=subtraction_15, ZCoordinate=0)
construct_point_6 = ConstructPoint(XCoordinate=expr("-x", addition_6), YCoordinate=expr("-x", subtraction_8), ZCoordinate=0)
construct_point_7 = ConstructPoint(XCoordinate=expr("-x", addition_6), YCoordinate=subtraction_8, ZCoordinate=0)
construct_point_8 = ConstructPoint(XCoordinate=expr("-x", subtraction_9), YCoordinate=expr("-x", subtraction_12), ZCoordinate=0)
construct_point_9 = ConstructPoint(XCoordinate=expr("-x", subtraction_9), YCoordinate=subtraction_12, ZCoordinate=0)
construct_point_10 = ConstructPoint(XCoordinate=expr("-x", number), YCoordinate=expr("-x", subtraction_14), ZCoordinate=0)
construct_point_11 = ConstructPoint(XCoordinate=expr("-x", number), YCoordinate=subtraction_14, ZCoordinate=0)
construct_point_12 = ConstructPoint(XCoordinate=expr("-x", multiplication_3), YCoordinate=expr("-x", division_3), ZCoordinate=0)
construct_point_13 = ConstructPoint(XCoordinate=expr("-x", multiplication_3), YCoordinate=division_3, ZCoordinate=0)
construct_point_14 = ConstructPoint(XCoordinate=expr("-x", addition_2), YCoordinate=expr("-x", division_3), ZCoordinate=0)
construct_point_15 = ConstructPoint(XCoordinate=expr("-x", addition_2), YCoordinate=division_3, ZCoordinate=0)
construct_point_16 = ConstructPoint(XCoordinate=expr("-x", addition_4), YCoordinate=expr("-x", addition_5), ZCoordinate=0)
construct_point_17 = ConstructPoint(XCoordinate=expr("-x", addition_4), YCoordinate=addition_5, ZCoordinate=0)
construct_point_18 = ConstructPoint(XCoordinate=expr("-x", addition_7), YCoordinate=expr("-x", subtraction_16), ZCoordinate=0)
construct_point_19 = ConstructPoint(XCoordinate=expr("-x", addition_7), YCoordinate=subtraction_16, ZCoordinate=0)
construct_point_20 = ConstructPoint(XCoordinate=expr("-x", number_4), YCoordinate=expr("-x", number_5), ZCoordinate=0)
construct_point_21 = ConstructPoint(XCoordinate=expr("-x", number_4), YCoordinate=number_5, ZCoordinate=0)
# Profile points
construct_point_22 = ConstructPoint(XCoordinate=0, YCoordinate=0, ZCoordinate=0)
point = Point(construct_point_3)
point_2 = Point(construct_point_4)
point_3 = Point(construct_point_5)
point_4 = Point(construct_point_6)
point_5 = Point(construct_point_7)
point_6 = Point(construct_point_8)
point_7 = Point(construct_point_9)
point_8 = Point(construct_point_10)
point_9 = Point(construct_point_11)
point_10 = Point(construct_point_22)
point_11 = Point(construct_point_12)
point_12 = Point(construct_point_13)
point_13 = Point(construct_point_14)
point_14 = Point(construct_point_15)
point_15 = Point(construct_point_16)
point_16 = Point(construct_point_17)
point_17 = Point(construct_point_18)
point_18 = Point(construct_point_19)
point_19 = Point(construct_point_20)
point_20 = Point(construct_point_21)
# Duplicates single item input points
# to match tree structure input points
cross_reference = CrossReference(
    ListA=graft(point_10),
    ListB=graft(point_11),
    ListC=graft(point_13),
    ListD=graft(point_15),
    ListE=graft(point_17),
    ListF=graft(point_19),
    ListG=graft(point_20),
    ListH=graft(point_18),
    ListI=graft(point_16),
    ListJ=graft(point_14),
    ListK=graft(point_12),
    CrossMode=1)  # -> ListA, ListB, ListC, ListD, ListE, ListF, ListG, ListH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
cross_reference_2 = CrossReference(
    ListA=graft(point),
    ListB=graft(point_2),
    ListC=graft(point_4),
    ListD=graft(point_6),
    ListE=graft(point_8),
    ListF=graft(point_9),
    ListG=graft(point_7),
    ListH=graft(point_5),
    ListI=graft(point_3),
    CrossMode=1)  # -> ListA, ListB, ListC, ListD, ListE, ListF, ListG, ListH, ListI
merge = Merge(
    Data1=cross_reference.ListA,
    Data2=cross_reference.ListB,
    Data3=cross_reference.ListC,
    Data4=cross_reference.ListD,
    Data5=cross_reference.ListE,
    Data6=cross_reference.ListF,
    Data7=cross_reference.ListG,
    Data8=cross_reference.ListH,
    Data9=cross_reference.ListI,
    Data10=cross_reference.ListJ,
    Data11=cross_reference.ListK)
merge_2 = Merge(
    Data1=cross_reference_2.ListA,
    Data2=cross_reference_2.ListB,
    Data3=cross_reference_2.ListC,
    Data4=cross_reference_2.ListD,
    Data5=cross_reference_2.ListE,
    Data6=cross_reference_2.ListF,
    Data7=cross_reference_2.ListG,
    Data8=cross_reference_2.ListH,
    Data9=cross_reference_2.ListI)
polyline = PolyLine(Vertices=merge_2, Closed=True)
param_viewer = ParamViewer(merge)
polyline_2 = PolyLine(Vertices=merge, Closed=True)
trim_tree = TrimTree(Tree=polyline, Depth=1)
point_list = PointList(Points=merge, Size=Slider(256, range=0..1000))
trim_tree_2 = TrimTree(Tree=polyline_2, Depth=1)
hole = Curve(trim_tree)
hole_2 = ClusterOutput(hole)
outline = Curve(trim_tree_2)
outline_2 = ClusterOutput(outline)

# ==== cluster Cluster_2
crossfall_angle = ClusterInput()
parapet_width = ClusterInput()
deck_width = ClusterInput()
parapet_width_2 = Integer(parapet_width)
crossfall_angle_2 = Number(crossfall_angle)
deck_width_2 = Integer(deck_width)
radians = Radians(Degrees=crossfall_angle_2)

# ---- group: y0, y1
division = Division(A=deck_width_2, B="2")

# ----
tangent = Tangent(Value=radians)

# ---- group: y2, y3
subtraction = Subtraction(A=division, B=parapet_width_2)

# ---- group: x1
multiplication = Multiplication(A=division, B=tangent)

# ---- group: x2
multiplication_2 = Multiplication(A=subtraction, B=tangent)

# ----
construct_point = ConstructPoint(XCoordinate=0, YCoordinate=expr("-x", division), ZCoordinate=0)
construct_point_2 = ConstructPoint(XCoordinate=expr("-x", multiplication), YCoordinate=expr("-x", division), ZCoordinate=0)
construct_point_3 = ConstructPoint(XCoordinate=expr("-x", multiplication), YCoordinate=division, ZCoordinate=0)
construct_point_4 = ConstructPoint(XCoordinate=expr("-x", multiplication_2), YCoordinate=expr("-x", subtraction), ZCoordinate=0)
construct_point_5 = ConstructPoint(XCoordinate=expr("-x", multiplication_2), YCoordinate=subtraction, ZCoordinate=0)
construct_point_6 = ConstructPoint(XCoordinate=0, YCoordinate=expr("-x", subtraction), ZCoordinate=0)
construct_point_7 = ConstructPoint(XCoordinate=0, YCoordinate=division, ZCoordinate=0)
construct_point_8 = ConstructPoint(XCoordinate=0, YCoordinate=subtraction, ZCoordinate=0)
point = Point(construct_point_2)
point_2 = Point(construct_point_8)
point_3 = Point(construct_point)
point_4 = Point(construct_point_7)
point_5 = Point(construct_point_3)
point_6 = Point(construct_point_4)
point_7 = Point(construct_point_5)
point_8 = Point(construct_point_6)
merge = Merge(Data1=point_3, Data2=point, Data3=point_6, Data4=point_8)
merge_2 = Merge(Data1=point_4, Data2=point_5, Data3=point_7, Data4=point_2)
point_9 = Point(merge)
point_10 = Point(merge_2)
polyline = PolyLine(Vertices=point_9, Closed=True)
polyline_2 = PolyLine(Vertices=point_10, Closed=True)
point_list = PointList(Points=point_9, Size=Slider(114, range=0..1000))
point_list_2 = PointList(Points=point_10, Size=Slider(256, range=0..1000))

# ---- group: Outline
parapet_1_outline = Curve(polyline)

parapet_2_outline = Curve(polyline_2)

# ----
parapet_1_outline_2 = ClusterOutput(parapet_1_outline)
parapet_2_outline_2 = ClusterOutput(parapet_2_outline)

# ==== cluster Cluster_3
deck_width = ClusterInput()
crossfall_angle = ClusterInput()
height = ClusterInput()
deck_width_2 = Integer(deck_width)
crossfall_angle_2 = Number(crossfall_angle)
height_2 = Integer(height)
radians = Radians(Degrees=crossfall_angle_2)

# ---- group: y1, y2
division = Division(A=deck_width_2, B="2")

# ----
tangent = Tangent(Value=radians)

# ---- group: x1
multiplication = Multiplication(A=division, B=tangent)

# ---- group: x2
addition = Addition(A=multiplication, B=height_2)
height_3 = Integer(height_2)

# ----
construct_point = ConstructPoint(XCoordinate=expr("-x", multiplication), YCoordinate=expr("-x", division), ZCoordinate=0)
construct_point_2 = ConstructPoint(XCoordinate=expr("-x", multiplication), YCoordinate=division, ZCoordinate=0)
construct_point_3 = ConstructPoint(XCoordinate=expr("-x", height_3), YCoordinate=expr("-x", division), ZCoordinate=0)
construct_point_4 = ConstructPoint(XCoordinate=expr("-x", height_3), YCoordinate=division, ZCoordinate=0)
# Profile points
construct_point_5 = ConstructPoint(XCoordinate=0, YCoordinate=0, ZCoordinate=0)
point = Point(construct_point_5)
point_2 = Point(construct_point)
point_3 = Point(construct_point_2)
point_4 = Point(construct_point_3)
point_5 = Point(construct_point_4)
cross_reference = CrossReference(ListA=graft(point), ListB=graft(point_2), ListC=graft(point_4), ListD=graft(point_5), ListE=graft(point_3), CrossMode=1)  # -> ListA, ListB, ListC, ListD, ListE
merge = Merge(
    Data1=cross_reference.ListA,
    Data2=cross_reference.ListB,
    Data3=cross_reference.ListC,
    Data4=cross_reference.ListD,
    Data5=cross_reference.ListE)
param_viewer = ParamViewer(merge)
polyline = PolyLine(Vertices=merge, Closed=True)
point_list = PointList(Points=merge, Size=Slider(256, range=0..1000))
trim_tree = TrimTree(Tree=polyline, Depth=1)
outline = Curve(trim_tree)
outline_2 = ClusterOutput(outline)

# ==== cluster Cluster_4
top_offset = ClusterInput()
deck_width = ClusterInput()
height = ClusterInput()
side_width = ClusterInput()
deck_width_2 = Integer(deck_width)
side_width_2 = Integer(side_width)
top_offset_2 = Integer(top_offset)
height_2 = Integer(height)
division = Division(A=deck_width_2, B="2")

# ---- group: y1, y2
addition = Addition(A=division, B=side_width_2)

# ---- group: x2
addition_2 = Addition(A=top_offset_2, B=height_2)

# ---- group: x1
top_offset_3 = Integer(top_offset_2)
addition_3 = Addition(B=top_offset_3)

# ----
# Profile points
construct_point = ConstructPoint(XCoordinate=expr("-x", top_offset_3), YCoordinate=expr("-x", addition), ZCoordinate=0)
construct_point_2 = ConstructPoint(XCoordinate=expr("-x", top_offset_3), YCoordinate=addition, ZCoordinate=0)
construct_point_3 = ConstructPoint(XCoordinate=expr("-x", addition_2), YCoordinate=expr("-x", addition), ZCoordinate=0)
construct_point_4 = ConstructPoint(XCoordinate=expr("-x", addition_2), YCoordinate=addition, ZCoordinate=0)
point = Point(construct_point)
point_2 = Point(construct_point_2)
point_3 = Point(construct_point_3)
point_4 = Point(construct_point_4)
cross_reference = CrossReference(ListA=graft(point), ListB=graft(point_3), ListC=graft(point_4), ListD=graft(point_2), CrossMode=1)  # -> ListA, ListB, ListC, ListD
merge = Merge(Data1=cross_reference.ListA, Data2=cross_reference.ListB, Data3=cross_reference.ListC, Data4=cross_reference.ListD)
param_viewer = ParamViewer(merge)
polyline = PolyLine(Vertices=merge, Closed=True)
point_list = PointList(Points=merge, Size=Slider(256, range=0..1000))
trim_tree = TrimTree(Tree=polyline, Depth=1)
outline = Curve(trim_tree)
outline_2 = ClusterOutput(outline)

# ==== cluster Cluster_5
chamfer_width = Slider(300, range=0..1000)
chamfer_height = Slider(400, range=0..1000)
crossfall_angle = ClusterInput()
deck_width = ClusterInput()
side_width = ClusterInput()
height = ClusterInput()
deck_width_2 = Integer(deck_width)
side_width_2 = Integer(side_width)
side_width_3 = Integer(chamfer_width)
crossfall_angle_2 = Number(crossfall_angle)
side_width_4 = Integer(chamfer_height)
height_2 = Integer(height)
radians = Radians(Degrees=crossfall_angle_2)

# ---- group: y0, y4
division = Division(A=deck_width_2, B="2")

# ----
tangent = Tangent(Value=radians)

# ---- group: y2, y3
addition = Addition(A=division, B=side_width_2)

# ---- group: x0, x1
multiplication = Multiplication(A=division, B=tangent)

# ---- group: x2
addition_2 = Addition(A=multiplication, B=side_width_4)

# ---- group: x3, x4
deck_thickness = Integer(height_2)

# ---- group: y1
subtraction = Subtraction(A=addition, B=side_width_3)

# ----
construct_point = ConstructPoint(XCoordinate=expr("-x", multiplication), YCoordinate=expr("-x", division), ZCoordinate=0)
construct_point_2 = ConstructPoint(XCoordinate=expr("-x", multiplication), YCoordinate=division, ZCoordinate=0)
construct_point_3 = ConstructPoint(XCoordinate=expr("-x", multiplication), YCoordinate=expr("-x", subtraction), ZCoordinate=0)
construct_point_4 = ConstructPoint(XCoordinate=expr("-x", multiplication), YCoordinate=subtraction, ZCoordinate=0)
construct_point_5 = ConstructPoint(XCoordinate=expr("-x", addition_2), YCoordinate=expr("-x", addition), ZCoordinate=0)
construct_point_6 = ConstructPoint(XCoordinate=expr("-x", addition_2), YCoordinate=addition, ZCoordinate=0)
construct_point_7 = ConstructPoint(XCoordinate=expr("-x", deck_thickness), YCoordinate=expr("-x", addition), ZCoordinate=0)
construct_point_8 = ConstructPoint(XCoordinate=expr("-x", deck_thickness), YCoordinate=addition, ZCoordinate=0)
construct_point_9 = ConstructPoint(XCoordinate=expr("-x", deck_thickness), YCoordinate=expr("-x", division), ZCoordinate=0)
construct_point_10 = ConstructPoint(XCoordinate=expr("-x", deck_thickness), YCoordinate=division, ZCoordinate=0)
point = Point(construct_point)
point_2 = Point(construct_point_2)
point_3 = Point(construct_point_3)
point_4 = Point(construct_point_4)
point_5 = Point(construct_point_5)
point_6 = Point(construct_point_6)
point_7 = Point(construct_point_7)
point_8 = Point(construct_point_8)
point_9 = Point(construct_point_9)
point_10 = Point(construct_point_10)
cross_reference = CrossReference(ListA=graft(point), ListB=graft(point_3), ListC=graft(point_5), ListD=graft(point_7), ListE=graft(point_9), CrossMode=1)  # -> ListA, ListB, ListC, ListD, ListE
cross_reference_2 = CrossReference(
    ListA=graft(point_2),
    ListB=graft(point_4),
    ListC=graft(point_6),
    ListD=graft(point_8),
    ListE=graft(point_10),
    CrossMode=1)  # -> ListA, ListB, ListC, ListD, ListE
merge = Merge(
    Data1=cross_reference.ListA,
    Data2=cross_reference.ListB,
    Data3=cross_reference.ListC,
    Data4=cross_reference.ListD,
    Data5=cross_reference.ListE)
merge_2 = Merge(
    Data1=cross_reference_2.ListA,
    Data2=cross_reference_2.ListB,
    Data3=cross_reference_2.ListC,
    Data4=cross_reference_2.ListD,
    Data5=cross_reference_2.ListE)
param_viewer = ParamViewer(merge)
polyline = PolyLine(Vertices=merge, Closed=True)
polyline_2 = PolyLine(Vertices=merge_2, Closed=True)
point_list = PointList(Points=merge, Size=Slider(256, range=0..1000))
point_list_2 = PointList(Points=merge_2, Size=Slider(256, range=0..1000))
trim_tree = TrimTree(Tree=polyline, Depth=1)
trim_tree_2 = TrimTree(Tree=polyline_2, Depth=1)

# ---- group: Outline
side_2_outline = Curve(trim_tree_2)

side_1_outline = Curve(trim_tree)

# ----
side_2_outline_2 = ClusterOutput(side_2_outline)
side_1_outline_2 = ClusterOutput(side_1_outline)

# ==== cluster Cluster_6
section_locations = ClusterInput()
section_heights = ClusterInput()
step_size = ClusterInput()
section_locations_2 = Number(flatten(section_locations))
section_heights_2 = Number(flatten(section_heights))
step_size_2 = Number(step_size)
shift_list = ShiftList(List=section_locations_2, Shift=1, Wrap=False)
subtraction = Subtraction(A=shift_list, B=section_locations_2)
division = Division(A=subtraction, B=step_size_2)
round = Round(Number=division)  # -> Nearest, Floor, Ceiling
series = Series(Start=0, Step=step_size_2, Count=round.Ceiling)
shift_list_2 = ShiftList(List=series, Shift=1, Wrap=False)

# ---- group: Location interpolation points
number = Number(shift_list_2)

# ----
list_length = ListLength(List=shift_list_2)
duplicate_data = DuplicateData(Data=graft(section_heights_2), Number=list_length, Order=True)

# ---- group: Additional section heights with no interpolation
number_2 = Number(duplicate_data)

# ---- group: No interpolation
number_3 = Number(duplicate_data)

# ----
addition = Addition(A=graft(section_locations_2), B=series)
section_locations_3 = Number(flatten(addition))
section_locations_4 = ClusterOutput(section_locations_3)

section_heights_3 = Number(section_heights_2)
section_locations_5 = Number(section_locations_2)
shift_list_3 = ShiftList(List=section_heights_3, Shift=1, Wrap=False)
shift_list_4 = ShiftList(List=section_locations_5, Shift=1, Wrap=False)
subtraction_2 = Subtraction(A=shift_list_3, B=section_heights_3)  # -> graft(Result)
subtraction_3 = Subtraction(A=shift_list_4, B=section_locations_5)  # -> graft(Result)
division_2 = Division(A=number, B=subtraction_3)

# ---- group: Multiplication without populating empty branches
division_3 = Division(A="1", B=division_2)
division_4 = Division(A=subtraction_2, B=division_3)
multiplication = Multiplication(A=subtraction_2, B=division_2)  # disabled

# ----
addition_2 = Addition(A=number_2, B=division_4)

# ---- group: Section height with linear interpolation
number_4 = Number(addition_2)

# ----
linear_interpolation = Number(number_4)
merge = Merge(Data1=simplify(graft(section_heights_2)), Data2=simplify(linear_interpolation))
section_heights_4 = Number(flatten(merge))
section_heights_5 = ClusterOutput(section_heights_4)
