# Grasshopper definition Column Dimensions.gh (Grasshopper 1.0.8)
# plug-ins: Grasshopper-Tekla Link 2023.1.16, Grasshopper-Tekla drawing Link 2.15.1

# ---- group: HIDDEN
drawing_object_types = DrawingObjectTypes({"Arc", "Bolt", "Circle", "Cloud", "Connection", "Container View", "Detail Mark", "Dwg Object", "Grid", "Hyper Link"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}, selected="Part")
# This Grasshopper definition
# was developed by Grzegorz Olszewski
# ✉ contact@learngrasshopper.com
# DRAWING LINK
boolean_toggle = BooleanToggle(True)

# ----
selected_objects = SelectedObjects(Toggle=boolean_toggle)

# ---- group: GROUP: Main
main_viewing_direction = ViewingDirection({"From Left": {1,0,0}, "From Right": {-1,0,0}, "From Bottom": {0,1,0}, "From Top": {0,-1,0}}, selected=["From Right", "From Bottom"])
distance = Slider(1000, range=0..5000)
attributes = Panel("standard")

# ---- group: GROUP: Secondary
second_viewing_direction = ViewingDirection({"From Left": {1,0,0}, "From Right": {-1,0,0}, "From Bottom": {0,1,0}, "From Top": {0,-1,0}}, selected="From Bottom")
use_second_dimension = BooleanToggle(True)

# ---- group: Every drawing object is in some view
# Copyright (C) 2024 - LEARNGRASSHOPPER.COM
list_item = ListItem(List=selected_objects, Index=0, Wrap=True)
father_view = FatherView(DrawingObject=list_item)
view_properties = ViewProperties(View=father_view)  # -> Type, Name, ViewCS, DisplayCS, RestrictionBox, Scale, Tags

# ---- group: We need 3d geometry of selected parts
search_using_key = SearchUsingKey(Values=selected_objects, Keys=selected_objects, Search=drawing_object_types)
drawing_to_model_object = DrawingToModelObject(DrawingPart=search_using_key)
convert_to_brep = ConvertToBrep(TeklaObject=drawing_to_model_object, SolidType=2, ToleranceMm=0.6)

# ----
stream_gate = StreamGate(Stream=second_viewing_direction, Gate=use_second_dimension)  # -> Target0, Target1
list_length = ListLength(List=drawing_to_model_object)
merge = Merge(Data1=main_viewing_direction, Data2=stream_gate.Target1)

# ---- group: 3d geometry has to be transformed into its 2d projection
simple_orient = SimpleOrient(Geometry=convert_to_brep, Plane=view_properties.DisplayCS)
brep_projection_border = BrepProjectionBorder(Brep=simple_orient)  # -> Boundary, Hole, UnionRectangle
find_visible_edges = FindVisibleEdges(Curve=brep_projection_border.Boundary, Vector=merge)  # -> Points, Edges, Extremes

# ---- group: Dimension lines has to be placed somewhere
find_visible_edges_2 = FindVisibleEdges(Curve=brep_projection_border.UnionRectangle, Vector=merge)  # -> Points, Edges, Extremes
negative = Negative(Value=merge)
list_item_2 = ListItem(List=find_visible_edges_2.Extremes, Index=0, Wrap=True)  # -> Item, Item1
multiplication = Multiplication(A=negative, B=distance)
line = Line(StartPoint=list_item_2.Item, EndPoint=list_item_2.Item1)
duplicate_data = DuplicateData(Data=multiplication, Number=list_length, Order=True)
graft_tree = GraftTree(Tree=duplicate_data, IncludeEmptyLists=True, IncludeNullItems=True)
move = Move(Geometry=line, Motion=graft_tree)  # -> Geometry, Transform

# ---- group: Styling of dimension lines based on pre-saved attributes
dimension_line_attributes = DimensionLineAttributes(AttributesName=attributes, PlacingType="Fixed")

# ----
dimension_line = DimensionLine(
    View=father_view,
    Points=find_visible_edges.Points,
    Location=move.Geometry,
    DimensionLineAttributes=dimension_line_attributes,
    Insert_always=0)

# ---- group: If you want, you can create also link dimensions
# If you want, you can also link dimensions
shift_paths = ShiftPaths(Data=dimension_line, Offset=-1)  # disabled
dimension_link = DimensionLink(DimensionLine=shift_paths)  # disabled
