# Grasshopper definition Loop keeper for exports.gh (Grasshopper 1.0.8)
# plug-ins: Grasshopper-Tekla drawing Link 2.23

selected_drawings = SelectedDrawings(Toggle=Toggle(False))
export_dwg = ExportDWG(Drawing=selected_drawings, Directory="output", Settings="standard")
panel = Panel(selected_drawings)
loop_keeper = LoopKeeper(Data=selected_drawings, Swimlanes=export_dwg)
panel_2 = Panel(export_dwg)
export_pdf = ExportPDF(Drawing=loop_keeper, Path="output", Settings="standard")
loop_keeper_2 = LoopKeeper(Data=selected_drawings, Swimlanes=export_pdf)
panel_3 = Panel(export_pdf)
panel_4 = Panel("C:\Users\grzeg\Downloads\Sample Office Building\PlotFiles\output\CastUnitList")
drawing_source = DrawingSource(Drawing=loop_keeper_2)
export_report = ExportReport(ModelObject=drawing_source, Path=panel_4, Template="Cast_Unit_List", Export_mode=0)
panel_5 = Panel(export_report)
