# Grasshopper definition Loop with synchronization.gh (Grasshopper 1.0.7)
# plug-ins: Grasshopper-Tekla drawing Link 2.15.1, Grasshopper-Tekla Link 2023.1.16

boolean_toggle = BooleanToggle(False)
selected_drawings = SelectedDrawings(Toggle=boolean_toggle)
loop_start = LoopStart(Toggle=boolean_toggle, Data=selected_drawings)  # -> port, Counter, Item
open_drawing = OpenDrawing(Drawing=loop_start.Item, Show=True)

# ---- group: Part view creation
part_view_types = PartViewTypes({"Front": "FrontView", "Top": "TopView", "Back": "BackView", "Bottom": "BottomView", "3d": "_3DView"}, selected="Front")
construct_point = ConstructPoint(XCoordinate=0, YCoordinate=0, ZCoordinate=0)
part_view = PartView(Drawing=open_drawing, Type=part_view_types, Point=construct_point, Attributes_by_macro=False)
view_properties = ViewProperties(View=part_view)  # -> Type, Name, ViewCS, DisplayCS, RestrictionBox, Scale, Tags

# ---- group: Dimension on the part view
drawing_source = DrawingSource(Drawing=open_drawing)
deconstruct_assembly = DeconstructAssembly(Assembly=drawing_source, ToleranceMm=0.6)  # -> Name, Type, MainPart, Secondaries, AllObjects
convert_to_brep = ConvertToBrep(TeklaObject=deconstruct_assembly.MainPart, SolidType=2, ToleranceMm=0.6)
flatten_tree = FlattenTree(Tree=convert_to_brep, Path="{0}")
simple_orient = SimpleOrient(Geometry=flatten_tree, Plane=view_properties.DisplayCS)
viewing_direction = ViewingDirection({"From Left": {1,0,0}, "From Right": {-1,0,0}, "From Bottom": {0,1,0}, "From Top": {0,-1,0}}, selected="From Top")
brep_projection_border = BrepProjectionBorder(Brep=simple_orient)  # -> Boundary, Hole, UnionRectangle
find_visible_edges = FindVisibleEdges(Curve=brep_projection_border.UnionRectangle, Vector=viewing_direction)  # -> Points, Edges, Extremes
list_item = ListItem(List=find_visible_edges.Edges, Index=0, Wrap=True)
multiplication = Multiplication(A=viewing_direction, B="-1", C="400")
move = Move(Geometry=list_item, Motion=multiplication)  # -> Geometry, Transform
dimension_line = DimensionLine(View=part_view, Points=find_visible_edges.Extremes, Location=move.Geometry, Insert_always=0)
null_item = NullItem(Item=dimension_line)  # -> NullFlags, InvalidFlags, Description

# ---- group: Sections creation
subtraction = Subtraction(A="4", B="1")
divide_curve = DivideCurve(Curve=list_item, Count="4", Kinks=False)  # -> Points, Tangents, Parameters
construct_domain = ConstructDomain(DomainStart="1", DomainEnd=subtraction)
sub_list = SubList(List=divide_curve.Points, Domain=construct_domain, Wrap=True)  # -> List, Index
move_2 = Move(Geometry=sub_list.List, Motion="{0,100,0}")  # -> Geometry, Transform
move_3 = Move(Geometry=sub_list.List, Motion="{0,-100,0}")  # -> Geometry, Transform
construct_point_2 = ConstructPoint(XCoordinate=0, YCoordinate=0, ZCoordinate=0)
section_view = SectionView(
    View=part_view,
    StartPoint=move_2.Geometry,
    EndPoint=move_3.Geometry,
    InsertionPoint=construct_point_2,
    Attributes_by_macro=False)  # -> View, Mark

# ---- group: Dimension line in sections
flatten_tree_2 = FlattenTree(Tree=section_view.View, Path="{0}")
flip_matrix = FlipMatrix(Data=flatten_tree_2)
view_properties_2 = ViewProperties(View=flip_matrix)  # -> Type, Name, ViewCS, DisplayCS, RestrictionBox, Scale, Tags
orient = Orient(Geometry=flatten_tree, Source=view_properties_2.DisplayCS, Target=PlaneXY(0, 0, 0))  # -> Geometry, Transform
viewing_direction_2 = ViewingDirection({"From Left": {1,0,0}, "From Right": {-1,0,0}, "From Bottom": {0,1,0}, "From Top": {0,-1,0}}, selected="From Left")
brep_projection_border_2 = BrepProjectionBorder(Brep=orient.Geometry)  # -> Boundary, Hole, UnionRectangle
find_visible_edges_2 = FindVisibleEdges(Curve=brep_projection_border_2.Boundary, Vector=viewing_direction_2)  # -> Points, Edges, Extremes
dimension_line_2 = DimensionLine(View=flatten_tree_2, Points=find_visible_edges_2.Points, Location=find_visible_edges_2.Edges, Insert_always=0)
null_item_2 = NullItem(Item=dimension_line_2)  # -> NullFlags, InvalidFlags, Description

# ---- group: Synchronization
merge = Merge(Data1=null_item.InvalidFlags, Data2=null_item_2.InvalidFlags)
panel = Panel(merge)
flatten_tree_3 = FlattenTree(Tree=merge, Path="{0}")
mass_addition = MassAddition(Input=flatten_tree_3)  # -> Result, PartialResults
stream_gate = StreamGate(Stream=open_drawing, Gate=mass_addition.Result)  # -> Target0, Target1

# ----
close_drawing = CloseDrawing(Drawing=stream_gate.Target0)
loop_end = LoopEnd(port=loop_start.port, Result=close_drawing)  # -> Completion, Output
