# Grasshopper definition Loop.gh (Grasshopper 1.0.7)
# plug-ins: Grasshopper-Tekla drawing Link 2.13.0

boolean_toggle = BooleanToggle(False)
panel = Panel("""1
2
3
4
5
6
7
8
9
10""")
selected_drawings = SelectedDrawings(Toggle=boolean_toggle)
loop_start = LoopStart(Toggle=Toggle(False), Data=panel)  # -> port, Counter, Item
panel_2 = Panel(selected_drawings)
loop_start_2 = LoopStart(Toggle=boolean_toggle, Data=selected_drawings)  # -> port, Counter, Item
multiplication = Multiplication(A=loop_start.Item, B="10")
open_drawing = OpenDrawing(Drawing=loop_start_2.Item, Show=True)
loop_end = LoopEnd(port=loop_start.port, Result=multiplication)  # -> Completion, Output
vector_xyz = VectorXYZ(XComponent="10", YComponent=0, ZComponent=0)  # -> Vector, Length
views_in_drawing = ViewsInDrawing(Drawing=open_drawing, All_objects=0)
move_view = MoveView(View=views_in_drawing, Vector=vector_xyz.Vector)
panel_3 = Panel(loop_end.Completion)
panel_4 = Panel(loop_end.Output)
list_item = ListItem(List=move_view, Index=0, Wrap=True)
null_item = NullItem(Item=list_item)  # -> NullFlags, InvalidFlags, Description
gate_not = GateNot(A=null_item.NullFlags)
stream_gate = StreamGate(Stream=open_drawing, Gate=gate_not)  # -> Target0, Target1
close_drawing = CloseDrawing(Drawing=stream_gate.Target1)
loop_end_2 = LoopEnd(port=loop_start_2.port, Result=close_drawing)  # -> Completion, Output
panel_5 = Panel(loop_end_2.Output)
panel_6 = Panel(loop_end_2.Completion)
