# Grasshopper definition MultiDimensions.gh (Grasshopper 1.0.7)
# plug-ins: Grasshopper-Tekla drawing Link 2.4.1

construct_point = ConstructPoint(XCoordinate=0, YCoordinate=0, ZCoordinate=0)
construct_point_2 = ConstructPoint(XCoordinate="500", YCoordinate=0, ZCoordinate=0)
construct_point_3 = ConstructPoint(XCoordinate=0, YCoordinate=0, ZCoordinate=0)
construct_point_4 = ConstructPoint(XCoordinate="3000", YCoordinate=0, ZCoordinate=0)
construct_point_5 = ConstructPoint(XCoordinate=0, YCoordinate="-50", ZCoordinate=0)
construct_point_6 = ConstructPoint(XCoordinate=0, YCoordinate="150", ZCoordinate=0)
unit_x = UnitX(Factor=1)
active_drawing = ActiveDrawing(Toggle=Toggle(False))
merge = Merge(Data1=construct_point, Data2=construct_point_2)
merge_2 = Merge(Data1=construct_point_3, Data2=construct_point_4)
views_at_drawing = ViewsAtDrawing(Drawing=active_drawing)
line_sdl = LineSDL(Start=graft([construct_point_6, construct_point_5]), Direction=unit_x, Length=1)
entwine = Entwine(Branch00=merge, Branch01=merge_2, FlattenInputs=True)
dimension_line_attributes = DimensionLineAttributes(PlacingType=0, ShortDimensionType=1, ExtensionLineType=0)
dimension_line_attributes_2 = DimensionLineAttributes(DimType=16)
path_mapper = PathMapper(line_sdl, source="{A;B}(i)", target="{1;B}")
path_mapper_2 = PathMapper(entwine, source="{A;B}(i)", target="{1;B}")
merge_3 = Merge(Data1=line_sdl, Data2=path_mapper)
merge_4 = Merge(Data1=entwine, Data2=path_mapper_2)
merge_5 = Merge(Data1=dimension_line_attributes, Data2=dimension_line_attributes_2)
panel = Panel(views_at_drawing)
panel_2 = Panel(merge_4)
dimension_line = DimensionLine(View=views_at_drawing, Points=merge_4, Location=merge_3, DimensionLineAttributes=merge_5, Insert_always=0)
panel_3 = Panel(merge_3)
panel_4 = Panel(dimension_line)
panel_5 = Panel(merge_5)
