# Grasshopper definition PilesColoring.gh (Grasshopper 1.0.7)
# plug-ins: Grasshopper-Tekla drawing Link 1.2.0, Grasshopper-Tekla Link 2022.1.14

selected_objects = SelectedObjects(BooleanTrigger=Toggle(False))
drawing_to_model_object = DrawingToModelObject(DrawingPart=selected_objects)
get_property = GetProperty(TeklaObject=drawing_to_model_object, Name="WIDTH", Type=0)
get_property_2 = GetProperty(TeklaObject=drawing_to_model_object, Name="TOP_LEVEL", Type=0)
get_property_3 = GetProperty(TeklaObject=drawing_to_model_object, Name="BOTTOM_LEVEL", Type=0)
format = Format(Format="{0}-{1}-{2}", Culture=127, Data0=get_property, Data1=get_property_2, Data2=get_property_3)
colors = Panel("""160
161
162
163
164
165""")
create_set = CreateSet(List=format)  # -> Set, Map
hatch_type = Panel("hardware_SOLID")
list_item = ListItem(List=colors, Index=create_set.Map, Wrap=True)
hatch_attributes = HatchAttributes(Name=hatch_type, DrawingHatchColor=list_item)
line_attributes = LineAttributes(LineType=1, DrawingColor=list_item)
modify_part = ModifyPart(Part=selected_objects, VisibileLines=line_attributes, PartFacesHatch=hatch_attributes)
