# Grasshopper definition Rhino Webinar - Automating Tekla 2D Drawings.gh (Grasshopper 1.0.8)
# plug-ins: Grasshopper-Tekla Link 2024.1.19, Pufferfish, Grasshopper-Tekla drawing Link 2.20.0

# This Grasshopper definition
# was developed by Grzegorz Olszewski
# ✉ contact@learngrasshopper.com
# DRAWING LINK
# View positioning
# CU -> W.36
boolean_toggle = BooleanToggle(False)
drawing_object_types = DrawingObjectTypes({"Arc", "Bolt", "Circle", "Cloud", "Connection", "Container View", "Detail Mark", "Dwg Object", "Edge Chamfer", "Grid"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}, selected="Straight Dimension Set")
# Create drawing
# Steel column
panel = Panel("FAB-BEAM-INC_PARTS")
# Export to IFC
panel_2 = Panel("Assembly")
# View creation
# A -> CA.102
boolean_toggle_2 = BooleanToggle(False)
model_object = ModelObject(
    [null x375],
    ModelID="Sample Office Building.db1",
    ModelObjectInfos=["Tekla.Structures.Model.RebarSet, Tekla.Structures.Model, Version=2024.0.0.0, Culture=neutral, PublicKeyToken=2f04dbe497b71114;e2e400ac-d382-4ac4-9319-7f9e1c02669e", "Tekla.Structures.Model.Assembly, Tekla.Structures.Model, Version=2024.0.0.0, Culture=neutral, PublicKeyToken=2f04dbe497b71114;d5cb4e49-c2a2-4b5e-b7ac-eca7a66a3c3d", "Tekla.Structures.Model.Assembly, Tekla.Structures.Model, Version=2024.0.0.0, Culture=neutral, PublicKeyToken=2f04dbe497b71114;086f8c5c-a246-4641-857b-f66fa3f54821", "Tekla.Structures.Model.Assembly, Tekla.Structures.Model, Version=2024.0.0.0, Culture=neutral, PublicKeyToken=2f04dbe497b71114;0f243be7-5142-4861-9c50-dc86e4fc82c6", "Tekla.Structures.Model.Assembly, Tekla.Structures.Model, Version=2024.0.0.0, Culture=neutral, PublicKeyToken=2f04dbe497b71114;6bf3d4bc-afb5-4c82-92c9-c6ecb11ef476", "Tekla.Structures.Model.Assembly, Tekla.Structures.Model, Version=2024.0.0.0, Culture=neutral, PublicKeyToken=2f04dbe497b71114;150e4824-7856-4e81-9a1b-6df6a603ed90"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])
drawing_object_types_2 = DrawingObjectTypes({"Arc", "Bolt", "Circle", "Cloud", "Connection", "Container View", "Detail Mark", "Dwg Object", "Edge Chamfer", "Grid"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}, selected="Part")
# Dimension ordering
# CU W.20
drawing_view = DrawingObject()
# Section creation
# A -> CA.102
boolean_toggle_3 = BooleanToggle(False)
# Mark Placement
# G [6]
drawing_object_types_3 = DrawingObjectTypes({"Arc", "Bolt", "Circle", "Cloud", "Connection", "Container View", "Detail Mark", "Dwg Object", "Edge Chamfer", "Grid"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}, selected="Part")
model_object_2 = ModelObject(
    null,
    ModelID="Sample Office Building.db1",
    ModelObjectInfos="Tekla.Structures.Model.Assembly, Tekla.Structures.Model, Version=2024.0.0.0, Culture=neutral, PublicKeyToken=2f04dbe497b71114;4efac5d4-0002-06a5-3133-323530363130")
drawing_object_types_4 = DrawingObjectTypes({"Arc", "Bolt", "Circle", "Cloud", "Connection", "Container View", "Detail Mark", "Dwg Object", "Edge Chamfer", "Grid"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}, selected="Part")
# Marking top in form
# GA [2]
drawing_view_2 = DrawingObject()
# Dimension insertion
# GA [2]
drawing_view_3 = DrawingObject()
drawing_object_types_5 = DrawingObjectTypes({"Arc", "Bolt", "Circle", "Cloud", "Connection", "Container View", "Detail Mark", "Dwg Object", "Edge Chamfer", "Grid"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}, selected="Reinforcement Group")
drawing_view_4 = DrawingObject()
search_using_key = SearchUsingKey(Values=model_object, Keys=model_object, Search=panel_2)
active_drawing = ActiveDrawing(Toggle=boolean_toggle)
# Plugin insertion
# CU W.20
drawing_view_5 = DrawingObject()
view_properties = ViewProperties(View=drawing_view)  # -> Type, Name, ViewCS, DisplayCS, RestrictionBox, Scale, Tags
objects_from_view = ObjectsFromView(View=drawing_view, All_objects=0)  # -> DrawingObject, Keys
create_a_drawing = CreateADrawing(Assembly=model_object_2, AttributesName=panel)  # disabled
active_drawing_2 = ActiveDrawing(Toggle=boolean_toggle_2)
objects_from_view_2 = ObjectsFromView(View=drawing_view_2, All_objects=0)  # -> DrawingObject, Keys
objects_from_view_3 = ObjectsFromView(View=drawing_view_4, All_objects=0)  # -> DrawingObject, Keys
active_drawing_3 = ActiveDrawing(Toggle=boolean_toggle_3)
objects_from_view_4 = ObjectsFromView(View=drawing_view_3, All_objects=0)  # -> DrawingObject, Keys
objects_from_view_5 = ObjectsFromView(View=drawing_view_5, All_objects=0)  # -> DrawingObject, Keys
group_objects = GroupObjects(ModelObject=search_using_key, Property="MATERIAL_TYPE", Group_by_Assembly_Position=16)  # -> ModelObject, Keys
views_in_drawing = ViewsInDrawing(Drawing=active_drawing, All_objects=0)
search_using_key_2 = SearchUsingKey(Values=objects_from_view.DrawingObject, Keys=objects_from_view.Keys, Search=drawing_object_types)
part_view_types = PartViewTypes({"Front": "FrontView", "Top": "TopView", "Back": "BackView", "Bottom": "BottomView", "3d": "_3DView"}, selected="Top")
part_view_types_2 = PartViewTypes({"Front": "FrontView", "Top": "TopView", "Back": "BackView", "Bottom": "BottomView", "3d": "_3DView"}, selected="Front")
simple_orient = SimpleOrient(Geometry=view_properties.RestrictionBox, Plane=view_properties.DisplayCS)
part_view_types_3 = PartViewTypes({"Front": "FrontView", "Top": "TopView", "Back": "BackView", "Bottom": "BottomView", "3d": "_3DView"}, selected="Bottom")
open_drawing = OpenDrawing(Drawing=create_a_drawing, Show=True)
search_using_key_3 = SearchUsingKey(Values=objects_from_view_2.DrawingObject, Keys=objects_from_view_2.Keys, Search=drawing_object_types_2)
search_using_key_4 = SearchUsingKey(Values=objects_from_view_3.DrawingObject, Keys=objects_from_view_3.Keys, Search=drawing_object_types_3)
views_in_drawing_2 = ViewsInDrawing(Drawing=active_drawing_3, All_objects=0)
search_using_key_5 = SearchUsingKey(Values=objects_from_view_4.DrawingObject, Keys=objects_from_view_4.Keys, Search=drawing_object_types_4)
drawing_source = DrawingSource(Drawing=active_drawing_3)
search_using_key_6 = SearchUsingKey(Values=objects_from_view_5.DrawingObject, Keys=objects_from_view_5.Keys, Search=drawing_object_types_5)
deconstruct_dimension_line = DeconstructDimensionLine(DimensionLine=search_using_key_2)  # -> Points, Location, DimensionLineAttributes
volume = Volume(Geometry=simple_orient)  # -> Volume, Centroid
drawing_to_model_object = DrawingToModelObject(DrawingPart=search_using_key_3)
drawing_to_model_object_2 = DrawingToModelObject(DrawingPart=search_using_key_4)
view_properties_2 = ViewProperties(View=views_in_drawing)  # -> Type, Name, ViewCS, DisplayCS, RestrictionBox, Scale, Tags
# Copyright (C) 2025 - LEARNGRASSHOPPER.COM
drawing_size = DrawingSize(Drawing=active_drawing)  # -> Width, Height, Rectangle
drawing_to_model_object_3 = DrawingToModelObject(DrawingPart=search_using_key_5)
drawing_to_model_object_4 = DrawingToModelObject(DrawingPart=search_using_key_6)
view_properties_3 = ViewProperties(View=drawing_view_5)  # -> Type, Name, ViewCS, DisplayCS, RestrictionBox, Scale, Tags
concatenate = Concatenate(Fragment_A="C:\temp\IFC Export\2024\", Fragment_B=group_objects.Keys, A=".ifc")
part_view = PartView(
    Drawing=active_drawing_2,
    Type=part_view_types,
    Point="0,150,0",
    AttributesName="new_FAB-COLUMN-INC_PARTS",
    Attributes_by_macro=False,
    Remove_when_input_is_empty=False)
view_properties_4 = ViewProperties(View=views_in_drawing_2)  # -> Type, Name, ViewCS, DisplayCS, RestrictionBox, Scale, Tags
unit_x = UnitX(Factor=1)
part_view_2 = PartView(
    Drawing=active_drawing_2,
    Type=part_view_types_2,
    Point="0,0,0",
    AttributesName="new_FAB-COLUMN-INC_PARTS",
    Attributes_by_macro=False,
    Remove_when_input_is_empty=False)
part_view_3 = PartView(
    Drawing=active_drawing_2,
    Type=part_view_types_3,
    Point="0,-100,0",
    AttributesName="new_FAB-COLUMN-INC_PARTS",
    Attributes_by_macro=False,
    Remove_when_input_is_empty=False)
export_ifc4 = ExportIFC4(ModelObject=group_objects.ModelObject, Path=group_objects.Keys, Settings="NewSettings", Export_mode=0)  # disabled
tekla_bounding_box = TeklaBoundingBox(TeklaObject=drawing_source, SolidType=2, CreateUnionBox=False, ToleranceMm=0.6)
deconstruct_assembly = DeconstructAssembly(Assembly=drawing_source, ToleranceMm=0.6)  # -> Name, Type, MainPart, Secondaries, AllObjects
part_view_types_4 = PartViewTypes({"Front": "FrontView", "Top": "TopView", "Back": "BackView", "Bottom": "BottomView", "3d": "_3DView"}, selected="Front")
group_objects_2 = GroupObjects(ModelObject=drawing_to_model_object, Group_by_Assembly_Position=2)  # -> ModelObject, Keys
group_objects_3 = GroupObjects(ModelObject=drawing_to_model_object_2, Group_by_Assembly_Position=2)  # -> ModelObject, Keys
group_objects_4 = GroupObjects(ModelObject=drawing_to_model_object_3, Group_by_Assembly_Position=2)  # -> ModelObject, Keys
panel_3 = Panel(concatenate)
group_objects_5 = GroupObjects(ModelObject=drawing_to_model_object_4, Property="SHAPE_INTERNAL", Group_by_Assembly_Position=16)  # -> ModelObject, Keys
dot_product = DotProduct(VectorA=unitize(deconstruct_dimension_line.Location), VectorB=unit_x, Unitize=False)
search_using_key_7 = SearchUsingKey(Values=views_in_drawing, Keys=view_properties_2.Type, Search="_3DView")
export_ifc = ExportIFC(ModelObject=group_objects.ModelObject, Path=concatenate, Settings="NewSettings", Export_mode=0)  # disabled
panel_4 = Panel(export_ifc4)
search_using_key_8 = SearchUsingKey(Values=views_in_drawing, Keys=view_properties_2.Type, Search="SectionView")
search_using_key_9 = SearchUsingKey(Values=views_in_drawing, Keys=view_properties_2.Type, Search="FrontView")
search_using_key_10 = SearchUsingKey(Values=views_in_drawing_2, Keys=view_properties_4.Type, Search=part_view_types_4)
search_using_key_11 = SearchUsingKey(Values=group_objects_2.ModelObject, Keys=group_objects_2.Keys, Search="COLUMN")
search_using_key_12 = SearchUsingKey(Values=group_objects_3.ModelObject, Keys=group_objects_3.Keys, Search="PAD FOOTING")
anchor = AutoValueList({"LowerLeft": 0, "UpperLeft": 1, "UpperRight": 2, "LowerRight": 3, "OriginHorizontally": 4, "OriginVertically": 5}, selected="UpperRight")
construct_point = ConstructPoint(XCoordinate=drawing_size.Width, YCoordinate=drawing_size.Height, ZCoordinate=0)
panel_5 = Panel(export_ifc)  # disabled
search_using_key_13 = SearchUsingKey(Values=group_objects_4.ModelObject, Keys=group_objects_4.Keys, Search="COLUMN")
search_using_key_14 = SearchUsingKey(Values=group_objects_5.ModelObject, Keys=group_objects_5.Keys, Search="4")
open_file = OpenFile(Path=export_ifc)  # disabled
larger_than = LargerThan(FirstNumber=expr("abs(x)", dot_product), SecondNumber="0.95")  # -> LargerThan, OrEqualTo
view_properties_5 = ViewProperties(View=search_using_key_9)  # -> Type, Name, ViewCS, DisplayCS, RestrictionBox, Scale, Tags
view_properties_6 = ViewProperties(View=search_using_key_8)  # -> Type, Name, ViewCS, DisplayCS, RestrictionBox, Scale, Tags
group_objects_6 = GroupObjects(ModelObject=search_using_key_11, Group_by_Assembly_Position=4)  # -> ModelObject, Keys
view_properties_7 = ViewProperties(View=search_using_key_10)  # -> Type, Name, ViewCS, DisplayCS, RestrictionBox, Scale, Tags
drawing_size_2 = DrawingSize(Drawing=active_drawing_2)  # -> Width, Height, Rectangle
convert_to_brep = ConvertToBrep(TeklaObject=deconstruct_assembly.MainPart, SolidType=2, ToleranceMm=0.6)
group_objects_7 = GroupObjects(ModelObject=search_using_key_12, Property="PROFILE", Group_by_Assembly_Position=16)  # -> ModelObject, Keys
group_objects_8 = GroupObjects(ModelObject=search_using_key_13, Group_by_Assembly_Position=4)  # -> ModelObject, Keys
simple_orient_2 = SimpleOrient(Geometry=view_properties_3.RestrictionBox, Plane=view_properties_3.DisplayCS)
move_view_to_point = MoveViewToPoint(View=search_using_key_7, Point=construct_point, Anchor=anchor)
list_item = ListItem(List=view_properties_6.Tags, Index=0, Wrap=True)
construct_point_2 = ConstructPoint(XCoordinate=0, YCoordinate=drawing_size_2.Height, ZCoordinate=0)
dispatch = Dispatch(List=search_using_key_2, DispatchPattern=larger_than.LargerThan)  # -> ListA, ListB
search_using_key_15 = SearchUsingKey(Values=group_objects_6.ModelObject, Keys=group_objects_6.Keys, Search="13")
expand_object = ExpandObject(Object=search_using_key_14, ToleranceMm=0.6)  # -> Class, EndFromPlaneOffset, EndHook, EndPoint, EndPointOffsetType, EndPointOffsetValue, ExcludeType, Father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
search_using_key_16 = SearchUsingKey(Values=group_objects_7.ModelObject, Keys=group_objects_7.Keys, Search="2700*900")
volume_2 = Volume(Geometry=simple_orient_2)  # -> Volume, Centroid
search_using_key_17 = SearchUsingKey(Values=group_objects_8.ModelObject, Keys=group_objects_8.Keys, Search="13")
model_to_drawing_object = ModelToDrawingObject(ViewBase=drawing_view_5, ModelObject=search_using_key_14)
simple_orient_3 = SimpleOrient(Geometry=tekla_bounding_box, Plane=view_properties_7.DisplayCS)
anchor_2 = AutoValueList({"LowerLeft": 0, "UpperLeft": 1, "UpperRight": 2, "LowerRight": 3, "OriginHorizontally": 4, "OriginVertically": 5}, selected="UpperLeft")
simple_orient_4 = SimpleOrient(Geometry=convert_to_brep, Plane=view_properties_7.DisplayCS)
flatten_tree = FlattenTree(Tree=list_item, Path="{0}")
search_using_key_18 = SearchUsingKey(Values=search_using_key_9, Keys=view_properties_5.Name, Search="Front reinforcement")
view_frame_geometry = ViewFrameGeometry(View=move_view_to_point)  # -> UpperLeft, UpperRight, LowerLeft, LowerRight, Rectangle, Width, Height, Origin
view_properties_8 = ViewProperties(View=drawing_view_3)  # -> Type, Name, ViewCS, DisplayCS, RestrictionBox, Scale, Tags
search_using_key_19 = SearchUsingKey(Values=search_using_key_9, Keys=view_properties_5.Name, Search="Front formwork")
anchor_3 = AutoValueList({"LowerLeft": 0, "UpperLeft": 1, "UpperRight": 2, "LowerRight": 3, "OriginHorizontally": 4, "OriginVertically": 5}, selected="UpperLeft")
move = Move(Geometry=construct_point_2, Motion="105,-5,0")  # -> Geometry, Transform
deconstruct_dimension_line_2 = DeconstructDimensionLine(DimensionLine=dispatch.ListB)  # -> Points, Location, DimensionLineAttributes
convert_to_brep_2 = ConvertToBrep(TeklaObject=search_using_key_17, SolidType=2, ToleranceMm=0.6)
model_to_drawing_object_2 = ModelToDrawingObject(ViewBase=drawing_view_4, ModelObject=search_using_key_16)
deconstruct_dimension_line_3 = DeconstructDimensionLine(DimensionLine=dispatch.ListA)  # -> Points, Location, DimensionLineAttributes
panel_6 = Panel("0")
panel_7 = Panel("1")
panel_8 = Panel("5")
panel_9 = Panel("2")
view_properties_9 = ViewProperties(View=drawing_view_4)  # -> Type, Name, ViewCS, DisplayCS, RestrictionBox, Scale, Tags
model_object_3 = ModelObject(search_using_key_15)
deconstruct_box = DeconstructBox(Box=simple_orient_4)  # -> Plane, X, Y, Z
convert_to_brep_3 = ConvertToBrep(TeklaObject=search_using_key_16, SolidType=2, ToleranceMm=0.6)
deconstruct_box_2 = DeconstructBox(Box=simple_orient_3)  # -> Plane, X, Y, Z
search_using_key_20 = SearchUsingKey(Values=search_using_key_8, Keys=flatten_tree, Search="FORMWORK")
search_using_key_21 = SearchUsingKey(Values=search_using_key_8, Keys=flatten_tree, Search="REINFORCEMENT")
unit_x_2 = UnitX(Factor=1)
unit_y = UnitY(Factor=1)
graft_tree = GraftTree(Tree=model_to_drawing_object, IncludeEmptyLists=True, IncludeNullItems=True)
move_view_to_point_2 = MoveViewToPoint(View=part_view, Point=move.Geometry, Anchor=anchor_2)
subtraction = Subtraction(A=view_frame_geometry.Width, B="410")
unit_y_2 = UnitY(Factor=1)
unit_z = UnitZ(Factor="-1")
unit_y_3 = UnitY(Factor="-1")
unit_z_2 = UnitZ(Factor=1)
get_uda_value = GetUDAValue(TeklaObject=model_object_3, Name="FixedMainView", Type=0, ToleranceMm=0.6)
deconstruct_domain = DeconstructDomain(Domain=deconstruct_box.X)  # -> Start, End
simple_orient_5 = SimpleOrient(Geometry=convert_to_brep_2, Plane=view_properties_8.DisplayCS)
deconstruct_domain_2 = DeconstructDomain(Domain=deconstruct_box_2.Z)  # -> Start, End
move_view_to_point_3 = MoveViewToPoint(View=search_using_key_19, Point="5,589,0", Anchor=anchor_3)
line = Line(StartPoint=expand_object.StartPoint, EndPoint=expand_object.EndPoint)
null_placeholder = NullPlaceholder()
simple_orient_6 = SimpleOrient(Geometry=convert_to_brep_3, Plane=view_properties_9.DisplayCS)
graft_tree_2 = GraftTree(Tree=model_to_drawing_object_2, IncludeEmptyLists=True, IncludeNullItems=True)
list_item_2 = ListItem(List=model_to_drawing_object_2, Index=0, Wrap=True)
anchor_4 = AutoValueList({"LowerLeft": 0, "UpperLeft": 1, "UpperRight": 2, "LowerRight": 3, "OriginHorizontally": 4, "OriginVertically": 5}, selected="UpperLeft")
viewing_direction = ViewingDirection({"From Left": {1,0,0}, "From Right": {-1,0,0}, "From Bottom": {0,1,0}, "From Top": {0,-1,0}}, selected=["From Left", "From Bottom"])
division = Division(A=subtraction, B="2")
line_sdl = LineSDL(Start=volume.Centroid, Direction=unit_x_2, Length=1)
curve_middle = CurveMiddle(Curve=deconstruct_dimension_line_3.Location)
curve_middle_2 = CurveMiddle(Curve=deconstruct_dimension_line_2.Location)
anchor_5 = AutoValueList({"LowerLeft": 0, "UpperLeft": 1, "UpperRight": 2, "LowerRight": 3, "OriginHorizontally": 4, "OriginVertically": 5}, selected="UpperLeft")
line_sdl_2 = LineSDL(Start=volume.Centroid, Direction=unit_y, Length=1)
simple_orient_7 = SimpleOrient(Geometry=line, Plane=view_properties_3.DisplayCS)
replace_nulls = ReplaceNulls(Items=get_uda_value, Replacements="5")  # -> Items, Count
view_frame_geometry_2 = ViewFrameGeometry(View=move_view_to_point_2)  # -> UpperLeft, UpperRight, LowerLeft, LowerRight, Rectangle, Width, Height, Origin
construct_point_3 = ConstructPoint(XCoordinate=deconstruct_domain.Start, YCoordinate=deconstruct_domain_2.Start, ZCoordinate=0)
construct_point_4 = ConstructPoint(XCoordinate=deconstruct_domain.Start, YCoordinate=deconstruct_domain_2.End, ZCoordinate=0)
brep_projection_border = BrepProjectionBorder(Brep=simple_orient_5)  # -> Boundary, Hole, UnionRectangle
view_frame_geometry_3 = ViewFrameGeometry(View=move_view_to_point_3)  # -> UpperLeft, UpperRight, LowerLeft, LowerRight, Rectangle, Width, Height, Origin
merge = Merge(Data1=unit_y_2, Data2=unit_z, Data3=unit_y_3, Data4=null_placeholder, Data5=null_placeholder, Data6=unit_z_2)
vector_xyz = VectorXYZ(XComponent=division, YComponent=0, ZComponent=0)  # -> Vector, Length
viewing_direction_2 = ViewingDirection({"From Left": {1,0,0}, "From Right": {-1,0,0}, "From Bottom": {0,1,0}, "From Top": {0,-1,0}}, selected="From Top")
anchor_6 = AutoValueList({"LowerLeft": 0, "UpperLeft": 1, "UpperRight": 2, "LowerRight": 3, "OriginHorizontally": 4, "OriginVertically": 5}, selected="UpperLeft")
curve_side = CurveSide(Curve=line_sdl, Point=curve_middle)  # -> Side, Left, Right
curve_side_2 = CurveSide(Curve=line_sdl_2, Point=curve_middle_2)  # -> Side, Left, Right
brep_projection_border_2 = BrepProjectionBorder(Brep=simple_orient_6)  # -> Boundary, Hole, UnionRectangle
pull_point = PullPoint(Point=volume_2.Centroid, Geometry=simple_orient_7, ClosestOnly=True)  # -> ClosestPoint, Distance, Index
move_view_to_point_4 = MoveViewToPoint(View=search_using_key_18, Point="5,292,0", Anchor=anchor_4)
list_item_3 = ListItem(List=merge, Index=replace_nulls.Items, Wrap=True)
negative = Negative(Value=viewing_direction)
move_view_to_point_5 = MoveViewToPoint(View=part_view_2, Point=view_frame_geometry_2.LowerLeft, Anchor=anchor_5)
move_view = MoveView(View=move_view_to_point, Vector=vector_xyz.Vector)
find_visible_edges = FindVisibleEdges(Curve=brep_projection_border.Boundary, Vector=viewing_direction)  # -> Points, Edges, Extremes
dispatch_2 = Dispatch(List=dispatch.ListB, DispatchPattern=curve_side_2.Left)  # -> ListA, ListB
anchor_7 = AutoValueList({"LowerLeft": 0, "UpperLeft": 1, "UpperRight": 2, "LowerRight": 3, "OriginHorizontally": 4, "OriginVertically": 5}, selected="OriginHorizontally")
dispatch_3 = Dispatch(List=dispatch.ListA, DispatchPattern=curve_side.Left)  # -> ListA, ListB
view_frame_geometry_4 = ViewFrameGeometry(SourceView=search_using_key_10)  # -> UpperLeft, UpperRight, LowerLeft, LowerRight, Rectangle, Width, Height, Origin
section_view = SectionView(
    View=search_using_key_10,
    StartPoint=construct_point_4,
    EndPoint=construct_point_3,
    InsertionPoint="0,0,0",
    DepthUp="100",
    DepthDown="100",
    ViewAttributes="new_FAB-BEAM-INC_PARTS_2",
    Attributes_by_macro=False,
    Remove_when_input_is_empty=False)  # -> SectionView, Mark
get_coordinate_system = GetCoordinateSystem(TeklaObject=model_object_3, AlignWithZ="False", ToleranceMm=0.6)  # -> Global, Local
volume_3 = Volume(Geometry=simple_orient_6)  # -> Volume, Centroid
anchor_8 = AutoValueList({"LowerLeft": 0, "UpperLeft": 1, "UpperRight": 2, "LowerRight": 3, "OriginHorizontally": 4, "OriginVertically": 5}, selected="UpperLeft")
view_frame_geometry_5 = ViewFrameGeometry(View=move_view_to_point_4)  # -> UpperLeft, UpperRight, LowerLeft, LowerRight, Rectangle, Width, Height, Origin
find_visible_edges_2 = FindVisibleEdges(Curve=brep_projection_border_2.UnionRectangle, Vector=viewing_direction_2)  # -> Points, Edges, Extremes
move_view_to_point_6 = MoveViewToPoint(View=search_using_key_20, Point=view_frame_geometry_3.UpperRight, Anchor=anchor_6)
view_frame_geometry_6 = ViewFrameGeometry(View=move_view_to_point_5)  # -> UpperLeft, UpperRight, LowerLeft, LowerRight, Rectangle, Width, Height, Origin
multiplication = Multiplication(A=negative, B=Slider(831, range=0..2000))
line_2 = Line(StartPoint=volume_2.Centroid, EndPoint=pull_point.ClosestPoint)
tree_statistics = TreeStatistics(Tree=find_visible_edges.Edges)  # -> Paths, Length, Count
multiplication_2 = Multiplication(A=viewing_direction_2, B="300")
anchor_9 = AutoValueList({"LowerLeft": 0, "UpperLeft": 1, "UpperRight": 2, "LowerRight": 3, "OriginHorizontally": 4, "OriginVertically": 5}, selected="UpperLeft")
curve_middle_3 = CurveMiddle(Curve=find_visible_edges_2.Edges)
move_view_to_point_7 = MoveViewToPoint(View=move_view_to_point_6, Point=view_frame_geometry_3.Origin, Anchor=anchor_7)
anchor_10 = AutoValueList({"LowerLeft": 0, "UpperLeft": 1, "UpperRight": 2, "LowerRight": 3, "OriginHorizontally": 4, "OriginVertically": 5}, selected="UpperRight")
entwine = Entwine(
    Branch00=dispatch_3.ListA,
    Branch01=dispatch_3.ListB,
    Branch02=dispatch_2.ListA,
    Branch03=dispatch_2.ListB,
    FlattenInputs=True)
settings_to_use = Panel("Profile")
deconstruct_plane = DeconstructPlane(Plane=get_coordinate_system.Global)  # -> Origin, XAxis, YAxis, ZAxis
negative_2 = Negative(Value=multiplication_2)
unit_vector = UnitVector(Vector=line_2)
orient = Orient(Geometry=list_item_3, Source=PlaneXY(0, 0, 0), Target=get_coordinate_system.Global)  # -> Geometry, Transform
repeat_data = RepeatData(Data=multiplication, Length=tree_statistics.Count)
anchor_11 = AutoValueList({"LowerLeft": 0, "UpperLeft": 1, "UpperRight": 2, "LowerRight": 3, "OriginHorizontally": 4, "OriginVertically": 5}, selected="OriginHorizontally")
tekla_bounding_box_2 = TeklaBoundingBox(TeklaObject=model_object_3, SolidType=2, CreateUnionBox=False, ToleranceMm=0.6)
move_view_to_point_8 = MoveViewToPoint(View=part_view_3, Point=view_frame_geometry_6.LowerLeft, Anchor=anchor_8)
anchor_12 = AutoValueList({"LowerLeft": 0, "UpperLeft": 1, "UpperRight": 2, "LowerRight": 3, "OriginHorizontally": 4, "OriginVertically": 5}, selected="OriginHorizontally")
mark_attributes = MarkAttributes(AttributesName=settings_to_use, DrawingObject=list_item_2)
move_2 = Move(Geometry=curve_middle_3, Motion=negative_2)  # -> Geometry, Transform
placing_type = PlacingType(LeaderType=0)
multiplication_3 = Multiplication(A=unit_vector, B=Slider(600, range=0..1000))
graft_tree_3 = GraftTree(Tree=repeat_data, IncludeEmptyLists=True, IncludeNullItems=True)
move_view_to_point_9 = MoveViewToPoint(View=search_using_key_21, Point=view_frame_geometry_5.UpperRight, Anchor=anchor_9)
order_dim_lines = OrderDimLines(DimensionLines=entwine, Distance=Slider(254, range=100..500))
volume_4 = Volume(Geometry=tekla_bounding_box_2)  # -> Volume, Centroid
move_view_to_point_10 = MoveViewToPoint(View=section_view.SectionView, Point=view_frame_geometry_4.UpperLeft, Anchor=anchor_10)
subtraction_2 = Subtraction(A=orient.Geometry, B=deconstruct_plane.Origin)
move_3 = Move(Geometry=find_visible_edges.Edges, Motion=graft_tree_3)  # -> Geometry, Transform
move_4 = Move(Geometry=pull_point.ClosestPoint, Motion=multiplication_3)  # -> Geometry, Transform
dimension_line_attributes = DimensionLineAttributes(ShortDimensionType=0)
move_view_to_point_11 = MoveViewToPoint(View=move_view_to_point_9, Point=view_frame_geometry_5.Origin, Anchor=anchor_12)
line_sdl_3 = LineSDL(Start=volume_4.Centroid, Direction=subtraction_2, Length="1000")
move_view_to_point_12 = MoveViewToPoint(View=move_view_to_point_10, Point=view_frame_geometry_4.Origin, Anchor=anchor_11)
input_type = InputType(View=drawing_view_5, InputValues=move_4.Geometry, Modeling_macro=2)
associative_note = AssociativeNote(
    DrawingObject=graft_tree_2,
    InsertionPoint=volume_3.Centroid,
    PlacingType=placing_type,
    MarkAttributes=mark_attributes,
    Remove_when_input_is_empty=False)
brep_curve = BrepCurve(Brep=tekla_bounding_box_2, Curve=line_sdl_3)  # -> Curves, Points
picker_input = PickerInput(Input=input_type)
dimension_line = DimensionLine(
    View=drawing_view_3,
    Points=find_visible_edges.Points,
    Location=move_3.Geometry,
    DimensionLineAttributes=dimension_line_attributes,
    Insert_always=0,
    Remove_when_input_is_empty=False)
point_display = PointDisplay(
    Point=brep_curve.Points,
    Type=0,
    Remove_when_input_is_empty=True,
    Remove_while_inputs_are_being_modified=False,
    Run_in_background=True,
    ToleranceMm=0.6)
plugin = Plugin(
    View=drawing_view_5,
    Name="RebarGroupDimensionPlugin",
    PickerInput=picker_input,
    AttributesName="standard",
    ObjectsToSelect=graft_tree,
    Remove_when_input_is_empty=False)
shift_paths = ShiftPaths(Data=dimension_line, Offset=-1)
view_properties_10 = ViewProperties(View=drawing_view_2)  # -> Type, Name, ViewCS, DisplayCS, RestrictionBox, Scale, Tags
dimension_link = DimensionLink(DimensionLine=shift_paths, Remove_when_input_is_empty=False)
unit_y_4 = UnitY(Factor=1)
simple_orient_8 = SimpleOrient(Geometry=brep_curve.Points, Plane=view_properties_10.DisplayCS)
simple_orient_9 = SimpleOrient(Geometry=line_sdl_3, Plane=view_properties_10.DisplayCS)
angle = Angle(VectorA=simple_orient_9, VectorB=unit_y_4)  # -> Angle, Reflex
degrees = Degrees(Radians=angle.Angle)
panel_10 = Panel(degrees)
symbol_selection = SymbolSelection(File="concrete", Index="96")
panel_11 = Panel("10")
symbol_attributes = SymbolAttributes(AttributesName="TopInForm", SymbolSelection=symbol_selection, Angle=degrees)
flatten_tree_2 = FlattenTree(Tree=simple_orient_8, Path="{0}")
# Insert dimension lines
symbol = Symbol(View=drawing_view_2, Point=flatten_tree_2, SymbolAttributes=symbol_attributes, Remove_when_input_is_empty=False)
