# Grasshopper definition Samples.gh (Grasshopper 1.0.7)
# plug-ins: Grasshopper-Tekla drawing Link 1.1.0, Pufferfish, Anemone, Grasshopper-Tekla Link 2022.1.13

# ---- group: Arrange HD drawing
boolean_toggle = BooleanToggle(False)
initialize = Button()
active_drawing = ActiveDrawing(BooleanTrigger=initialize)
drawing_size = DrawingSize(Drawing=active_drawing)  # -> Width, Height
views_at_drawing = ViewsAtDrawing(Drawing=active_drawing)
offset_from_left = Panel("20")
offset_from_top = Panel("45")
offset_from_bottom = Panel("10")
offset_from_left_2 = Panel("20")
subtraction = Subtraction(A=drawing_size.Height, B=offset_from_top)
construct_point = ConstructPoint(XCoordinate=offset_from_left_2, YCoordinate=offset_from_bottom, ZCoordinate=0)
construct_point_2 = ConstructPoint(XCoordinate=offset_from_left, YCoordinate=subtraction, ZCoordinate=0)
view_type = Panel("TopView")
view_type_2 = Panel("SectionView")
move_by_anchoring_to_bottom_left = MoveByAnchoringToBottomLeft(view=views_at_drawing, destination=construct_point, member=view_type_2)
move_by_anchoring_to_top_left = MoveByAnchoringToTopLeft(view=views_at_drawing, destination=construct_point_2, member=view_type)
panel = Panel(move_by_anchoring_to_top_left)
view_frame_geometry = ViewFrameGeometry(View=move_by_anchoring_to_bottom_left)  # -> UpperLeft, UpperRight, LowerLeft, LowerRight, Width, Height, Origin
view_type_3 = Panel("_3DView")
move_by_anchoring_to_bottom_left_2 = MoveByAnchoringToBottomLeft(view=views_at_drawing, destination=view_frame_geometry.LowerRight, member=view_type_3)

# ---- group: Loop over drawing list selection
# Anemone component
boolean_toggle_2 = BooleanToggle(False)
selected_drawings_on_list = SelectedDrawingsOnList(BooleanTrigger=boolean_toggle_2)
clean_tree = CleanTree(RemoveNulls=True, RemoveInvalid=True, RemoveEmpty=False, Tree=selected_drawings_on_list)
list_length = ListLength(List=clean_tree)
subtraction_2 = Subtraction(A=list_length, B=1)
loop_start = LoopStart(Repeat=subtraction_2, Data=clean_tree)  # -> port, Counter, Data
list_item = ListItem(List=loop_start.Data, Index=loop_start.Counter, Wrap=True)
change_openings_on_top_view = ChangeOpeningsOnTopView(drawing=list_item)
stream_filter = StreamFilter(Gate=change_openings_on_top_view, Stream1=loop_start.Data)
loop_end = LoopEnd(port=loop_start.port, Exit=False, Data=stream_filter, TimeOutVal=0, pausedState=False, state="Last & Record")

# ---- group: Run macro on selected drawing
# Right click to
# change the mode
boolean_toggle_3 = BooleanToggle(False)
initialize_2 = Button()
selected_drawings_on_list_2 = SelectedDrawingsOnList(BooleanTrigger=initialize_2)
index = Panel("0")
list_item_2 = ListItem(List=selected_drawings_on_list_2, Index=index, Wrap=True)
open_drawing = OpenDrawing(Drawing=list_item_2, Show=True)
views_at_drawing_2 = ViewsAtDrawing(Drawing=open_drawing)
type_of_needed_view = Panel("TopView")
view_properties = ViewProperties(View=views_at_drawing_2)  # -> Type, Name
member_index = MemberIndex(Set=view_properties.Type, Member=type_of_needed_view)  # -> Index, Count
list_item_3 = ListItem(List=views_at_drawing_2, Index=member_index.Index, Wrap=True)
select_object = SelectObject(DrawingObject=list_item_3)
macro = Panel("""#pragma warning disable 1633 // Unrecognized #pragma directive
#pragma reference "Tekla.Macros.Akit"
#pragma reference "Tekla.Macros.Runtime"
#pragma warning restore 1633 // Unrecognized #pragma directive

namespace UserMacros {
    public sealed class Macro {
        [Tekla.Macros.Runtime.MacroEntryPointAttribute()]
        public static void Run(Tekla.Macros.Runtime.IMacroRuntime runtime) {
            Tekla.Macros.Akit.IAkitScriptHost akit = runtime.Get<Tekla.Macros.Akit.IAkitScriptHost>();
            akit.Callback("acmd_display_selected_drawing_object_dialog", "", "View_10 window_1");
            akit.TabChange("view_dial", "tabWndViewAttributes", "tabAttributes2");
            akit.ValueChange("view_dial", "optViewOpenings", "1");
            akit.PushButton("view_modify", "view_dial");
            akit.PushButton("view_cancel", "view_dial");
        }
    }
}""")
null_item = NullItem(Item=select_object)  # -> NullFlags, InvalidFlags, Description
invert_boolean = InvertBoolean(Boolean=null_item.NullFlags)  # -> Inverted, Number
run_macro = RunMacro(Run=invert_boolean.Inverted, Macro=macro, Modeling_macro=2)
stream_filter_2 = StreamFilter(Gate=run_macro, Stream1=open_drawing)
close_drawing = CloseDrawing(Drawing=stream_filter_2, Save=True)
panel_2 = Panel(close_drawing)

# ---- group: Create CU drawing and add detail views
model_object = ModelObject(
    ModelID="Sweden start model.db1",
    ModelObjectInfos="Tekla.Structures.Model.Assembly, Tekla.Structures.Model, Version=2022.0.0.0, Culture=neutral, PublicKeyToken=2f04dbe497b71114;8b6e4a13-144b-4dd7-8bba-46410389230b")
get_assembly = GetAssembly(TeklaObject=model_object, Level=0)
create_cu_drawing = CreateCUDrawing(CastUnit=get_assembly, Attributes="Vägg-VL")
open_drawing_2 = OpenDrawing(Drawing=create_cu_drawing, Show=True)
views_at_drawing_3 = ViewsAtDrawing(Drawing=open_drawing_2)
drawing_source = DrawingSource(Drawing=open_drawing_2)
view_properties_2 = ViewProperties(View=views_at_drawing_3)  # -> Type, Name
source_view = Panel("FrontView")
deconstruct_assembly = DeconstructAssembly(Assembly=drawing_source)  # -> Name, Type, MainPart, Secondaries, AllObjects
member_index_2 = MemberIndex(Set=view_properties_2.Type, Member=source_view)  # -> Index, Count
subassembly_for_detail = Panel("""SUMO16H
SUMO20H
SUMO24H""")
deconstruct_assembly_2 = DeconstructAssembly(Assembly=deconstruct_assembly.Secondaries)  # -> Name, Type, MainPart, Secondaries, AllObjects
list_item_4 = ListItem(List=views_at_drawing_3, Index=member_index_2.Index, Wrap=True)
create_set = CreateSet(List=deconstruct_assembly_2.Name)  # -> Set, Map
set_intersection = SetIntersection(SetA=subassembly_for_detail, SetB=create_set.Set)
member_index_3 = MemberIndex(Set=deconstruct_assembly_2.Name, Member=set_intersection)  # -> Index, Count
list_item_5 = ListItem(List=member_index_3.Index, Index=0, Wrap=True)  # -> flatten(Item)
list_item_6 = ListItem(List=deconstruct_assembly.Secondaries, Index=list_item_5, Wrap=True)
detail_label_offset = Panel("500")
get_cog = GetCOG(GravityObject=list_item_6)
vector_xyz = VectorXYZ(XComponent=detail_label_offset, YComponent=detail_label_offset, ZComponent=0)  # -> Vector, Length
point_to_view = PointToView(Point=get_cog, View=list_item_4)
addition = Addition(A=point_to_view, B=vector_xyz.Vector)
list_length_2 = ListLength(List=addition)
detail_names = Panel("""A
B
C
D
E
F
G
H
I
J
K
L
M
N
O
P
Q
R
S
T
U
V
W
X
Y
Z""")
construct_point_3 = ConstructPoint(XCoordinate=0, YCoordinate=0, ZCoordinate=0)
detail_attribute_name = Panel("2D Detail with label")
split_list = SplitList(List=detail_names, Index=list_length_2)  # -> ListA, ListB
detail_view = DetailView(
    View=list_item_4,
    CenterPoint=point_to_view,
    LabelPoint=addition,
    InsertionPoint=construct_point_3,
    Radius=500,
    ViewAttributes=detail_attribute_name,
    MarkAttributes="standard",
    Name=split_list.ListA)  # -> View, Mark

# ---- group: Arrange detail views horizontally
drawing_point = DrawingPoint(null)
null_item_2 = NullItem(Item=drawing_point)  # -> NullFlags, InvalidFlags, Description
invert_boolean_2 = InvertBoolean(Boolean=null_item_2.NullFlags)  # -> Inverted, Number
gate_and = GateAnd(A=Toggle(False), B=invert_boolean_2.Inverted)
active_drawing_2 = ActiveDrawing(BooleanTrigger=gate_and)
views_at_drawing_4 = ViewsAtDrawing(Drawing=active_drawing_2)
view_properties_3 = ViewProperties(View=views_at_drawing_4)  # -> Type, Name
type_of_view = Panel("DetailView")
member_index_4 = MemberIndex(Set=view_properties_3.Type, Member=type_of_view)  # -> Index, Count
list_item_7 = ListItem(List=views_at_drawing_4, Index=member_index_4.Index, Wrap=True)
view_properties_4 = ViewProperties(View=list_item_7)  # -> Type, flatten(Name)
sort_text = SortText(Keys=view_properties_4.Name, Values=list_item_7, Culture=127)  # -> Keys, Values
deconstruct = Deconstruct(Point=drawing_point)  # -> XComponent, YComponent, ZComponent
view_frame_geometry_2 = ViewFrameGeometry(View=sort_text.Values)  # -> UpperLeft, UpperRight, LowerLeft, LowerRight, Width, Height, Origin
deconstruct_2 = Deconstruct(Point=view_frame_geometry_2.LowerLeft)  # -> XComponent, YComponent, ZComponent
mass_addition = MassAddition(Input=view_frame_geometry_2.Width)  # -> Result, PartialResults
list_item_8 = ListItem(List=view_frame_geometry_2.Width, Index=0, Wrap=True)
subtraction_3 = Subtraction(A=deconstruct.XComponent, B=deconstruct_2.XComponent)
subtraction_4 = Subtraction(A=deconstruct.YComponent, B=deconstruct_2.YComponent)
subtraction_5 = Subtraction(A=mass_addition.PartialResults, B=list_item_8)
addition_2 = Addition(A=subtraction_5, B=subtraction_3)
vector_xyz_2 = VectorXYZ(XComponent=addition_2, YComponent=subtraction_4, ZComponent=0)  # -> Vector, Length
move_view = MoveView(View=sort_text.Values, Vector=vector_xyz_2.Vector)

# ----
initialize_3 = Button()

# ---- group: Create detail views
boolean_toggle_4 = BooleanToggle(False)
active_drawing_3 = ActiveDrawing(BooleanTrigger=initialize_3)
views_at_drawing_5 = ViewsAtDrawing(Drawing=active_drawing_3)
drawing_source_2 = DrawingSource(Drawing=active_drawing_3)
view_properties_5 = ViewProperties(View=views_at_drawing_5)  # -> Type, Name
source_view_2 = Panel("FrontView")
deconstruct_assembly_3 = DeconstructAssembly(Assembly=drawing_source_2)  # -> Name, Type, MainPart, Secondaries, AllObjects
member_index_5 = MemberIndex(Set=view_properties_5.Type, Member=source_view_2)  # -> Index, Count
subassembly_for_detail_2 = Panel("""SUMO16H
SUMO20H
SUMO24H""")
deconstruct_assembly_4 = DeconstructAssembly(Assembly=deconstruct_assembly_3.Secondaries)  # -> Name, Type, MainPart, Secondaries, AllObjects
list_item_9 = ListItem(List=views_at_drawing_5, Index=member_index_5.Index, Wrap=True)
create_set_2 = CreateSet(List=deconstruct_assembly_4.Name)  # -> Set, Map
set_intersection_2 = SetIntersection(SetA=subassembly_for_detail_2, SetB=create_set_2.Set)
member_index_6 = MemberIndex(Set=deconstruct_assembly_4.Name, Member=set_intersection_2)  # -> Index, Count
list_item_10 = ListItem(List=member_index_6.Index, Index=0, Wrap=True)  # -> flatten(Item)
list_item_11 = ListItem(List=deconstruct_assembly_3.Secondaries, Index=list_item_10, Wrap=True)
detail_label_offset_2 = Panel("500")
get_cog_2 = GetCOG(GravityObject=list_item_11)
vector_xyz_3 = VectorXYZ(XComponent=detail_label_offset_2, YComponent=detail_label_offset_2, ZComponent=0)  # -> Vector, Length
point_to_view_2 = PointToView(Point=get_cog_2, View=list_item_9)
addition_3 = Addition(A=point_to_view_2, B=vector_xyz_3.Vector)
list_length_3 = ListLength(List=addition_3)
detail_names_2 = Panel("""A
B
C
D
E
F
G
H
I
J
K
L
M
N
O
P
Q
R
S
T
U
V
W
X
Y
Z""")
construct_point_4 = ConstructPoint(XCoordinate=0, YCoordinate=0, ZCoordinate=0)
detail_attribute_name_2 = Panel("2D Detail with label")
split_list_2 = SplitList(List=detail_names_2, Index=list_length_3)  # -> ListA, ListB
detail_view_2 = DetailView(
    View=list_item_9,
    CenterPoint=point_to_view_2,
    LabelPoint=addition_3,
    InsertionPoint=construct_point_4,
    Radius=500,
    ViewAttributes=detail_attribute_name_2,
    MarkAttributes="standard",
    Name=split_list_2.ListA)  # -> View, Mark

# ==== cluster ChangeOpeningsOnTopView
drawing = ClusterInput()

# ---- group: Run macro on selected drawing
# Right click to
# change the mode
open_drawing = OpenDrawing(Drawing=drawing, Show=True)
views_at_drawing = ViewsAtDrawing(Drawing=open_drawing)
type_of_needed_view = Panel("TopView")
view_properties = ViewProperties(View=views_at_drawing)  # -> Type, Name
member_index = MemberIndex(Set=view_properties.Type, Member=type_of_needed_view)  # -> Index, Count
list_item = ListItem(List=views_at_drawing, Index=member_index.Index, Wrap=True)
select_object = SelectObject(DrawingObject=list_item)
macro = Panel("""#pragma warning disable 1633 // Unrecognized #pragma directive
#pragma reference "Tekla.Macros.Akit"
#pragma reference "Tekla.Macros.Runtime"
#pragma warning restore 1633 // Unrecognized #pragma directive

namespace UserMacros {
    public sealed class Macro {
        [Tekla.Macros.Runtime.MacroEntryPointAttribute()]
        public static void Run(Tekla.Macros.Runtime.IMacroRuntime runtime) {
            Tekla.Macros.Akit.IAkitScriptHost akit = runtime.Get<Tekla.Macros.Akit.IAkitScriptHost>();
            akit.Callback("acmd_display_selected_drawing_object_dialog", "", "View_10 window_1");
            akit.TabChange("view_dial", "tabWndViewAttributes", "tabAttributes2");
            akit.ValueChange("view_dial", "optViewOpenings", "0");
            akit.PushButton("view_modify", "view_dial");
            akit.PushButton("view_cancel", "view_dial");
        }
    }
}""")
null_item = NullItem(Item=select_object)  # -> NullFlags, InvalidFlags, Description
invert_boolean = InvertBoolean(Boolean=null_item.NullFlags)  # -> Inverted, Number
run_macro = RunMacro(Run=invert_boolean.Inverted, Macro=macro, Modeling_macro=2)
stream_filter = StreamFilter(Gate=run_macro, Stream1=open_drawing)
close_drawing = CloseDrawing(Drawing=stream_filter, Save=True)

# ----
result = ClusterOutput(close_drawing)

# ==== cluster MoveByAnchoringToTopLeft
view = ClusterInput()
view_properties = ViewProperties(View=view)  # -> Type, Name
member = ClusterInput()
member_index = MemberIndex(Set=view_properties.Type, Member=member)  # -> Index, Count
list_item = ListItem(List=view, Index=member_index.Index, Wrap=True)
view_frame_geometry = ViewFrameGeometry(View=list_item)  # -> UpperLeft, UpperRight, LowerLeft, LowerRight, Width, Height, Origin
destination = ClusterInput()
subtraction = Subtraction(Destination=destination, Actual=view_frame_geometry.UpperLeft)
move_view = MoveView(View=list_item, Vector=subtraction)
view_2 = ClusterOutput(move_view)

# ==== cluster MoveByAnchoringToBottomLeft
view = ClusterInput()
view_properties = ViewProperties(View=view)  # -> Type, Name
member = ClusterInput()
member_index = MemberIndex(Set=view_properties.Type, Member=member)  # -> Index, Count
list_item = ListItem(List=view, Index=member_index.Index, Wrap=True)
view_frame_geometry = ViewFrameGeometry(View=list_item)  # -> UpperLeft, UpperRight, LowerLeft, LowerRight, Width, Height, Origin
destination = ClusterInput()
subtraction = Subtraction(Destination=destination, Actual=view_frame_geometry.LowerLeft)
move_view = MoveView(View=list_item, Vector=subtraction)
view_2 = ClusterOutput(move_view)
